# Grasshopper definition imageToPattern.gh (Grasshopper 1.0.7)
# plug-ins: Human

file_path = FilePath("F:\GSD\jose\images\George Maciunas.png")
imgdiv = Slider(40, range=0..100)
file_path_2 = FilePath("/Users/karenkuo/file/Spring 2023/jose/final/export/hsv-mosaic.png")
panel = Panel(file_path_2)

# ---- group: display image
import_image = ImportImage(File=file_path_2)

# ---- group: RGB, HSV, Pixel
ghpython_script = GhPythonScript(file=file_path_2, imgDiv=imgdiv)  # -> out, coRGB, coHSV, coH, pt, pixelX, pixelY, xloop, yloop; inputs imgDiv: Int32
# ---------- ghpython_script: Python ----------
__author__ = "kalunkuo"
__version__ = "2023.04.08"

import rhinoscriptsyntax as rs
import System
import math
import os

# reference: https://learn.microsoft.com/en-us/dotnet/api/system.drawing.color?view=net-7.0&viewFallbackFrom=windowsdesktop-8.0
#previewTemp = rs.CreatePreviewImage(file)
#previewImg = previewTemp

# import file
fileTest = "C:\\Users\\kalunkuo\\Desktop\\test2.jpg"
image = System.Drawing.Image.FromFile(file)
bitmap = System.Drawing.Bitmap.FromFile(file)
width = bitmap.Width
height = bitmap.Height
print("file path: ", file)
print("image width: ", width, "image height: ", height)

# list of RGB colors
listRGB = [] 
listHSV = []
listPt = []
listH = []

# convert RGB to HSV
def rgb_to_hsv(r, g, b):
    r, g, b = r/255.0, g/255.0, b/255.0
    mx = max(r, g, b)
    mn = min(r, g, b)
    df = mx-mn
    if mx == mn:
        h = 0
    elif mx == r:
        h = (60 * ((g-b)/df) + 360) % 360
    elif mx == g:
        h = (60 * ((b-r)/df) + 120) % 360
    elif mx == b:
        h = (60 * ((r-g)/df) + 240) % 360
    if mx == 0:
        s = 0
    else:
        s = (df/mx)*100
    v = mx*100
    return h, s, v

pixXTemp = int(round(width / imgDiv, 0))
pixYTemp = int(round(height / imgDiv, 0))
pixX = width / pixXTemp
pixY = height / pixYTemp
print(pixX, pixY, pixXTemp, pixYTemp, pixXTemp*pixX, pixYTemp*pixY)


for i in range(pixXTemp):
    for j in range(pixYTemp):
        pixelTempX = pixX*(i)
        pixelTempY = pixY*(pixYTemp-j-1)
        
    
    
        ptCor = (pixelTempX, pixelTempY, 0)
        ptTemp = rs.AddPoint(ptCor)
        listPt.append(ptTemp)
        
        print(pixelTempX, pixelTempY)
        colorX = pixX*(i)
        colorY = pixY*(j)
        coRGB =  System.Drawing.Bitmap.GetPixel(bitmap, colorX, colorY)
        listRGB.append(coRGB)
        # print(coRGB[0])
        
        coHSV = rgb_to_hsv(coRGB[0], coRGB[1], coRGB[2])
        listHSV.append(coHSV)
        listH.append(coHSV[0])
        


# output
coRGB = listRGB
coHSV = listHSV
pt = listPt
pixelX = pixX
pixelY = pixY
xloop = pixXTemp
yloop = pixYTemp
coH = listH
# ---------- end ghpython_script ----------

# ---- group: display H + V value
ghpython_script_2 = GhPythonScript(x=ghpython_script.coHSV)  # -> out, h, v; inputs x: list
# ---------- ghpython_script_2: Python ----------
__author__ = "karenkuo"

import rhinoscriptsyntax as rs

listH = []
listV = []

for i in range(len(x)):
    listH.append(round(x[i][0]))
    listV.append(round(x[i][2]))
    
h = listH
v = listV
# ---------- end ghpython_script_2 ----------
font_table = FontTable()
panel_2 = Panel(font_table)
list_item = ListItem(List=font_table, Index=Slider(157, range=0..1000), Wrap=True)
screen_oriented_text = ScreenOrientedText(
    Text=ghpython_script_2.v,
    Font=list_item,
    Justification=5,
    Location=ghpython_script.pt,
    SizeFactor=Slider(20, range=0..50),
    Color=ColourSwatch(SwatchColor=RGB(255, 255, 255)),
    Depth=0,
    Absolute=False)  # disabled

# ---- group: pt
point = Point(ghpython_script.pt)

# ----
scalemax = Slider(0.99, range=0.01..3)
scalemin = Slider(0.1, range=0.01..1)
hsvdiv = Slider(10, range=0..10)
ghpython_script_3 = GhPythonScript(
    coHSV=ghpython_script.coHSV,
    pt=point,
    pixelX=ghpython_script.pixelX,
    pixelY=ghpython_script.pixelY,
    hsvDiv=hsvdiv,
    scaleMin=scalemin,
    scaleMax=scalemax,
    xloop=ghpython_script.xloop,
    yloop=ghpython_script.yloop)  # -> out, hatch; inputs coHSV: list, pt: list, hsvDiv: Int32, xloop: Int32, yloop: Int32
# ---------- ghpython_script_3: Python ----------
__author__ = "kalunkuo"
__version__ = "2023.04.12"

import rhinoscriptsyntax as rs
import System
import math
import os

import Rhino
import Grasshopper
import GhPython
import ghpythonlib.components as ghcomp
import scriptcontext as sc


listHSV = [[] for i in xrange(hsvDiv)]
# print(listHSV)

# split lists into buckets based on H value
for i in range(hsvDiv):
    loTemp = i*60
    hiTemp = i*60 + 60
    # print("Low and high H range is: ", loTemp, hiTemp)
    for j in range(len(coHSV)):
        if(coHSV[j][0] >= loTemp and coHSV[j][0] < hiTemp):
            listHSV[i].append(coHSV[j])

# find min and max V value from each list
listVMin = []
listVMax = []

for i in range(len(listHSV)):
    print(len(listHSV[i]))
    if (len(listHSV[i]) > 0):
        
        listVTemp = []
        for j in range(len(listHSV[i])):
            V = listHSV[i][j][2]
            listVTemp.append(V)
            
        minV = min(listVTemp)
        listVMin.append(minV)
        
        maxV = max(listVTemp)
        listVMax.append(maxV)
        
    else:
        listVMin.append(0)
        listVMax.append(255)

# print(listVMin, listVMax)

def map_value(in_v, in_min, in_max, out_min, out_max):
     
    if ((in_max - in_min)!= 0):
        v = (in_v - in_min) * (out_max - out_min) / (in_max - in_min) + out_min
    else:
        v = out_min
    
    if v < out_min: 
        v = out_min 
    elif v > out_max: 
        v = out_max
    return v

# make hatch
def _hatch(_pt, _index, _len, _list, _hVal):
    # pt = rs.AddPoint(_pt[0], _pt[1], _pt[2])
    ptCor = rs.PointCoordinates(_pt)
    px = ptCor[0]
    py = ptCor[1]
    pz = ptCor[2]
    
    #pLT   pT   pTR 
    # pL   pC   pR
    # pBL   pB   pRB
    
    pC = rs.coerce3dpoint(_pt)
    pCT = rs.coerce3dpoint(rs.AddPoint(px, py+_len*0.01, pz))
    pCL = rs.coerce3dpoint(rs.AddPoint(px-_len*0.01, py, pz))
    pCB = rs.coerce3dpoint(rs.AddPoint(px, py-_len*0.01, pz))
    pCR = rs.coerce3dpoint(rs.AddPoint(px+_len*0.01, py, pz))
    
    pT = rs.coerce3dpoint(rs.AddPoint(px, py+_len, pz))
    pR = rs.coerce3dpoint(rs.AddPoint(px+_len, py, pz))
    pB = rs.coerce3dpoint(rs.AddPoint(px, py-_len, pz))
    pL = rs.coerce3dpoint(rs.AddPoint(px-_len, py, pz))
    
    pTR = rs.coerce3dpoint(rs.AddPoint(px+_len, py+_len, pz))
    pRB = rs.coerce3dpoint(rs.AddPoint(px+_len, py-_len, pz))
    pBL = rs.coerce3dpoint(rs.AddPoint(px-_len, py-_len, pz))
    pLT = rs.coerce3dpoint(rs.AddPoint(px-_len, py+_len, pz))
    

    
    # 0 red to yellow
    if(_index == 0):
        t1 = Rhino.Geometry.Polyline([pCL, pLT, pCT, pTR, pCR, pRB, pCB, pBL, pCL])
        t2 = Rhino.Geometry.Polyline([pCL, pLT, pT, pTR, pCR,pRB, pB, pBL, pCL])
        
        scale = map_value(_hVal, _index*60, (_index+1)*60, 0, 1)
        transform = ghcomp.TweenCurve(t1, t2, scale)
        _list.append(transform)
        # print(t1, t2, scale, transform)
    
    # 1 yellow to green
    if(_index == 1):
        #t1 = Rhino.Geometry.Polyline([pCL, pLT, pT, pTR, pCR,pRB, pB, pBL, pCL])
        t1 = Rhino.Geometry.Polyline([pCR, pTR,pLT,pCL,pBL,pRB,pCR])

        pt = rs.coerce3dpoint(_pt)
        t2 = Rhino.Geometry.Circle(pt, _len)
        
        scale = map_value(_hVal, _index*60, (_index+1)*60, 0, 1)
        transform = ghcomp.TweenCurve(t1, t2, scale)
        _list.append(transform)
        
    # 2 green to cyan
    if(_index == 2):
        pt = rs.coerce3dpoint(_pt)
        t1 = Rhino.Geometry.Circle(pt, _len)
        t2 = Rhino.Geometry.Polyline([pTR, pRB,pL, pTR])
        
        scale = map_value(_hVal, _index*60,(_index+1)*60, 0, 1)
        transform = ghcomp.TweenCurve(t1, t2, scale)
        _list.append(transform)
        
    # 3 cyan to blue
    if(_index == 3):
        t1 = Rhino.Geometry.Polyline([pTR, pRB,pL, pTR])
        t2 = Rhino.Geometry.Polyline([pLT, pTR, pRB, pBL, pLT])
        
        scale = map_value(_hVal, _index*60,(_index+1)*60, 0, 1)
        transform = ghcomp.TweenCurve(t1, t2, scale)
        _list.append(transform)
        
        
    # 4 blue to magenta
    if(_index == 4):
        t1 = Rhino.Geometry.Polyline([pLT, pTR, pRB, pBL, pLT])
        t2 = Rhino.Geometry.Polyline([pT, pR,pB, pL,  pT])
        
        scale = map_value(_hVal, _index*60, (_index+1)*60, 0, 1)
        transform = ghcomp.TweenCurve(t1, t2, scale)
        _list.append(transform)
        
        

    # 5 magenta to red
    if(_index == 5):
        t1 = Rhino.Geometry.Polyline([pT, pR,pB, pL,  pT])
        #t2 = Rhino.Geometry.Polyline([pCL, pLT, pCT, pTR, pCR, pRB, pCB, pBL, pCL])
        t2 = Rhino.Geometry.Polyline([pCL, pLT, pCT, pTR, pCR, pRB, pCB, pBL, pCL])

        
        scale = map_value(_hVal,_index*60, (_index+1)*60, 0, 1)
        transform = ghcomp.TweenCurve(t1, t2, scale)
        _list.append(transform)
        


listHatch = []
for i in range(len(coHSV)):
    H = float(coHSV[i][0])
    V = float(coHSV[i][2])
    
    index = int(math.floor(H/60))
    # print(index)
    
    minTemp = listVMin[index]
    maxTemp = listVMax[index]
    
    val = map_value(V, minTemp, maxTemp, scaleMin, scaleMax)
    # val = map_value(V, maxTemp, minTemp, scaleMin, scaleMax)
        
    '''
    if((maxTemp-minTemp)!= 0):
        valScale = (scaleMax-scaleMin)/(maxTemp-minTemp)
        valOffset = -minTemp*(scaleMax-scaleMin)/(maxTemp-minTemp) + scaleMin
        val = V*valScale + valOffset
        scale = (pixelX/2)*val
    else:
        scale = (pixelX/2)*scaleMin
    '''
    # print(H, index, pt[i])
    
    scale = (pixelX/2)*val
    print(index)
    _hatch(pt[i], index, scale, listHatch, H)
        
        


def _addPt(_pt):
    ptCor = rs.PointCoordinates(_pt)
    px = ptCor[0]
    py = ptCor[1]
    pz = ptCor[2]
    
    pT = rs.AddPoint(px, py+_len, pz)
    pR = rs.AddPoint(px+_len, py, pz)
    pB = rs.AddPoint(px, py-_len, pz)
    pL = rs.AddPoint(px-_len, py, pz)
    
    pTR = rs.AddPoint(px+_len, py+_len, pz)
    pRB = rs.AddPoint(px+_len, py-_len, pz)
    pBL = rs.AddPoint(px-_len, py-_len, pz)
    pLT = rs.AddPoint(px-_len, py+_len, pz)
    
    return pT, pR, pB, pL, pTR, pRB, pBL, pLT

# output
# list = listHSV
hatch = listHatch
# ---------- end ghpython_script_3 ----------

# ---- group: display Rectangle
division = Division(A=ghpython_script.pixelY, B="-2")
division_2 = Division(A=ghpython_script.pixelX, B="-2")
vector_xyz = VectorXYZ(XComponent=division_2, YComponent=division, ZComponent=0)  # -> Vector, Length
move = Move(Geometry=ghpython_script.pt, Motion=vector_xyz.Vector)  # -> Geometry, Transform
rectangle = Rectangle(Plane=move.Geometry, XSize=ghpython_script.pixelX, YSize=ghpython_script.pixelY, Radius=0)  # -> Rectangle, Length
custom_preview_lineweights = CustomPreviewLineweights(
    Geometry=rectangle.Rectangle,
    Shader=ColourSwatch(SwatchColor=RGB(255, 255, 255)),
    Thickness=Slider(2, range=0..10),
    Absolute=False)

# ----
ghpython_script_4 = GhPythonScript(x=ghpython_script.coHSV)  # -> out, a; inputs x: list
# ---------- ghpython_script_4: Python ----------
__author__ = "karenkuo"

import rhinoscriptsyntax as rs


vList = []

for i in range(len(x)):
    vList.append(x[i][2]+10)

a = vList
# ---------- end ghpython_script_4 ----------
ghpython_script_5 = GhPythonScript(
    vVal=ghpython_script_4.a,
    pixelX=ghpython_script.pixelX,
    pixelY=ghpython_script.pixelY,
    min=Slider(0.01, range=0..1),
    max=Slider(8.424, range=0..20))  # -> out, weight; inputs vVal: list
# ---------- ghpython_script_5: Python ----------
__author__ = "karenkuo"

import rhinoscriptsyntax as rs




def map_value(in_v, in_min, in_max, out_min, out_max):
     
    v = (in_v - in_min) * (out_max - out_min) / (in_max - in_min) + out_min
    
    if v < out_min: 
        v = out_min 
    elif v > out_max: 
        v = out_max
    return v

lineWeightList = []

for i in range(len(vVal)):
    print(vVal[i])
    lineWeightList.append(map_value(vVal[i], 0.0, 255.0, min, max))

weight = lineWeightList
# ---------- end ghpython_script_5 ----------
panel_3 = Panel(ghpython_script_5.weight)
boolean_toggle = BooleanToggle(True)
custom_preview_lineweights_2 = CustomPreviewLineweights(
    Geometry=ghpython_script_3.hatch,
    Shader=ColourSwatch(SwatchColor=RGB(255, 255, 255)),
    Thickness=ghpython_script_5.weight,
    Absolute=boolean_toggle)  # disabled

custom_preview_lineweights_3 = CustomPreviewLineweights(
    Geometry=ghpython_script_3.hatch,
    Shader=ColourSwatch(SwatchColor=RGB(255, 255, 255)),
    Thickness=Slider(2, range=0..10),
    Absolute=boolean_toggle)  # disabled

# ---- group: v value
ghpython_script_6 = GhPythonScript(x=ghpython_script.coHSV)  # -> out, a; inputs x: list
# ---------- ghpython_script_6: Python ----------
__author__ = "karenkuo"

import rhinoscriptsyntax as rs

list = []

for i in range(len(x)):
#    obj = (255, 255, int(x[i][2]))
    obj = x[i][2]
    list.append(obj)

a = list
# ---------- end ghpython_script_6 ----------

# ---- group: hatch pattern test
number_slider = Slider(3, range=0..5)
curve = Curve(<curve referenced from the Rhino model>)
curve_2 = Curve([<curve referenced from the Rhino model> x9])
point_2 = Point(Point(5, 5, 0))
curve_3 = Curve(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)
point_3 = Point([Point(0, 20, 0), Point(10, 20, 0), Point(20, 20, 0), Point(30, 20, 0), Point(40, 20, 0), Point(50, 20, 0), Point(0, 30, 0), Point(10, 30, 0), Point(20, 30, 0), Point(30, 30, 0)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])
curve_4 = Curve([<curve referenced from the Rhino model> x9])
curve_5 = Curve([<curve referenced from the Rhino model> x4])
group = Group(Objects=curve_4)
group_2 = Group(Objects=curve)
group_3 = Group(Objects=curve_5)
group_4 = Group(Objects=curve_2)
merge = Merge(Data1=group, Data2=group_2, Data3=group_3, Data4=group_4)

# ---- group: hatch pattern test / hatch maker
ghpython_script_7 = GhPythonScript(pt=point_2, boundary=curve_3, ptList=point_3, index=number_slider, input=merge)  # -> out, a; inputs ptList: list, index: Int32, input: list; disabled
# ---------- ghpython_script_7: Python ----------
__author__ = "kalunkuo"
__version__ = "2023.04.15"

import rhinoscriptsyntax as rs

hatchCor = rs.PointCoordinates(pt)
print(hatchCor)

listMove = []

print("dim: ", rs.CurveDim(boundary))


for i in range(len(ptList)):
    
    
    ptCor = rs.PointCoordinates(ptList[i])
    translation = ptCor - hatchCor
    print("ptCor: ", ptCor)
    print("translation: ", translation)
    
    for j in range(len(input[index])):
        copyObj = rs.CopyObject(input[index][j])
        scaleObj = rs.ScaleObject(copyObj, pt, (0.8, 0.8, 0.8), False)
        moveObj = rs.MoveObject(scaleObj, translation)
        listMove.append(moveObj)

a = listMove
# ---------- end ghpython_script_7 ----------

# ---- group: hatch pattern test (continued)
curve_6 = Curve(ghpython_script_7.a)

# ----
geometry = Geometry(ghpython_script_3.hatch)
panel_4 = Panel(ghpython_script_6.a)
bnd = Bounds(Numbers=panel_4)
dom = ConstructDomain(DomainStart="1", DomainEnd="0")
remap = RemapNumbers(Value=panel_4, Source=bnd, Target=dom)  # -> Mapped, Clipped
panel_5 = Panel(remap.Mapped)
number_slider_2 = Slider(0, range=0..1)
graph = GraphMapper(
    remap.Mapped,
    x0=0,
    x1=1,
    y0=0,
    y1=1,
    container_name="Bezier",
    cpx=[0, 0.1533873677, 0.3921190798, 1],
    cpy=[1, 0.4590001106, 0.288629353, 0.1870963573])
hsv = ColourHSV(Alpha=1, Hue=number_slider_2, Saturation=number_slider_2, Value=graph)

# ---- group: surface
surface = Surface(geometry)

# ----
ghpython_script_8 = GhPythonScript(x=ghpython_script.coHSV)  # -> out, a; inputs x: list; same code as ghpython_script_4
ghpython_script_9 = GhPythonScript(
    vVal=ghpython_script_8.a,
    pixelX=ghpython_script.pixelX,
    pixelY=ghpython_script.pixelY,
    min=Slider(0, range=0..1),
    max=Slider(1, range=0..10))  # -> out, weight; inputs vVal: list; same code as ghpython_script_5
number_slider_3 = Slider(0, range=0..1)
hsv_2 = ColourHSV(Alpha=1, Hue=number_slider_3, Saturation=number_slider_3, Value=ghpython_script_9.weight)
custom_preview = CustomPreview(Geometry=surface, Material=hsv_2)  # disabled

custom_preview_2 = CustomPreview(Geometry=surface, Material=hsv)  # disabled
