# Grasshopper definition 0_pendulum.gh (Grasshopper 1.0.7)

time_step = Slider(0.1, range=0..0.1)
count = Slider(500, range=0..10000)
delta_t = Slider(0.1, range=0..0.1)
freq1 = Slider(7.948, range=0..10)
mag1 = Slider(1, range=0..10)
phase1 = Slider(0.179, range=0..1)
phase2 = Slider(0.15, range=0..1)
degree = Slider(1, range=0..10)
freq2 = Slider(2, range=0..10)
mag2 = Slider(1, range=0..10)
decay1 = Slider(30, range=0..100)
decay2 = Slider(21, range=0..100)
time_step_2 = Slider(0.1, range=0..0.1)
count_2 = Slider(300, range=0..10000)
delta_t_2 = Slider(0.044, range=0..0.1)
freq1_2 = Slider(6.005, range=0..10)
freq2_2 = Slider(1.927, range=0..10)
mag1_2 = Slider(1, range=0..10)
mag2_2 = Slider(1, range=0..10)
decay1_2 = Slider(18, range=0..100)
decay2_2 = Slider(20, range=0..100)
phase1_2 = Slider(0, range=0..1)
phase2_2 = Slider(0.405, range=0..1)
time_step_3 = Slider(0.1, range=0..0.1)
count_3 = Slider(300, range=0..10000)
freq1_3 = Slider(6.005, range=0..10)
mag1_3 = Slider(1, range=0..10)
phase1_3 = Slider(0, range=0..1)
phase2_3 = Slider(0.522, range=0..1)
delta_t_3 = Slider(0.079, range=0..0.1)
freq2_3 = Slider(3.922, range=0..10)
mag2_3 = Slider(1, range=0..10)
decay1_3 = Slider(13, range=0..100)
decay2_3 = Slider(21, range=0..100)
degree_2 = Slider(2, range=0..10)
degree_3 = Slider(2, range=0..10)
time_step_4 = Slider(0.1, range=0..0.1)
count_4 = Slider(500, range=0..10000)
delta_t_4 = Slider(0.072, range=0..0.1)
freq1_4 = Slider(6.005, range=0..10)
freq2_4 = Slider(1.927, range=0..10)
mag1_4 = Slider(1, range=0..10)
mag2_4 = Slider(1, range=0..10)
decay1_4 = Slider(18, range=0..100)
decay2_4 = Slider(20, range=0..100)
phase1_4 = Slider(0, range=0..1)
phase2_4 = Slider(0.452, range=0..1)
degree_4 = Slider(2, range=0..10)
time_step_5 = Slider(0.1, range=0..0.1)
count_5 = Slider(500, range=0..10000)
delta_t_5 = Slider(0.072, range=0..0.1)
freq1_5 = Slider(4.807, range=0..10)
mag1_5 = Slider(1, range=0..10)
mag2_5 = Slider(1, range=0..10)
decay1_5 = Slider(14, range=0..100)
decay2_5 = Slider(20, range=0..100)
phase1_5 = Slider(0, range=0..1)
phase2_5 = Slider(0.068, range=0..1)
freq2_5 = Slider(2.001, range=0..10)
degree_5 = Slider(2, range=0..10)
series = Series(Start="0", Step=time_step, Count=count)
series_2 = Series(Start="0", Step=time_step_2, Count=count_2)
series_3 = Series(Start="0", Step=time_step_3, Count=count_3)
series_4 = Series(Start="0", Step=time_step_4, Count=count_4)
series_5 = Series(Start="0", Step=time_step_5, Count=count_5)
addition = Addition(A=delta_t, B=series)
addition_2 = Addition(A=delta_t_2, B=series_2)
addition_3 = Addition(A=delta_t_3, B=series_3)
addition_4 = Addition(A=delta_t_4, B=series_4)
addition_5 = Addition(A=delta_t_5, B=series_5)
expression = Expression(
    Magnitude=mag2,
    time=addition,
    decay_rate=decay2,
    frequency=freq2,
    PhaseShift=phase2,
    Expression="Magnitude*Exp(-time/decay_rate)*cos(2*π*frequency*time + PhaseShift*time)")
expression_2 = Expression(
    Magnitude=mag1,
    time=addition,
    decay_rate=decay1,
    frequency=freq1,
    PhaseShift=phase1,
    Expression="Magnitude*Exp(-time/decay_rate)*sin(2*π*frequency*time + PhaseShift*time)")
expression_3 = Expression(
    Magnitude=mag2_2,
    time=addition_2,
    decay_rate=decay2_2,
    frequency=freq2_2,
    PhaseShift=phase2_2,
    Expression="Magnitude*Exp(-time/decay_rate)*cos(2*π*frequency*time + PhaseShift*time)")
expression_4 = Expression(
    Magnitude=mag1_2,
    time=addition_2,
    decay_rate=decay1_2,
    frequency=freq1_2,
    PhaseShift=phase1_2,
    Expression="Magnitude*Exp(-time/decay_rate)*sin(2*π*frequency*time + PhaseShift*time)")
expression_5 = Expression(
    Magnitude=mag2_3,
    time=addition_3,
    decay_rate=decay2_3,
    frequency=freq2_3,
    PhaseShift=phase2_3,
    Expression="Magnitude*Exp(-time/decay_rate)*cos(2*π*frequency*time + PhaseShift*time)")
expression_6 = Expression(
    Magnitude=mag1_3,
    time=addition_3,
    decay_rate=decay1_3,
    frequency=freq1_3,
    PhaseShift=phase1_3,
    Expression="Magnitude*Exp(-time/decay_rate)*sin(2*π*frequency*time + PhaseShift*time)")
expression_7 = Expression(
    Magnitude=mag2_4,
    time=addition_4,
    decay_rate=decay2_4,
    frequency=freq2_4,
    PhaseShift=phase2_4,
    Expression="Magnitude*Exp(-time/decay_rate)*cos(2*π*frequency*time + PhaseShift*time)")
expression_8 = Expression(
    Magnitude=mag1_4,
    time=addition_4,
    decay_rate=decay1_4,
    frequency=freq1_4,
    PhaseShift=phase1_4,
    Expression="Magnitude*Exp(-time/decay_rate)*sin(2*π*frequency*time + PhaseShift*time)")
expression_9 = Expression(
    Magnitude=mag2_5,
    time=addition_5,
    decay_rate=decay2_5,
    frequency=freq2_5,
    PhaseShift=phase2_5,
    Expression="Magnitude*Exp(-time/decay_rate)*cos(2*π*frequency*time + PhaseShift*time)")
expression_10 = Expression(
    Magnitude=mag1_5,
    time=addition_5,
    decay_rate=decay1_5,
    frequency=freq1_5,
    PhaseShift=phase1_5,
    Expression="Magnitude*Exp(-time/decay_rate)*sin(2*π*frequency*time + PhaseShift*time)")
construct_point = ConstructPoint(XCoordinate=expression_2, YCoordinate=expression, ZCoordinate=0)
construct_point_2 = ConstructPoint(XCoordinate=expression_4, YCoordinate=expression_3, ZCoordinate=0)
construct_point_3 = ConstructPoint(XCoordinate=expression_6, YCoordinate=expression_5, ZCoordinate=0)
construct_point_4 = ConstructPoint(XCoordinate=expression_8, YCoordinate=expression_7, ZCoordinate=0)
construct_point_5 = ConstructPoint(XCoordinate=expression_10, YCoordinate=expression_9, ZCoordinate=0)
interpolate = Interpolate(Vertices=construct_point, Degree=degree, Periodic=Toggle(False), KnotStyle=1)  # -> Curve, Length, Domain
interpolate_2 = Interpolate(Vertices=construct_point_2, Degree=degree_2, Periodic=Toggle(False), KnotStyle=1)  # -> Curve, Length, Domain
interpolate_3 = Interpolate(Vertices=construct_point_3, Degree=degree_3, Periodic=Toggle(False), KnotStyle=1)  # -> Curve, Length, Domain
interpolate_4 = Interpolate(Vertices=construct_point_4, Degree=degree_4, Periodic=Toggle(False), KnotStyle=1)  # -> Curve, Length, Domain
interpolate_5 = Interpolate(Vertices=construct_point_5, Degree=degree_5, Periodic=Toggle(False), KnotStyle=1)  # -> Curve, Length, Domain
curve = Curve(interpolate.Curve)
curve_2 = Curve(interpolate_2.Curve)  # disabled
curve_3 = Curve(interpolate_4.Curve)  # disabled
curve_4 = Curve(interpolate_5.Curve)  # disabled
curve_5 = Curve(interpolate_3.Curve)  # disabled
