# Grasshopper definition 1_sphericalProjection.gh (Grasshopper 1.0.7)

size_of_geometry = Slider(5, range=0..10)
offset_distance = Slider(0.12, range=0..1)
grid_size = Slider(1, range=0..1)
construct_point = ConstructPoint(XCoordinate=0, YCoordinate=0, ZCoordinate=0)
division = Division(A=size_of_geometry, B=grid_size)
multiplication = Multiplication(A=grid_size, B=division)
point = Point(construct_point)
multiplication_2 = Multiplication(A=multiplication, B="-0.5")
square = Square(Plane=point, Size=grid_size, ExtentX=division, ExtentY=division)  # -> Cells, Points
vector_xyz = VectorXYZ(XComponent=multiplication_2, YComponent=multiplication_2, ZComponent=0)  # -> Vector, Length
move = Move(Geometry=square.Cells, Motion=vector_xyz.Vector)  # -> Geometry, Transform
bounding_box = BoundingBox(Content=flatten(move.Geometry), Plane=PlaneXY(0, 0, 0), UnionBox=True)  # -> Box, Box_2
brep_edges = BrepEdges(Brep=bounding_box.Box)  # -> Naked, Interior, NonManifold
join_curves = JoinCurves(Curves=brep_edges.Naked, Preserve=False)
offset_curve = OffsetCurve(Curve=move.Geometry, Distance=expr("-x", offset_distance), Plane=PlaneXY(0, 0, 0), Corners=1)
offset_curve_2 = OffsetCurve(Curve=join_curves, Distance=offset_distance, Plane=PlaneXY(0, 0, 0), Corners=1)
boundary_surfaces = BoundarySurfaces(Edges=flatten([offset_curve_2, offset_curve]))

V = Slider(1, range=1..100)
v_count = Slider(30, range=10..100)
u_count = Slider(30, range=10..100)
range = Range(Domain=Domain(0, 1), Steps=v_count)
dom = ConstructDomain(DomainStart=expr("-x", V), DomainEnd=V)
range_2 = Range(Domain=Domain(0, 1), Steps=u_count)
dom_2 = ConstructDomain(DomainStart=expr("-x", V), DomainEnd=V)
int = Integer(expr("x+1", u_count))
remap = RemapNumbers(Value=range, Source=Domain(0, 1), Target=dom)  # -> Mapped, Clipped
remap_2 = RemapNumbers(Value=range_2, Source=Domain(0, 1), Target=dom_2)  # -> Mapped, Clipped
crossref = CrossReference(ListA=remap.Mapped, ListB=remap_2.Mapped, CrossMode=1)  # -> ListA, ListB
expression = Expression(u=crossref.ListA, v=crossref.ListB, Expression="2*u / (u² + v² + 1)")
expression_2 = Expression(u=crossref.ListA, v=crossref.ListB, Expression="2*v / (u² + v² + 1)")
expression_3 = Expression(u=crossref.ListA, v=crossref.ListB, Expression="(u² + v² - 1) / (u² + v² + 1)")
int_2 = Integer(int)
pt = ConstructPoint(XCoordinate=expression, YCoordinate=expression_2, ZCoordinate=expression_3)
srfgrid = SurfaceFromPoints(Points=pt, UCount=int_2, Interpolate=True)

# ---- group: Define Pattern
surface = Surface(<surface referenced from the Rhino model>)

# ----
sphere_radius = Slider(2.5, range=0..3)
buffer = Slider(0, range=0..5)
ghpython_script = GhPythonScript(x=size_of_geometry, y=sphere_radius, buffer=buffer)  # -> out, h1, h2
# ---------- ghpython_script: Python ----------
__author__ = "karenkuo"

import rhinoscriptsyntax as rs
import math as m

radius = x/2
height = m.tan(75* m.pi / 180)* radius
buffer

height_2 = m.tan(75* m.pi / 180)* y
move= height - height_2 - buffer

h1 = height
h2 = move
# ---------- end ghpython_script ----------

bounding_box_2 = BoundingBox(Content=srfgrid, Plane=PlaneXY(0, 0, 0))  # -> Box, Box_2
deconstruct_brep = DeconstructBrep(Brep=bounding_box_2.Box)  # -> Faces, Edges, Vertices
list_item = ListItem(List=deconstruct_brep.Faces, Index=Slider(4, range=0..10), Wrap=True)
list_item_2 = ListItem(List=deconstruct_brep.Edges, Index=Slider(8, range=0..10), Wrap=True)
list_item_3 = ListItem(List=deconstruct_brep.Edges, Index=Slider(5, range=0..10), Wrap=True)
length = Length(Curve=list_item_2)
length_2 = Length(Curve=list_item_3)
division_2 = Division(A=length_2, B=length)
scale_nu = ScaleNU(Geometry=bounding_box_2.Box, Plane=list_item, ScaleX=1, ScaleY=1, ScaleZ=division_2)  # -> Geometry, Transform
division_3 = Division(A=length_2, B="2")
division_4 = Division(A=sphere_radius, B=division_3)
volume = Volume(Geometry=scale_nu.Geometry)  # -> Volume, Centroid
scale_nu_2 = ScaleNU(Geometry=srfgrid, Plane=volume.Centroid, ScaleX=division_4, ScaleY=division_4, ScaleZ=division_4)  # -> Geometry, Transform
construct_point_2 = ConstructPoint(XCoordinate=0, YCoordinate=0, ZCoordinate=Slider(3.3, range=0..10))
move_2 = Move(Geometry=scale_nu_2.Geometry, Motion=construct_point_2)  # -> Geometry, Transform

area = Area(Geometry=surface)  # -> Area, Centroid

construct_point_3 = ConstructPoint(XCoordinate=0, YCoordinate=0, ZCoordinate=ghpython_script.h1)
move_3 = Move(Geometry=area.Centroid, Motion=construct_point_3)  # -> Geometry, Transform
extrude_point = ExtrudePoint(Base=surface, Point=move_3.Geometry)

brep_brep = BrepBrep(BrepA=extrude_point, BrepB=move_2.Geometry)  # -> Curves, Points
surface_split = SurfaceSplit(Surface=move_2.Geometry, Curves=brep_brep.Curves)  # -> flatten(Fragments)
list_item_4 = ListItem(List=surface_split, Index=Slider(65, range=0..100), Wrap=True)
surface_2 = Surface(list_item_4)
custom_preview = CustomPreview(
    Geometry=surface_2,
    Material={diffuse=RGB(221, 160, 221), emission=RGB(66, 48, 66), shine=0.5, specular=RGB(255, 255, 255), transparency=0})

panel = Panel("1")  # disabled
number_slider = Slider(0, range=0..360)  # disabled
vector_xyz_2 = VectorXYZ(XComponent=0, YComponent=panel, ZComponent=0)  # -> Vector, Length; disabled
relay = Relay()  # disabled
rotate_3d = Rotate3D(Geometry=surface_2, Angle=degrees(number_slider), Center=relay, Axis=vector_xyz_2.Vector)  # -> Geometry, Transform; disabled
custom_preview_2 = CustomPreview(
    Geometry=rotate_3d.Geometry,
    Material={diffuse=RGB(221, 160, 221), emission=RGB(66, 48, 66), shine=0.5, specular=RGB(255, 255, 255), transparency=0})  # disabled
