# Grasshopper definition approach_0.gh (Grasshopper 1.0.7)

file_path = FilePath("/Volumes/kmj/GSD/08-2022fall/com des/assignment[0]/ass/htc_test/group08_14.csv")

# ---- group: initial split
split_point = Slider(99, range=0..223)
tween_count = Slider(74, range=0..100)

# ---- group: curve degree
list = ValueList({"One": 1, "Two": 2, "Three": 2² - 1, "Four": Sqrt(16)}, selected="Four")

# ---- group: divide
number_slider = Slider(1, range=1..20)

# ---- group: angle
value_a = Slider(0, range=0..0.5)
angle = Slider(0, range=0..100)

# ----
x = Slider(0, range=0..10)
z = Slider(0, range=0..10)
y = Slider(0, range=0..10)

# ---- group: size
factor = Slider(0, range=0..10)
value_f = Slider(2.1, range=0..10)

# ----
panel = Panel(file_path)
readfile = ReadFile(Path=file_path, PerLine=file_path)  # -> Data; inputs Empty: Boolean
# ---------- readfile: Python ----------
"""Reads the contents of a file.
    Inputs:
        Path: The absolute path of the file to read
        PerLine: By default True to output the data line by line, or False
        Empty: By default True, or False to remove empty lines
    Output:
        Data: The file content"""

ghenv.Component.Name = "Read File"
ghenv.Component.NickName = "ReadFile"

__author__ = "diff-arch"
__version__ = "0.1.5 (2020-12-28)"


## -----------------------------------------------------------------------------


import Grasshopper as gh
import os


def read_lines(fpath, empty=True):
    """Reads the contents of a file line by line.
    
    Args:
      fpath: An absolute path to a file to read
      empty: By default True to remove empty lines
    
    Raises:
      OSError: '<fpath>' is not a valid file path
      RuntimeError: Unable to read 'fname'
    
    Returns:
      The individual lines of data in a list.
    """
    lines = []
    if not os.path.exists(fpath) or not os.path.isfile(fpath):
        raise OSError("'{}' is not a valid file path".format(fpath))
    try:
        with open(fpath) as f:
            for line in f:
                if not empty and (line == '\n' or line == '\r\n'):
                    continue
                lines.append(line)
    except:
        basedir, fname = os.path.split(fpath)
        raise RuntimeError("Unable to read '{}'".format(fname))
    return lines


## -----------------------------------------------------------------------------


if __name__ == "__main__":
    # Manaage inputs
    if Path is None:
        e = "Input parameter Path failed to collect data"
        ghenv.Component.AddRuntimeMessage(
            gh.Kernel.GH_RuntimeMessageLevel.Warning, e
            )
    if PerLine is None:
        PerLine = True
    if Empty is None:
        Empty = True
    
    
    if Path is not None:
        # Read data from file
        lines = []
        try:
            lines = read_lines(Path, Empty)
        except Exception as e:
            ghenv.Component.AddRuntimeMessage(
                gh.Kernel.GH_RuntimeMessageLevel.Error, str(e)
                )
        # Output data
        if PerLine:
            Data = lines
        else:
            Data = "".join(lines)
# ---------- end readfile ----------
c_script = CSharpScript(CSVData=readfile)  # -> out, TIMESTAMPS, T0_PLANES, T0_TRIGGER_PRESSED, T0_TRIGGER_CLICKED, T0_TRIGGER_VALUE, T0_TOUCHPAD_PRESSED, T0_TOUCHPAD_CLICKED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; inputs CSVData: list of String
# ---------- c_script: C# usings ----------
using System.IO;
using System.Linq;
using System.Data;
using System.Drawing;
using System.Reflection;
using System.Windows.Forms;
using System.Xml;
using System.Xml.Linq;
using System.Runtime.InteropServices;

using Rhino.DocObjects;
using Rhino.Collections;
using GH_IO;
using GH_IO.Serialization;
# ---------- c_script: C# ----------
    List<long> timestamps = new List<long>();

    List<Plane> t0_planes = new List<Plane>();
    List<bool> t0_trigger_pressed = new List<bool>();
    List<bool> t0_trigger_clicked = new List<bool>();
    List<double> t0_trigger_value = new List<double>();
    List<bool> t0_touchpad_pressed = new List<bool>();
    List<bool> t0_touchpad_clicked = new List<bool>();
    List<Vector3d> t0_touchpad_vectors = new List<Vector3d>();

    List<Plane> t1_planes = new List<Plane>();
    List<bool> t1_trigger_pressed = new List<bool>();
    List<bool> t1_trigger_clicked = new List<bool>();
    List<double> t1_trigger_value = new List<double>();
    List<bool> t1_touchpad_pressed = new List<bool>();
    List<bool> t1_touchpad_clicked = new List<bool>();
    List<Vector3d> t1_touchpad_vectors = new List<Vector3d>();


    // Let's iterate over all the string in the incoming data list, one per line.
    // Notice how we start with 1, because we want to skip the header in the file.
    for (int i = 1; i < CSVData.Count; i++) {
      // Let's retrieve a line will all the data
      string dataRow = CSVData[i];

      // Because it is a Comma-Separated Values (CSV) list, we values are separated with commas.
      // If we split the string with commas, we can get an array of strings with the individual values!
      // https://docs.microsoft.com/en-us/dotnet/api/system.string.split?view=netframework-4.5
      string[] cols = dataRow.Split(',');  // notice how we use single quotes to indicate a char input

      timestamps.Add(Convert.ToInt64(cols[0]));

      Plane pl0 = new Plane(
        new Point3d(Convert.ToDouble(cols[1]), Convert.ToDouble(cols[2]), Convert.ToDouble(cols[3])),
        new Vector3d(Convert.ToDouble(cols[4]), Convert.ToDouble(cols[5]), Convert.ToDouble(cols[6])),
        new Vector3d(Convert.ToDouble(cols[7]), Convert.ToDouble(cols[8]), Convert.ToDouble(cols[9]))
        );
      t0_planes.Add(pl0);

      t0_trigger_pressed.Add(Convert.ToBoolean(cols[10]));
      t0_trigger_clicked.Add(Convert.ToBoolean(cols[11]));
      t0_trigger_value.Add(Convert.ToDouble(cols[12]));

      t0_touchpad_pressed.Add(Convert.ToBoolean(cols[13]));
      t0_touchpad_clicked.Add(Convert.ToBoolean(cols[14]));

      Vector3d tpv0 = new Vector3d(Convert.ToDouble(cols[15]), Convert.ToDouble(cols[16]), 0);
      t0_touchpad_vectors.Add(tpv0);

      Plane pl1 = new Plane(
        new Point3d(Convert.ToDouble(cols[17]), Convert.ToDouble(cols[18]), Convert.ToDouble(cols[19])),
        new Vector3d(Convert.ToDouble(cols[20]), Convert.ToDouble(cols[21]), Convert.ToDouble(cols[22])),
        new Vector3d(Convert.ToDouble(cols[23]), Convert.ToDouble(cols[24]), Convert.ToDouble(cols[25]))
        );
      t1_planes.Add(pl1);

      t1_trigger_pressed.Add(Convert.ToBoolean(cols[26]));
      t1_trigger_clicked.Add(Convert.ToBoolean(cols[27]));
      t1_trigger_value.Add(Convert.ToDouble(cols[28]));

      t1_touchpad_pressed.Add(Convert.ToBoolean(cols[29]));
      t1_touchpad_clicked.Add(Convert.ToBoolean(cols[30]));

      Vector3d tpv1 = new Vector3d(Convert.ToDouble(cols[31]), Convert.ToDouble(cols[32]), 0);
      t1_touchpad_vectors.Add(tpv1);



    }


    TIMESTAMPS = timestamps;

    T0_PLANES = t0_planes;
    T0_TRIGGER_PRESSED = t0_trigger_pressed;
    T0_TRIGGER_CLICKED = t0_trigger_clicked;
    T0_TRIGGER_VALUE = t0_trigger_value;
    T0_TOUCHPAD_PRESSED = t0_touchpad_pressed;
    T0_TOUCHPAD_CLICKED = t0_touchpad_clicked;
    T0_TOUCHPAD_VECTORS = t0_touchpad_vectors;

    T1_PLANES = t1_planes;
    T1_TRIGGER_PRESSED = t1_trigger_pressed;
    T1_TRIGGER_CLICKED = t1_trigger_clicked;
    T1_TRIGGER_VALUE = t1_trigger_value;
    T1_TOUCHPAD_PRESSED = t1_touchpad_pressed;
    T1_TOUCHPAD_CLICKED = t1_touchpad_clicked;
    T1_TOUCHPAD_VECTORS = t1_touchpad_vectors;
# ---------- end c_script ----------

point = Point(c_script.T0_PLANES)
split_list = SplitList(List=point, Index=split_point)  # -> ListA, ListB
pt = Point(split_list.ListB)
pt_2 = Point(split_list.ListA)

# ---- group: NurbsCurve
c_script_2 = CSharpScript(points=pt_2, degree=list)  # -> out, OutCurve; inputs points: list of Point3d, degree: Int32
# ---------- c_script_2: C# ----------
    //Declare a variable of type Curve
    Curve nc = default(Curve);

    //Create an instance of a Nurbs Curve using input points as control points
    // and input degree
    nc = Rhino.Geometry.Curve.CreateControlPointCurve(points, degree);

    //Assign curve to the output value A
    OutCurve = nc;
# ---------- end c_script_2 ----------

c_script_3 = CSharpScript(points=pt, degree=list)  # -> out, OutCurve; inputs points: list of Point3d, degree: Int32; same code as c_script_2

# ----
geometry = Geometry(c_script_2.OutCurve)
geometry_2 = Geometry(c_script_3.OutCurve)

crv = Curve(geometry_2)
crv_2 = Curve(geometry)

# ---- group: tween
c_script_4 = CSharpScript(curve0=crv_2, curve1=crv, count=tween_count)  # -> out, Curves; inputs curve0: Curve, curve1: Curve, count: Int32
# ---------- c_script_4: C# ----------
    //Declare a variable of type Curve
    Curve[] tweenCrvs = null;

    //Create an array of tween curves from two input curves and number
    tweenCrvs = Rhino.Geometry.Curve.CreateTweenCurves(curve0, curve1, count, 0.01);

    //Assign curve to the output value A
    Curves = tweenCrvs;
# ---------- end c_script_4 ----------

# ---- group: Divide curve by number
c_script_5 = CSharpScript(crv=geometry_2, num=number_slider)  # -> out, A; inputs crv: Curve, num: Int32
# ---------- c_script_5: C# ----------
    //Declare an array of points
    Point3d[] points = {};

    //Divide the curve by number
    crv.DivideByCount(num, true, out points);

    //Output
    A = points;
# ---------- end c_script_5 ----------

# ----
geo = Geometry(c_script_4.Curves)
vector_xyz = VectorXYZ(XComponent=x, YComponent=y, ZComponent=z)  # -> Vector, Length
merge = Merge(Data1=c_script_5.A)

# ---- group: Scale, rotate and translate (move) objects
c_script_6 = CSharpScript(
    objs=geo,
    factor=factor,
    angle=angle,
    value_a=value_a,
    value_f=value_f,
    count=number_slider,
    pt=merge,
    dir=vector_xyz.Vector)  # -> out, XformGeom; inputs objs: list of GeometryBase, factor: Double, angle: Double, value_a: Double, value_f: Double, count: Int32, pt: Point3d, dir: Vector3d
# ---------- c_script_6: C# ----------
    //Create a new list of geometry objects
    List<GeometryBase> newGeom = new List<GeometryBase>();



    foreach (GeometryBase obj in objs) {
      //scale, rotate And move

      for (int i = 0; i < count; i++){

        angle = angle + value_a;
        factor = factor + value_f;

      }
      obj.Scale(factor);
      obj.Rotate(angle, Vector3d.YAxis, pt);
      obj.Translate(dir);


      //add to list
      newGeom.Add(obj);
    }

    //Assign output
    XformGeom = newGeom;
# ---------- end c_script_6 ----------

# ---- group: output
geo_2 = Geometry(c_script_6.XformGeom)

# ---- group: visualization: very SLOW / pipe
c_script_7 = CSharpScript(curve=geo_2, pipe=Slider(0.01, range=0..0.1))  # -> out, P; inputs curve: Curve, pipe: Double; disabled
# ---------- c_script_7: C# ----------
    var pipe_line0 = Brep.CreatePipe(curve, pipe, true, 0, false, 0.1, 0.1);
    P = pipe_line0;
# ---------- end c_script_7 ----------

geometry_3 = Geometry(c_script_7.P)

# ---- group: visualization: very SLOW
custom_preview = CustomPreview(Geometry=geometry_3, Material=ColourSwatch(SwatchColor=RGBA(255, 255, 255, 50)))
