# Grasshopper definition approach_1.gh (Grasshopper 1.0.7)
# plug-ins: ScriptParasite

# ---- group: Let's use GH to read the CSV file into a List of strings. Make sure you replace the incoming path with wherever your file lives.
# #GSD6338
# Introduction to Computational Design
# Instructor: Jose Luis García del Castillo y López
# Harvard University Graduate School of Design
# HTC Vive CSV Reader
# This file contains a sample Grasshopper definition to read recorder motion tracker information from a CSV file and reconstruct it in different ways.
# This file uses the ViveTrack plugin by Chen Jingcheng to read from the controller: https://github.com/ccc159/ViveTrack/releases
# 
# This file is part of a class assignment for GSD6338: Introduction to Computational Design.
# More info on: https://gsd6338.org
panel = Panel("/Users/chelliah/Desktop/htc_csv/group08_08.csv")
file = ReadFile(File=panel, PerLineParse=True)

# ----
panel_2 = Panel("/Users/chelliah/Desktop/test")
boolean_toggle = BooleanToggle(False)
c_script = CSharpScript(CSVData=file)  # -> out, TIMESTAMPS, T0_PLANES, T0_TRIGGER_PRESSED, T0_TRIGGER_CLICKED, T0_TRIGGER_VALUE, T0_TOUCHPAD_PRESSED, T0_TOUCHPAD_CLICKED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; inputs CSVData: list of String
# ---------- c_script: C# usings ----------
using System.IO;
using System.Linq;
using System.Data;
using System.Drawing;
using System.Reflection;
using System.Windows.Forms;
using System.Xml;
using System.Xml.Linq;
using System.Runtime.InteropServices;

using Rhino.DocObjects;
using Rhino.Collections;
using GH_IO;
using GH_IO.Serialization;
# ---------- c_script: C# ----------
    List<long> timestamps = new List<long>();

    List<Plane> t0_planes = new List<Plane>();
    List<bool> t0_trigger_pressed = new List<bool>();
    List<bool> t0_trigger_clicked = new List<bool>();
    List<double> t0_trigger_value = new List<double>();
    List<bool> t0_touchpad_pressed = new List<bool>();
    List<bool> t0_touchpad_clicked = new List<bool>();
    List<Vector3d> t0_touchpad_vectors = new List<Vector3d>();

    List<Plane> t1_planes = new List<Plane>();
    List<bool> t1_trigger_pressed = new List<bool>();
    List<bool> t1_trigger_clicked = new List<bool>();
    List<double> t1_trigger_value = new List<double>();
    List<bool> t1_touchpad_pressed = new List<bool>();
    List<bool> t1_touchpad_clicked = new List<bool>();
    List<Vector3d> t1_touchpad_vectors = new List<Vector3d>();


    // Let's iterate over all the string in the incoming data list, one per line.
    // Notice how we start with 1, because we want to skip the header in the file.
    for (int i = 1; i < CSVData.Count; i++) {
      // Let's retrieve a line will all the data
      string dataRow = CSVData[i];

      // Because it is a Comma-Separated Values (CSV) list, we values are separated with commas.
      // If we split the string with commas, we can get an array of strings with the individual values!
      // https://docs.microsoft.com/en-us/dotnet/api/system.string.split?view=netframework-4.5
      string[] cols = dataRow.Split(',');  // notice how we use single quotes to indicate a char input

      timestamps.Add(Convert.ToInt64(cols[0]));

      Plane pl0 = new Plane(
        new Point3d(Convert.ToDouble(cols[1]), Convert.ToDouble(cols[2]), Convert.ToDouble(cols[3])),
        new Vector3d(Convert.ToDouble(cols[4]), Convert.ToDouble(cols[5]), Convert.ToDouble(cols[6])),
        new Vector3d(Convert.ToDouble(cols[7]), Convert.ToDouble(cols[8]), Convert.ToDouble(cols[9]))
        );
      t0_planes.Add(pl0);

      t0_trigger_pressed.Add(Convert.ToBoolean(cols[10]));
      t0_trigger_clicked.Add(Convert.ToBoolean(cols[11]));
      t0_trigger_value.Add(Convert.ToDouble(cols[12]));

      t0_touchpad_pressed.Add(Convert.ToBoolean(cols[13]));
      t0_touchpad_clicked.Add(Convert.ToBoolean(cols[14]));

      Vector3d tpv0 = new Vector3d(Convert.ToDouble(cols[15]), Convert.ToDouble(cols[16]), 0);
      t0_touchpad_vectors.Add(tpv0);

      Plane pl1 = new Plane(
        new Point3d(Convert.ToDouble(cols[17]), Convert.ToDouble(cols[18]), Convert.ToDouble(cols[19])),
        new Vector3d(Convert.ToDouble(cols[20]), Convert.ToDouble(cols[21]), Convert.ToDouble(cols[22])),
        new Vector3d(Convert.ToDouble(cols[23]), Convert.ToDouble(cols[24]), Convert.ToDouble(cols[25]))
        );
      t1_planes.Add(pl1);

      t1_trigger_pressed.Add(Convert.ToBoolean(cols[26]));
      t1_trigger_clicked.Add(Convert.ToBoolean(cols[27]));
      t1_trigger_value.Add(Convert.ToDouble(cols[28]));

      t1_touchpad_pressed.Add(Convert.ToBoolean(cols[29]));
      t1_touchpad_clicked.Add(Convert.ToBoolean(cols[30]));

      Vector3d tpv1 = new Vector3d(Convert.ToDouble(cols[31]), Convert.ToDouble(cols[32]), 0);
      t1_touchpad_vectors.Add(tpv1);



    }


    TIMESTAMPS = timestamps;

    T0_PLANES = t0_planes;
    T0_TRIGGER_PRESSED = t0_trigger_pressed;
    T0_TRIGGER_CLICKED = t0_trigger_clicked;
    T0_TRIGGER_VALUE = t0_trigger_value;
    T0_TOUCHPAD_PRESSED = t0_touchpad_pressed;
    T0_TOUCHPAD_CLICKED = t0_touchpad_clicked;
    T0_TOUCHPAD_VECTORS = t0_touchpad_vectors;

    T1_PLANES = t1_planes;
    T1_TRIGGER_PRESSED = t1_trigger_pressed;
    T1_TRIGGER_CLICKED = t1_trigger_clicked;
    T1_TRIGGER_VALUE = t1_trigger_value;
    T1_TOUCHPAD_PRESSED = t1_touchpad_pressed;
    T1_TOUCHPAD_CLICKED = t1_touchpad_clicked;
    T1_TOUCHPAD_VECTORS = t1_touchpad_vectors;
# ---------- end c_script ----------
panel_3 = Panel(file)

c_script_2 = CSharpScript(t0_plane=c_script.T0_PLANES, t1_plane=c_script.T1_PLANES)  # -> out, A; inputs t0_plane: list of Plane, t1_plane: list of Plane
# ---------- c_script_2: C# ----------
    /* This method attempts to recreate the 2D drawings of pendulum motions 
     * produced by a harmonograph, which is a simple device of two pendulums 
     * oscillating at right angles to eachother, attached to a single pen.
     * The drawing will be either simple harmonic osscilation curves or complex 
     * Lissajous curves. All drawings will be produced by translating the motions 
     * given by the t0_plane and t1_plane parameters.
     * 
     * INPUTS:
     *  
     * var t0_plane type: List<Plane>
     * var t0_plane: List of Plane objects from one of the HTC controllers 
     *  visualizing our 3D motion.
     *  
     * var t1_plane type: List<Plane>
     * var t1_plane: List of Plane objects from one of the HTC controllers 
     *  visualizing our 3D motion.
     *  
     * OUTPUTS:
     * 
     * var reference A: Object
     * var reference A: the output object to display in Rhino
     */

    // Sanity check
    Print(t0_plane[0].Origin.ToString());
    Print(t0_plane[10].Origin.ToString());
    Print(t0_plane[20].Origin.ToString());

    Print(t1_plane[0].Origin.ToString());
    Print(t1_plane[10].Origin.ToString());
    Print(t1_plane[20].Origin.ToString());

    Print("count of t0_plane: " + t0_plane.Count);
    Print("count of t1_plane: " + t1_plane.Count);

    // AMPLITUDE
    // t0_planes min and max z values for Amplitude
    double max_t0_plane_z = 0;
    double min_t0_plane_z = 0;
    for (int i = 0; i < t0_plane.Count; i++)
    {
      double z_value = t0_plane[i].OriginZ;
      if (z_value > max_t0_plane_z)
      {
        max_t0_plane_z = z_value;
      }
      else if (z_value < min_t0_plane_z)
      {
        min_t0_plane_z = z_value;
      }
    }
    double total_z_height_t0_plane = max_t0_plane_z - min_t0_plane_z;

    // t1_planes min and max z values for Amplitude
    double max_t1_plane_z = 0;
    double min_t1_plane_z = 0;
    for (int i = 0; i < t1_plane.Count; i++)
    {
      double z_value = t1_plane[i].OriginZ;
      if (z_value > max_t1_plane_z)
      {
        max_t1_plane_z = z_value;
      }
      else if (z_value < min_t1_plane_z)
      {
        min_t1_plane_z = z_value;
      }
    }
    double total_z_height_t1_plane = max_t1_plane_z - min_t1_plane_z;

    // TOTAL TIME
    int snapshots = t0_plane.Count;

    // PHASE
    // total X distance expressed in pi
    double distance_t0_plane = 0;
    for (int i = 1; i < t0_plane.Count; i++)
    {
      distance_t0_plane += Math.Abs(t0_plane[i].DistanceTo(t0_plane[i - 1].Origin));
    }
    double total_t0_distance_in_pi = distance_t0_plane % 2 * Math.PI;
    // total Y distance expressed in pi
    double distance_t1_plane = 0;
    for (int i = 1; i < t1_plane.Count; i++)
    {
      distance_t1_plane += Math.Abs(t1_plane[i].DistanceTo(t0_plane[i - 1].Origin));
    }
    double total_t1_distance_in_pi = distance_t1_plane % 2 * Math.PI;

    // FREQUENCY
    // speed of the motion = total distance of motion / total time of motion
    double speed_t0_plane = distance_t0_plane / snapshots;
    double speed_t1_plane = distance_t1_plane / snapshots;

    // HTC DERIVED VALUES
    int time = snapshots;
    double A_x = total_z_height_t0_plane * 10;
    double A_y = total_z_height_t1_plane * 10;
    double f_x = speed_t0_plane * 10;
    double f_y = speed_t1_plane * 10;
    double p_x = total_t0_distance_in_pi;
    double p_y = total_t1_distance_in_pi;

    Print("time: " + time);
    Print("A_x: " + A_x);
    Print("A_y: " + A_y);
    Print("Total distance x: " + distance_t0_plane);
    Print("Total distance y: " + distance_t1_plane);
    Print("f_x: " + f_x);
    Print("f_y: " + f_y);
    Print("p_x: " + p_x);
    Print("p_y: " + p_y);

    // calculate x and y values for each point in time t
    List<Point3d> plot_points = new List<Point3d>();
    for (double t = 0; t <= time; t += 0.001)
    {
      double x = 0;
      double y = 0;
      // assuming a simple case of only one pendulum
      x += A_x * Math.Sin(t * f_x + p_x) * (1 - (t / time));
      y += A_y * Math.Sin(t * f_y + p_y) * (1 - (t / time));
      Point3d pt = new Point3d(x, y, 0);
      plot_points.Add(pt);
    }
    // plot x and y on xy plane
    Polyline plot = new Polyline(plot_points);
    A = plot;
    // color?
# ---------- end c_script_2 ----------
script_parasite = ScriptParasite(Enable=Toggle(True), Folder="/Users/chelliah/Desktop/scripts")

panel_4 = Panel(c_script_2.out)
panel_5 = Panel(c_script_2.A)
geo = Geometry(c_script_2.A)

# ---- group: Given Examples / Normal lines
c_script_3 = CSharpScript(t0_plane=c_script.T0_PLANES, t1_plane=c_script.T1_PLANES, length=Slider(0.14, range=0..1))  # -> out, A, B, C; inputs t0_plane: Plane, t1_plane: Plane, length: Double
# ---------- c_script_3: C# ----------
    Point3d start0 = t0_plane.Origin + length * t0_plane.ZAxis;
    Point3d end0 = t0_plane.Origin - length * t0_plane.ZAxis;
    Line line0 = new Line(start0, end0);

    Point3d start1 = t1_plane.Origin + length * t1_plane.ZAxis;
    Point3d end1 = t1_plane.Origin - length * t1_plane.ZAxis;
    Line line1 = new Line(start1, end1);

    Line lineJoint = new Line(t0_plane.Origin, t1_plane.Origin);

    A = line0;
    B = line1;
    C = lineJoint;
# ---------- end c_script_3 ----------
geo_2 = Geometry(c_script_3.B)
geo_3 = Geometry(c_script_3.C)
geo_4 = Geometry(c_script_3.A)

# ---- group: Given Examples / Spheres
c_script_4 = CSharpScript(t0_plane=c_script.T0_PLANES, radius=Slider(0.01, range=0..1))  # -> out, A; inputs t0_plane: Plane, radius: Double
# ---------- c_script_4: C# ----------
    Sphere sphere = new Sphere(t0_plane, radius);

    A = sphere;
# ---------- end c_script_4 ----------
geo_5 = Geometry(c_script_4.A)

# ---- group: Jewel Box - HTC #4
x_axis_frequency_scale_factor = Slider(100, range=0..1000)
y_axis_frequency_scale_factor = Slider(120.5, range=0..1000)
x_axis_amplitude_scale_factor = Slider(10, range=0..100)
y_axis_amplitude_scale_factor = Slider(20, range=0..100)
x_axis_phase_radians = Slider(0, range=0..18.849)
y_axis_phase_radians = Slider(0, range=0..6.283)
number_of_pendulums = Slider(1, range=1..3)
x_axis_decay_offset = Slider(0, range=0..100)
y_axis_decay_offset = Slider(0, range=0..100)
c_script_5 = CSharpScript(
    num_pendulums=number_of_pendulums,
    A_x_scale_factor=x_axis_amplitude_scale_factor,
    f_x_scale_factor=x_axis_frequency_scale_factor,
    p_x_offset=x_axis_phase_radians,
    d_x_offset=x_axis_decay_offset,
    A_y_scale_factor=y_axis_amplitude_scale_factor,
    f_y_scale_factor=y_axis_frequency_scale_factor,
    p_y_offset=y_axis_phase_radians,
    d_y_offset=y_axis_decay_offset,
    t0_plane=c_script.T0_PLANES,
    t1_plane=c_script.T1_PLANES)  # -> out, A; inputs num_pendulums: Int32, A_x_scale_factor: Double, f_x_scale_factor: Double, p_x_offset: Double, d_x_offset: Double, A_y_scale_factor: Double, f_y_scale_factor: Double, p_y_offset: Double, d_y_offset: Double, t0_plane: list of Plane, t1_plane: list of Plane
# ---------- c_script_5: C# ----------
    /* This method attempts to recreate the 2D drawings of pendulum motions 
     * produced by a harmonograph, which is a simple device of two pendulums 
     * oscillating at right angles to eachother, attached to a single pen.
     * The drawing will be either simple harmonic osscilation curves or complex 
     * Lissajous curves depending on the number of pendulums requested, which 
     * range from 1 to 3. The third pendulum will simulate the oscillations of 
     * the paper. All drawings will be produced by translating the motions 
     * given by the t0_plane and t1_plane parameters.
     * 
     * INPUTS:
     * 
     * var num_pendulums type: int
     * var num_pendulums: the number of pendulums to simulate; range[1,3]
     * 
     * var A_x_scale_factor type: double
     * var A_x_scale_factor: the factor by which to scale the x-axis amplitude; 
     *   range=[0,100]
     *   
     * var f_x_scale_factor type: double
     * var f_x_scale_factor: the factor by which to scale the x-axis frequency;
     *  range=[0, 100]
     * 
     * var p_x_offset type: double
     * var p_x_offset: the radian offset for the phase of the curves in the 
     *  x-axis; range=[0,2*Pi]
     *  
     * var d_x_offset type: int
     * var d_x_offset: increasing this value will lower the decay value by 
     *  increasing the time it takes for the pendulum to stop for the x-axis; 
     *  range=[0,100]
     *  
     * var A_y_scale_factor type: double
     * var A_y_scale_factor: the factor by which to scale the y-axis amplitude; 
     *   range=[0,100]
     *   
     * var f_y_scale_factor type: double
     * var f_y_scale_factor: the factor by which to scale the y-axis frequency;
     *  range=[0, 100]
     * 
     * var p_y_offset type: double
     * var p_y_offset: the radian offset for the phase of the curves in the 
     *  y-axis; range=[0,2*Pi]
     *  
     * var d_y_offset type: int
     * var d_y_offset: increasing this value will lower the decay value by 
     *  increasing the time it takes for the pendulum to stop for the y-axis; 
     *  range=[0,100]
     *  
     * var t0_plane type: List<Plane>
     * var t0_plane: List of Plane objects from one of the HTC controllers 
     *  visualizing our 3D motion.
     *  
     * var t1_plane type: List<Plane>
     * var t1_plane: List of Plane objects from one of the HTC controllers 
     *  visualizing our 3D motion.
     *  
     * OUTPUTS:
     * 
     * var reference A: Object
     * var reference A: the output object to display in Rhino
     */

    // Sanity check to confirm all is working
    Print(t0_plane[0].Origin.ToString());
    Print(t0_plane[10].Origin.ToString());
    Print(t0_plane[20].Origin.ToString());

    Print(t1_plane[0].Origin.ToString());
    Print(t1_plane[10].Origin.ToString());
    Print(t1_plane[20].Origin.ToString());

    Print("count of t0_plane: " + t0_plane.Count);
    Print("count of t1_plane: " + t1_plane.Count);

    // AMPLITUDE
    // t0_planes min and max x.y,z values for Amplitude
    double max_t0_plane_z = 0;
    double min_t0_plane_z = 0;
    double max_t0_plane_x = 0;
    double min_t0_plane_x = 0;
    double max_t0_plane_y = 0;
    double min_t0_plane_y = 0;

    for(int i=0; i<t0_plane.Count; i++)
    {
      double x_value = t0_plane[i].OriginX;
      double y_value = t0_plane[i].OriginY;
      double z_value = t0_plane[i].OriginZ;
      if (x_value > max_t0_plane_x)
      {
        max_t0_plane_x = x_value;
      }
      else if (x_value < min_t0_plane_x)
      {
        min_t0_plane_x = x_value;
      }
      if (y_value > max_t0_plane_y)
      {
        max_t0_plane_y = y_value;
      }
      else if (y_value < min_t0_plane_y)
      {
        min_t0_plane_y = y_value;
      }
      if (z_value > max_t0_plane_z)
      {
        max_t0_plane_z = z_value;
      }
      else if(z_value < min_t0_plane_z)
      {
        min_t0_plane_z = z_value;
      }
    }
    double total_x_height_t0_plane = max_t0_plane_x - min_t0_plane_x;
    double total_y_height_t0_plane = max_t0_plane_y - min_t0_plane_y;
    double total_z_height_t0_plane = max_t0_plane_z - min_t0_plane_z;

    // t1_planes min and max x,y,z values for Amplitude
    double max_t1_plane_z = 0;
    double min_t1_plane_z = 0;
    double max_t1_plane_x = 0;
    double min_t1_plane_x = 0;
    double max_t1_plane_y = 0;
    double min_t1_plane_y = 0;

    for (int i = 0; i < t1_plane.Count; i++)
    {
      double x_value = t1_plane[i].OriginX;
      double y_value = t1_plane[i].OriginY;
      double z_value = t1_plane[i].OriginZ;
      if (x_value > max_t1_plane_x)
      {
        max_t1_plane_x = x_value;
      }
      else if (x_value < min_t1_plane_x)
      {
        min_t1_plane_x = x_value;
      }
      if (y_value > max_t1_plane_y)
      {
        max_t1_plane_y = y_value;
      }
      else if (y_value < min_t1_plane_y)
      {
        min_t1_plane_y = y_value;
      }
      if (z_value > max_t1_plane_z)
      {
        max_t1_plane_z = z_value;
      }
      else if (z_value < min_t1_plane_z)
      {
        min_t1_plane_z = z_value;
      }
    }
    double total_x_height_t1_plane = max_t1_plane_x - min_t1_plane_x;
    double total_y_height_t1_plane = max_t1_plane_y - min_t1_plane_y;
    double total_z_height_t1_plane = max_t1_plane_z - min_t1_plane_z;

    // TOTAL TIME
    int snapshots = t0_plane.Count;

    // FREQUENCY
    // speed of the motion = total distance of motion in x,y, or z / total time of motion

    // T0 PLANES
    double total_x_distance_t0_plane = 0;
    double total_y_distance_t0_plane = 0;
    double total_z_distance_t0_plane = 0;

    for (int i = 1; i < t0_plane.Count; i++)
    {
      Point3d current_pt = t0_plane[i].Origin;
      Point3d prev_pt = t0_plane[i-1].Origin;
      total_x_distance_t0_plane += Math.Abs(current_pt.X - prev_pt.X);
      total_y_distance_t0_plane += Math.Abs(current_pt.Y - prev_pt.Y);
      total_z_distance_t0_plane += Math.Abs(current_pt.Z - prev_pt.Z);
    }

    double speed_x_t0_plane = total_x_distance_t0_plane / snapshots;
    double speed_y_t0_plane = total_y_distance_t0_plane / snapshots;
    double speed_z_t0_plane = total_z_distance_t0_plane / snapshots;

    // T1 PLANES
    double total_x_distance_t1_plane = 0;
    double total_y_distance_t1_plane = 0;
    double total_z_distance_t1_plane = 0;

    for (int i = 1; i < t1_plane.Count; i++)
    {
      Point3d current_pt = t1_plane[i].Origin;
      Point3d prev_pt = t1_plane[i - 1].Origin;
      total_x_distance_t1_plane += Math.Abs(current_pt.X - prev_pt.X);
      total_y_distance_t1_plane += Math.Abs(current_pt.Y - prev_pt.Y);
      total_z_distance_t1_plane += Math.Abs(current_pt.Z - prev_pt.Z);
    }

    double speed_x_t1_plane = total_x_distance_t1_plane / snapshots;
    double speed_y_t1_plane = total_y_distance_t1_plane / snapshots;
    double speed_z_t1_plane = total_z_distance_t1_plane / snapshots;

    // PHASE

    // total t0 x,y, or z distances expressed in pi
    double total_x_distance_t0_plane_in_pi = total_x_distance_t0_plane % (2 * Math.PI);
    double total_y_distance_t0_plane_in_pi = total_y_distance_t0_plane % (2 * Math.PI);
    double total_z_distance_t0_plane_in_pi = total_z_distance_t0_plane % (2 * Math.PI);

    // total t1 x,y, or z distances expressed in pi
    double total_x_distance_t1_plane_in_pi = total_x_distance_t1_plane % (2 * Math.PI);
    double total_y_distance_t1_plane_in_pi = total_y_distance_t1_plane % (2 * Math.PI);
    double total_z_distance_t1_plane_in_pi = total_z_distance_t1_plane % (2 * Math.PI);


    // HTC DERIVED VALUES
    int time = snapshots;
    List<double> A_x = new List<double> { total_x_height_t0_plane, total_y_height_t0_plane, total_z_height_t0_plane };
    List<double> A_y = new List<double> { total_x_height_t1_plane, total_y_height_t1_plane, total_z_height_t1_plane };
    List<double> f_x = new List<double> { speed_x_t0_plane, speed_y_t0_plane, speed_z_t0_plane };
    List<double> f_y = new List<double> { speed_x_t1_plane, speed_y_t1_plane, speed_z_t1_plane };
    List<double> p_x = new List<double> { total_x_distance_t0_plane_in_pi, total_y_distance_t0_plane_in_pi, total_z_distance_t0_plane_in_pi};
    List<double> p_y = new List<double> { total_x_distance_t1_plane_in_pi, total_y_distance_t1_plane_in_pi, total_z_distance_t1_plane_in_pi};

    Print("time: " + time);
    Print("A_x: " + A_x[0] + " | " + A_x[1] + " | " + A_x[2]);
    Print("A_y: " + A_y[0] + " | " + A_y[1] + " | " + A_y[2]);
    Print("f_x: " + f_x[0] + " | " + f_x[1] + " | " + f_x[2]);
    Print("f_y: " + f_y[0] + " | " + f_y[1] + " | " + f_y[2]);
    Print("p_x: " + p_x[0] + " | " + p_x[1] + " | " + p_x[2]);
    Print("p_y: " + p_y[0] + " | " + p_y[1] + " | " + p_y[2]);

    // calculate x and y values for each point in time t
    List<Point3d> plot_points = new List<Point3d>();
    for (double t = 0; t <= time; t += 0.001)
    {
      double x = 0;
      double y = 0;
      for(int n=0; n<num_pendulums; n++)
      {
        //x += A * Math.Sin(t * f + p) * Math.Exp(-1 * d * t);
        x += A_x[n]* A_x_scale_factor * Math.Sin(t * f_x[n]*f_x_scale_factor + (p_x[n] + p_x_offset)) * (1 - (t / (time + d_x_offset)));

        //y += A * Math.Sin(t * f + p) * Math.Exp(-1 * d * t);
        y += A_y[n]* A_y_scale_factor * Math.Sin(t * f_y[n]*f_y_scale_factor + (p_y[n] + p_y_offset)) * (1 - (t / (time + d_y_offset)));
      }
      Point3d pt = new Point3d(x, y, 0);
      plot_points.Add(pt);
      //Print(x + "");
      //Print(y + "");
    }
    // plot x and y on xy plane
    Polyline plot = new Polyline(plot_points);
    A = plot;
    // color?
# ---------- end c_script_5 ----------
panel_6 = Panel(c_script_5.out)
panel_7 = Panel(c_script_5.A)
geo_6 = Geometry(c_script_5.A)

# ---- group: Asawa HTC #8
y_axis_frequency_scale_factor_2 = Slider(51, range=0..1000)
x_axis_frequency_scale_factor_2 = Slider(200, range=0..1000)
x_axis_amplitude_scale_factor_2 = Slider(6, range=0..100)
y_axis_amplitude_scale_factor_2 = Slider(20, range=0..100)
x_axis_phase_radians_2 = Slider(3, range=0..18.849)
y_axis_phase_radians_2 = Slider(2, range=0..6.283)
number_of_pendulums_2 = Slider(2, range=1..3)
x_axis_decay_offset_2 = Slider(0, range=0..100)
y_axis_decay_offset_2 = Slider(100, range=0..100)
c_script_6 = CSharpScript(
    num_pendulums=number_of_pendulums_2,
    A_x_scale_factor=x_axis_amplitude_scale_factor_2,
    f_x_scale_factor=x_axis_frequency_scale_factor_2,
    p_x_offset=x_axis_phase_radians_2,
    d_x_offset=x_axis_decay_offset_2,
    A_y_scale_factor=y_axis_amplitude_scale_factor_2,
    f_y_scale_factor=y_axis_frequency_scale_factor_2,
    p_y_offset=y_axis_phase_radians_2,
    d_y_offset=y_axis_decay_offset_2,
    t0_plane=c_script.T0_PLANES,
    t1_plane=c_script.T1_PLANES)  # -> out, A; inputs num_pendulums: Int32, A_x_scale_factor: Double, f_x_scale_factor: Double, p_x_offset: Double, d_x_offset: Double, A_y_scale_factor: Double, f_y_scale_factor: Double, p_y_offset: Double, d_y_offset: Double, t0_plane: list of Plane, t1_plane: list of Plane; same code as c_script_5
panel_8 = Panel(c_script_6.out)
panel_9 = Panel(c_script_6.A)
geo_7 = Geometry(c_script_6.A)

# ---- group: Tubes HTC #15
y_axis_frequency_scale_factor_3 = Slider(32, range=0..1000)
x_axis_frequency_scale_factor_3 = Slider(180.8, range=0..1000)
x_axis_amplitude_scale_factor_3 = Slider(6, range=0..100)
y_axis_amplitude_scale_factor_3 = Slider(20, range=0..100)
x_axis_phase_radians_3 = Slider(1.5, range=0..18.849)
y_axis_phase_radians_3 = Slider(1.5, range=0..6.283)
number_of_pendulums_3 = Slider(1, range=1..3)
x_axis_decay_offset_3 = Slider(0, range=0..100)
y_axis_decay_offset_3 = Slider(10, range=0..100)
c_script_7 = CSharpScript(
    num_pendulums=number_of_pendulums_3,
    A_x_scale_factor=x_axis_amplitude_scale_factor_3,
    f_x_scale_factor=x_axis_frequency_scale_factor_3,
    p_x_offset=x_axis_phase_radians_3,
    d_x_offset=x_axis_decay_offset_3,
    A_y_scale_factor=y_axis_amplitude_scale_factor_3,
    f_y_scale_factor=y_axis_frequency_scale_factor_3,
    p_y_offset=y_axis_phase_radians_3,
    d_y_offset=y_axis_decay_offset_3,
    t0_plane=c_script.T0_PLANES,
    t1_plane=c_script.T1_PLANES)  # -> out, A; inputs num_pendulums: Int32, A_x_scale_factor: Double, f_x_scale_factor: Double, p_x_offset: Double, d_x_offset: Double, A_y_scale_factor: Double, f_y_scale_factor: Double, p_y_offset: Double, d_y_offset: Double, t0_plane: list of Plane, t1_plane: list of Plane; same code as c_script_5
panel_10 = Panel(c_script_7.out)
panel_11 = Panel(c_script_7.A)
geo_8 = Geometry(c_script_7.A)

# ---- group: Cubic Flower HTC #14
c_script_8 = CSharpScript(t0_plane=c_script.T0_PLANES, t1_plane=c_script.T1_PLANES)  # -> out, A; inputs t0_plane: list of Plane, t1_plane: list of Plane; same code as c_script_2
panel_12 = Panel(c_script_8.out)
panel_13 = Panel(c_script_8.A)
geo_9 = Geometry(c_script_8.A)

# ---- group: Wave HTC #23
c_script_9 = CSharpScript(t0_plane=c_script.T0_PLANES, t1_plane=c_script.T1_PLANES)  # -> out, A; inputs t0_plane: list of Plane, t1_plane: list of Plane; same code as c_script_2
panel_14 = Panel(c_script_9.out)
panel_15 = Panel(c_script_9.A)
geo_10 = Geometry(c_script_9.A)

# ---- group: Yayoi Kusama HTC #5
c_script_10 = CSharpScript(t0_plane=c_script.T0_PLANES, t1_plane=c_script.T1_PLANES)  # -> out, A; inputs t0_plane: list of Plane, t1_plane: list of Plane; same code as c_script_2
panel_16 = Panel(c_script_10.out)
panel_17 = Panel(c_script_10.A)
geo_11 = Geometry(c_script_10.A)

# ---- group: Simple Ribbon HTC #2
c_script_11 = CSharpScript(t0_plane=c_script.T0_PLANES, t1_plane=c_script.T1_PLANES)  # -> out, A; inputs t0_plane: list of Plane, t1_plane: list of Plane; same code as c_script_2
panel_18 = Panel(c_script_11.out)
panel_19 = Panel(c_script_11.A)
geo_12 = Geometry(c_script_11.A)
