# Grasshopper definition approach0_animation.gh (Grasshopper 1.0.7)

panel = Panel("C:\Users\ethic\Desktop\Classes_Fall2022\ComputationalDesign\assignment[0]\wetransfer_group8_htcvive_2022-10-03_2300\Group 08\group08_12.csv")
file = ReadFile(File=panel, PerLineParse=True)
# #GSD6338
# Introduction to Computational Design
# Instructor: Jose Luis García del Castillo y López
# Harvard University Graduate School of Design
panel_2 = Panel(file)
c_script = CSharpScript(CSVData=file)  # -> out, TIMESTAMPS, T0_PLANES, T0_TRIGGER_PRESSED, T0_TRIGGER_CLICKED, T0_TRIGGER_VALUE, T0_TOUCHPAD_PRESSED, T0_TOUCHPAD_CLICKED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; inputs CSVData: list of String
# ---------- c_script: C# usings ----------
using System.IO;
using System.Linq;
using System.Data;
using System.Drawing;
using System.Reflection;
using System.Windows.Forms;
using System.Xml;
using System.Xml.Linq;
using System.Runtime.InteropServices;

using Rhino.DocObjects;
using Rhino.Collections;
using GH_IO;
using GH_IO.Serialization;
# ---------- c_script: C# ----------
    List<long> timestamps = new List<long>();

    List<Plane> t0_planes = new List<Plane>();
    List<bool> t0_trigger_pressed = new List<bool>();
    List<bool> t0_trigger_clicked = new List<bool>();
    List<double> t0_trigger_value = new List<double>();
    List<bool> t0_touchpad_pressed = new List<bool>();
    List<bool> t0_touchpad_clicked = new List<bool>();
    List<Vector3d> t0_touchpad_vectors = new List<Vector3d>();

    List<Plane> t1_planes = new List<Plane>();
    List<bool> t1_trigger_pressed = new List<bool>();
    List<bool> t1_trigger_clicked = new List<bool>();
    List<double> t1_trigger_value = new List<double>();
    List<bool> t1_touchpad_pressed = new List<bool>();
    List<bool> t1_touchpad_clicked = new List<bool>();
    List<Vector3d> t1_touchpad_vectors = new List<Vector3d>();


    // Let's iterate over all the string in the incoming data list, one per line.
    // Notice how we start with 1, because we want to skip the header in the file.
    for (int i = 1; i < CSVData.Count; i++) {
      // Let's retrieve a line will all the data
      string dataRow = CSVData[i];

      // Because it is a Comma-Separated Values (CSV) list, we values are separated with commas.
      // If we split the string with commas, we can get an array of strings with the individual values!
      // https://docs.microsoft.com/en-us/dotnet/api/system.string.split?view=netframework-4.5
      string[] cols = dataRow.Split(',');  // notice how we use single quotes to indicate a char input

      timestamps.Add(Convert.ToInt64(cols[0]));

      Plane pl0 = new Plane(
        new Point3d(Convert.ToDouble(cols[1]), Convert.ToDouble(cols[2]), Convert.ToDouble(cols[3])),
        new Vector3d(Convert.ToDouble(cols[4]), Convert.ToDouble(cols[5]), Convert.ToDouble(cols[6])),
        new Vector3d(Convert.ToDouble(cols[7]), Convert.ToDouble(cols[8]), Convert.ToDouble(cols[9]))
        );
      t0_planes.Add(pl0);

      t0_trigger_pressed.Add(Convert.ToBoolean(cols[10]));
      t0_trigger_clicked.Add(Convert.ToBoolean(cols[11]));
      t0_trigger_value.Add(Convert.ToDouble(cols[12]));

      t0_touchpad_pressed.Add(Convert.ToBoolean(cols[13]));
      t0_touchpad_clicked.Add(Convert.ToBoolean(cols[14]));

      Vector3d tpv0 = new Vector3d(Convert.ToDouble(cols[15]), Convert.ToDouble(cols[16]), 0);
      t0_touchpad_vectors.Add(tpv0);

      Plane pl1 = new Plane(
        new Point3d(Convert.ToDouble(cols[17]), Convert.ToDouble(cols[18]), Convert.ToDouble(cols[19])),
        new Vector3d(Convert.ToDouble(cols[20]), Convert.ToDouble(cols[21]), Convert.ToDouble(cols[22])),
        new Vector3d(Convert.ToDouble(cols[23]), Convert.ToDouble(cols[24]), Convert.ToDouble(cols[25]))
        );
      t1_planes.Add(pl1);

      t1_trigger_pressed.Add(Convert.ToBoolean(cols[26]));
      t1_trigger_clicked.Add(Convert.ToBoolean(cols[27]));
      t1_trigger_value.Add(Convert.ToDouble(cols[28]));

      t1_touchpad_pressed.Add(Convert.ToBoolean(cols[29]));
      t1_touchpad_clicked.Add(Convert.ToBoolean(cols[30]));

      Vector3d tpv1 = new Vector3d(Convert.ToDouble(cols[31]), Convert.ToDouble(cols[32]), 0);
      t1_touchpad_vectors.Add(tpv1);



    }


    TIMESTAMPS = timestamps;

    T0_PLANES = t0_planes;
    T0_TRIGGER_PRESSED = t0_trigger_pressed;
    T0_TRIGGER_CLICKED = t0_trigger_clicked;
    T0_TRIGGER_VALUE = t0_trigger_value;
    T0_TOUCHPAD_PRESSED = t0_touchpad_pressed;
    T0_TOUCHPAD_CLICKED = t0_touchpad_clicked;
    T0_TOUCHPAD_VECTORS = t0_touchpad_vectors;

    T1_PLANES = t1_planes;
    T1_TRIGGER_PRESSED = t1_trigger_pressed;
    T1_TRIGGER_CLICKED = t1_trigger_clicked;
    T1_TRIGGER_VALUE = t1_trigger_value;
    T1_TOUCHPAD_PRESSED = t1_touchpad_pressed;
    T1_TOUCHPAD_CLICKED = t1_touchpad_clicked;
    T1_TOUCHPAD_VECTORS = t1_touchpad_vectors;
# ---------- end c_script ----------
phase_for_animation = Slider(17.049, range=-20..20)
c_script_2 = CSharpScript(plane=c_script.T0_PLANES)  # -> x, y, z; inputs plane: Plane
# ---------- c_script_2: C# ----------
    
    double xx = plane.Origin.X;
    double yy = plane.OriginY;

    double zz = plane.Origin.Z;
    x = xx;
    y = yy;
    z = zz;
# ---------- end c_script_2 ----------
c_script_3 = CSharpScript(x=c_script_2.x, y=c_script_2.y, z=c_script_2.z, animationtime=phase_for_animation)  # -> xx, yy, zz; inputs x: Double, y: Double, z: Double, animationtime: Double
# ---------- c_script_3: C# ----------
    double newAnimation = y + animationtime;
  xx = x;
  zz = z;

 
    yy = newAnimation;
# ---------- end c_script_3 ----------
construct_point = ConstructPoint(XCoordinate=Slider(-1.2, range=-100..100), YCoordinate=Slider(0.7, range=-100..100), ZCoordinate=Slider(1, range=0..100))
c_script_4 = CSharpScript(
    x=c_script_3.xx,
    y=c_script_3.yy,
    z=c_script_3.zz,
    BlackHoleX=construct_point,
    BlackHoleY=construct_point,
    BlackHoleZ=construct_point,
    Intensity=Slider(1.162, range=0..2),
    MinGravityDistance=Slider(4.41, range=0..50),
    spheresize=Slider(0.048, range=0..1))  # -> out, A, NewPoint, newIntensity; inputs x: Double, y: Double, z: Double, BlackHoleX: Double, BlackHoleY: Double, BlackHoleZ: Double, Intensity: Double, MinGravityDistance: Double, spheresize: Double
# ---------- c_script_4: C# ----------
    Point3d pp = new Point3d(x, y, z);

    //distance between two points
    //getting the distance to black hole point
    double d = Math.Pow((Math.Pow(BlackHoleX - x, 2) +
      Math.Pow(BlackHoleY - y, 2) +
      Math.Pow(BlackHoleZ - z, 2) * 1.0), 0.5);

    Point3d blackholePoint = new Point3d(BlackHoleX, BlackHoleY, BlackHoleZ);



    //if within min distance
    //    if (d < MinGravityDistance)
    //    {
    //getting % of distance from the minimum gravity distance

    //remapping the distance to unitize between 0 and 1 so we move from min graxity distance to the new range 0 to 1
    double newLerp = ( RemapValueToNewRange(d, MinGravityDistance, 0, 0, 1) ) * Intensity;

    Point3d interpolatedPP = new Point3d(x * newLerp, y * newLerp, z * newLerp);
    NewPoint = interpolatedPP;

    //redius of sphere
    newIntensity = newLerp*spheresize;
    //    }
    //      //if outside min distance
    //    else {
    //      Point3d interpolatedPP = pp;
    //      NewPoint = interpolatedPP;
    //
    //    }
    //output needs to be set explicitly at the end
# ---------- c_script_4: C# additional code ----------
  double RemapValueToNewRange(double s, double a1, double a2, double b1, double b2)
  {
    return b1 + (s - a1) * (b2 - b1) / (a2 - a1);
  }
# ---------- end c_script_4 ----------
point = Point(c_script_4.NewPoint)
# try using a longer structure instead of circular points - arbitrary scaling of points - to follow motion - more striking visual
sphere = Sphere(Base=point, Radius=c_script_4.newIntensity)
# same points offset to make a more striking effect.
colour_swatch = ColourSwatch(SwatchColor=RGB(255, 255, 255))
custom_preview = CustomPreview(Geometry=sphere, Material=colour_swatch)
