# Grasshopper definition approach1_animation.gh (Grasshopper 1.0.7)
# plug-ins: treesloth01

movement_slow = Slider(1, range=0..1)
ellipse_r1 = Slider(300, range=0..500)
movement_count_index = Slider(2150, range=0..5000)
ellipse_multipler = Slider(3, range=0..3)
movement_count = Slider(5000, range=0..5000)
construct_point = ConstructPoint(XCoordinate="0", YCoordinate="0", ZCoordinate="0")
division = Division(A=ellipse_r1, B="2")
multiplication = Multiplication(A=movement_count_index, B=movement_slow)

# ---- group: Field
c_script = CSharpScript(
    plane=construct_point,
    r1=ellipse_r1,
    r2=division,
    multiplier=ellipse_multipler,
    count=movement_count,
    index=movement_count_index)  # -> out, E, E2, PT, PT_index; inputs plane: Plane, r1: Double, r2: Double, multiplier: Double, count: Int32, index: Int32
# ---------- c_script: C# ----------
// Rotation Field
var ellipse = new Ellipse(plane, r1,r2);
E = ellipse;

// Outer Field
var ellipse2 = new Ellipse(plane, r1*multiplier,r2*multiplier);
E2 = ellipse2;


var curve = ellipse.ToNurbsCurve();

Point3d[ ] points = { };
curve.DivideByCount(count,true, out points);
PT = points;

PT_index = points[index];
# ---------- end c_script ----------

# ----
geometry = Geometry(c_script.E)
geometry_2 = Geometry(c_script.PT)
geometry_3 = Geometry(c_script.PT_index)
geometry_4 = Geometry(c_script.E2)

# ---- group: orbit()
radius_precession_frequency = Slider(56, range=0..1000)
radius_eccentricity = Slider(1, range=0..1)
theta_1 = Slider(-60, range=-100..100)
theta_2 = Slider(31, range=-100..100)
phi_1 = Slider(-26, range=-100..100)
phi_2 = Slider(-46, range=-100..100)
number_slider = Slider(240, range=0..1000)
dom = ConstructDomain(DomainStart=theta_1, DomainEnd=theta_2)
dom_2 = ConstructDomain(DomainStart=phi_1, DomainEnd=phi_2)
range = Range(Domain=dom, Steps=number_slider)
range_2 = Range(Domain=dom_2, Steps=number_slider)
c_script_2 = CSharpScript(p=radius_precession_frequency, e=radius_eccentricity, theta=range, phi=range_2)  # -> out, A; inputs p: Double, e: Double, theta: Double, phi: Double
# ---------- c_script_2: C# ----------
var r = p/(1+e);

var x = r*(Math.Sin(theta))*(Math.Cos(phi));
var y = r*(Math.Sin(theta))*(Math.Sin(phi));
var z = r*(Math.Cos(theta));

var pt = new Point3d(x,y,z);
A = pt;
# ---------- end c_script_2 ----------
move = Move(Geometry=c_script_2.A, Motion=geometry_3)  # -> Geometry, Transform
nurbs_curve = NurbsCurve(Vertices=move.Geometry, Degree=3, Periodic=False)  # -> Curve, Length, Domain
divide_curve = DivideCurve(Curve=nurbs_curve.Curve, Count=movement_count, Kinks=False)  # -> Points, Tangents, Parameters
plane_normal = PlaneNormal(Origin=divide_curve.Points, ZAxis=divide_curve.Tangents)
list_item = ListItem(List=plane_normal, Index=multiplication, Wrap=True)

# ----
count_tween = Slider(80, range=0..100)
start = Slider(0, range=0..50)
count = Slider(30, range=0..100)
step_radius = Slider(0.209, range=0..1)
step_height = Slider(0.6, range=0..2)
multiplier = Slider(0.4, range=0..1)
divide_count = Slider(40, range=0..100)
divide_len = Slider(10, range=0..10)
step_angle = Slider(237.383, range=0..360)
c_script_3 = CSharpScript(
    start=start,
    step_angle=step_angle,
    step_radius=step_radius,
    step_ht=step_height,
    count=count,
    pt=list_item,
    plane=list_item)  # -> out, Rotate, Radius, Height; inputs start: Double, step_angle: Double, step_radius: Double, step_ht: Double, count: Double, pt: Point3d, plane: Plane
# ---------- c_script_3: C# ----------
List<Double> rotate = new List<Double>();

for (double i=start; i<count*step_angle; i=i+step_angle){
    rotate.Add(i);
}

Rotate = rotate;


List<Double> radius = new List<Double>();

for (double i=start; i<count*step_radius; i=i+step_radius){
    radius.Add(i);
}

Radius = radius;


List<Vector3d> hts = new List<Vector3d>();

for (double i=start; i<count*step_ht; i=i+step_ht){
    var ht = new Vector3d(pt.X,pt.Y,pt.Z+i);
    hts.Add(ht);
}

Height = hts;
# ---------- end c_script_3 ----------
expression = Expression(R=c_script_3.Radius, multipler=multiplier, Expression="multipler*e^R")

# ---- group: radius
c_script_4 = CSharpScript(R=expression, Z=c_script_3.Height)  # -> out, OutCircle; inputs R: Double, Z: Point3d
# ---------- c_script_4: C# ----------
List<Circle> cirs = new List<Circle>();

Circle cir = new Circle(Z, R);
cirs.Add(cir);

OutCircle = cirs;
# ---------- end c_script_4 ----------

# ---- group: Tween
geometry_5 = Geometry(flatten(c_script_4.OutCircle))
project_along = ProjectAlong(Geometry=geometry_5, Plane=list_item, Direction=list_item)  # -> Geometry, Transform
first_last = FirstLast(List=project_along.Geometry)  # -> FirstValue, LastValue
c_script_5 = CSharpScript(crv0=geometry_4, crv1=first_last.LastValue, count=count_tween)  # -> out, tweenCrv; inputs crv0: Curve, crv1: Curve, count: Int32
# ---------- c_script_5: C# ----------
Curve[ ] tweenCrvs = null;
//Create an array of tween curves
tweenCrvs = Rhino.Geometry.Curve.CreateTweenCurves(crv0, crv1, count, 0.01);

tweenCrv = tweenCrvs;
# ---------- end c_script_5 ----------

# ---- group: rotate
c_script_6 = CSharpScript(objs=flatten(c_script_4.OutCircle), angle=c_script_3.Rotate, center=c_script_3.Height)  # -> out, outBrep; inputs angle: Double, center: Point3d
# ---------- c_script_6: C# usings ----------
using System.IO;
using System.Linq;
using System.Data;
using System.Drawing;
using System.Reflection;
using System.Windows.Forms;
using System.Xml;
using System.Xml.Linq;
using System.Runtime.InteropServices;

using Rhino.DocObjects;
using Rhino.Collections;
using GH_IO;
using GH_IO.Serialization;
# ---------- c_script_6: C# ----------
    Transform xform = Transform.Rotation(angle, center);

    objs.Transform(xform);

    outBrep = objs;
# ---------- end c_script_6 ----------

# ---- group: divide curve
c_script_7 = CSharpScript(cir=c_script_6.outBrep, count=divide_count)  # -> out, PT; inputs cir: Curve, count: Int32
# ---------- c_script_7: C# ----------
Point3d[ ] points = { };
cir.DivideByCount(count,true, out points);
PT = points;
# ---------- end c_script_7 ----------

# ----
flip_matrix = FlipMatrix(Data=c_script_7.PT)
nurbs_curve_2 = NurbsCurve(Vertices=flip_matrix, Degree=3, Periodic=False)  # -> Curve, Length, Domain
project_along_2 = ProjectAlong(Geometry=nurbs_curve_2.Curve, Plane=list_item, Direction=list_item)  # -> Geometry, Transform

divide_curve_2 = DivideCurve(Curve=c_script_5.tweenCrv, Count=divide_count, Kinks=False)  # -> Points, Tangents, Parameters

# ---- group: visualize()
panel = Panel("""False
False
True""")
panel_2 = Panel("""False
True
False""")
panel_3 = Panel("""True
False
False""")
panel_4 = Panel("""0.1
2""")
colour_swatch = ColourSwatch(SwatchColor=RGBA(252, 255, 230, 138))
panel_5 = Panel("""0.05
0.1""")
dash_pattern = DashPattern(Curve=c_script_5.tweenCrv, Pattern=panel_4)  # -> Dashes, Gaps; disabled
dash_pattern_2 = DashPattern(Curve=project_along_2.Geometry, Pattern=panel_5)  # -> Dashes, Gaps; disabled
cull_pattern = CullPattern(List=dash_pattern_2.Dashes, CullPattern=panel)
cull_pattern_2 = CullPattern(List=dash_pattern_2.Dashes, CullPattern=panel_2)
cull_pattern_3 = CullPattern(List=dash_pattern_2.Dashes, CullPattern=panel_3)
custom_preview = CustomPreview(Geometry=dash_pattern.Dashes, Material=colour_swatch)
custom_preview_2 = CustomPreview(Geometry=cull_pattern, Material=ColourSwatch(SwatchColor=RGBA(0, 76, 255, 138)))
custom_preview_3 = CustomPreview(Geometry=cull_pattern_2, Material=ColourSwatch(SwatchColor=RGBA(0, 255, 255, 138)))
custom_preview_4 = CustomPreview(Geometry=cull_pattern_3, Material=colour_swatch)

# ---- group: quick preview
merge = Merge(Data1=c_script_5.tweenCrv, Data2=project_along_2.Geometry, Data3=nurbs_curve.Curve)
custom_preview_5 = CustomPreview(Geometry=merge, Material=ColourSwatch(SwatchColor=RGB(255, 255, 255)))

# ---- group: divide
c_script_8 = CSharpScript(cir=nurbs_curve_2.Curve, len=divide_len)  # -> out, PT; inputs cir: Curve, len: Double; disabled
# ---------- c_script_8: C# ----------
Point3d[ ] points = { };
cir.DivideByLength(len,true, out points);
PT = points;
# ---------- end c_script_8 ----------

# ----
c_script_9 = CSharpScript(len=divide_len)  # -> out, PT; inputs cir: Curve, len: Double; disabled; same code as c_script_8
c_script_10 = CSharpScript(center=c_script_8.PT, attractor=list_item)  # -> out, dis; inputs center: Point3d, attractor: Point3d; disabled
# ---------- c_script_10: C# ----------
var distance = center.DistanceTo(attractor);
dis = distance;
# ---------- end c_script_10 ----------
point = Point(c_script_9.PT)
