# Grasshopper definition approach0.gh (Grasshopper 1.0.7)

size = Slider(3, range=0..10)
time_step = Slider(0.038, range=0..0.1)
count = Slider(8606, range=0..10000)
delta_t = Slider(0.038, range=0..0.1)
freq1 = Slider(3, range=0..10)
freq2 = Slider(2, range=0..10)
mag1 = Slider(1, range=0..10)
mag1_2 = Slider(1, range=0..10)
decay1 = Slider(12, range=0..100)
decay2 = Slider(35, range=0..100)
phase1 = Slider(0.166, range=0..1)
phase2 = Slider(0, range=0..1)
count_2 = Slider(100, range=0..1000)
layer_height = Slider(0.048, range=0..0.1)
series = Series(Start="0", Step=time_step, Count=count)
addition = Addition(A=delta_t, B=series)
expression = Expression(
    Magnitude=mag1_2,
    time=addition,
    decay_rate=decay2,
    frequency=freq2,
    PhaseShift=phase2,
    Expression="Magnitude*Exp(-time/decay_rate)*cos(2*π*frequency*time + PhaseShift*time)")
expression_2 = Expression(
    Magnitude=mag1,
    time=addition,
    decay_rate=decay1,
    frequency=freq1,
    PhaseShift=phase1,
    Expression="Magnitude*Exp(-time/decay_rate)*sin(2*π*frequency*time + PhaseShift*time)")
construct_point = ConstructPoint(XCoordinate=expression_2, YCoordinate=expression, ZCoordinate=0)
nurbs_curve = NurbsCurve(Vertices=construct_point, Degree=3, Periodic=False)  # -> Curve, Length, Domain
bounding_box = BoundingBox(Content=nurbs_curve.Curve, Plane=PlaneXY(0, 0, 0))  # -> Box, Box_2
number_slider = Slider(10, range=0..10)
construct_point_2 = ConstructPoint(XCoordinate="0", YCoordinate="0", ZCoordinate="0")
deconstruct_brep = DeconstructBrep(Brep=bounding_box.Box)  # -> Faces, Edges, Vertices
length = Length(Curve=deconstruct_brep.Edges)
list_item = ListItem(List=length, Index=0, Wrap=True)
division = Division(A=size, B=list_item)
scale = Scale(Geometry=nurbs_curve.Curve, Center=construct_point_2, Factor=division)  # -> Geometry, Transform
panel = Panel(list_item)
divide_curve = DivideCurve(Curve=scale.Geometry, Count=count_2, Kinks=False)  # -> Points, Tangents, Parameters
series_2 = Series(Start="0", Step=layer_height, Count=count_2)
shatter = Shatter(Curve=scale.Geometry, Parameters=divide_curve.Parameters)
vector_xyz = VectorXYZ(XComponent=0, YComponent=0, ZComponent=series_2)  # -> Vector, Length
move = Move(Geometry=shatter, Motion=vector_xyz.Vector)  # -> Geometry, Transform
