# Grasshopper definition approach1.gh (Grasshopper 1.0.7)
# plug-ins: Kangaroo2 Components

time_step = Slider(0.1, range=0..0.1)
count = Slider(350, range=0..10000)
delta_t = Slider(0.1, range=0..0.1)
freq1 = Slider(7.963, range=0..10)
mag1 = Slider(1, range=0..10)
phase1 = Slider(0.034, range=0..1)
phase2 = Slider(0.244, range=0..1)
count_2 = Slider(45, range=0..1000)
layer_height = Slider(0.2, range=0..0.2)
size = Slider(20, range=0..50)
degree = Slider(1, range=0..10)
freq2 = Slider(2, range=0..10)
mag2 = Slider(1, range=0..10)
decay1 = Slider(30, range=0..100)
decay2 = Slider(21, range=0..100)
series = Series(Start="0", Step=time_step, Count=count)
addition = Addition(A=delta_t, B=series)
expression = Expression(
    Magnitude=mag2,
    time=addition,
    decay_rate=decay2,
    frequency=freq2,
    PhaseShift=phase2,
    Expression="Magnitude*Exp(-time/decay_rate)*cos(2*π*frequency*time + PhaseShift*time)")
expression_2 = Expression(
    Magnitude=mag1,
    time=addition,
    decay_rate=decay1,
    frequency=freq1,
    PhaseShift=phase1,
    Expression="Magnitude*Exp(-time/decay_rate)*sin(2*π*frequency*time + PhaseShift*time)")
construct_point = ConstructPoint(XCoordinate=expression_2, YCoordinate=expression, ZCoordinate=0)
interpolate = Interpolate(Vertices=construct_point, Degree=degree, Periodic=Toggle(False), KnotStyle=1)  # -> Curve, Length, Domain

bounding_box = BoundingBox(Content=interpolate.Curve, Plane=PlaneXY(0, 0, 0))  # -> Box, Box_2
number_slider = Slider(10, range=0..10)
construct_point_2 = ConstructPoint(XCoordinate="0", YCoordinate="0", ZCoordinate="0")
deconstruct_brep = DeconstructBrep(Brep=bounding_box.Box)  # -> Faces, Edges, Vertices
length = Length(Curve=deconstruct_brep.Edges)
list_item = ListItem(List=length, Index=0, Wrap=True)
division = Division(A=size, B=list_item)
scale = Scale(Geometry=interpolate.Curve, Center=construct_point_2, Factor=division)  # -> Geometry, Transform
panel = Panel(list_item)

splitatcorners = SplitAtCorners(Poly=flatten(scale.Geometry), Angle="0")  # -> Corners, Parts
list_length = ListLength(List=splitatcorners.Parts)
sphere = Sphere(Base=splitatcorners.Corners, Radius="0.1")
subtraction = Subtraction(A=list_length, B="1")
split_list = SplitList(List=splitatcorners.Parts, Index=subtraction)  # -> flatten(ListA), ListB
partition_list = PartitionList(List=split_list.ListA, Size=Slider(5, range=0..10))
join_curves = JoinCurves(Curves=partition_list, Preserve=False)  # -> flatten(Curves)

list_length_2 = ListLength(List=join_curves)
series_2 = Series(Start="0", Step=Slider(0.2, range=0..1), Count=list_length_2)
vector_xyz = VectorXYZ(XComponent=0, YComponent=0, ZComponent=series_2)  # -> Vector, Length
move = Move(Geometry=join_curves, Motion=vector_xyz.Vector)  # -> Geometry, Transform
pipe = Pipe(Curve=move.Geometry, Radius=Slider(0.1, range=0..0.1), Caps=0)
divide_distance = DivideDistance(Curve=move.Geometry, Distance=Slider(0.5, range=0..1))  # -> Points, Tangents, Parameters
custom_preview = CustomPreview(Geometry=move.Geometry, Material=ColourSwatch(SwatchColor=RGBA(255, 255, 255, 200)))

colour_swatch = ColourSwatch(SwatchColor=RGBA(255, 255, 255, 200))  # disabled
custom_preview_2 = CustomPreview(Geometry=scale.Geometry, Material=colour_swatch)  # disabled

# ---- group: MainGcode
c_maincode = CSharpScript(pl=move.Geometry)  # -> out, A, B; inputs pl: Polyline; disabled
# ---------- c_maincode: C# usings ----------
using System.IO;
# ---------- c_maincode: C# ----------
    string code = "";

    double e = Math.Round(0.0, 5);
    int f0 = 2000;
    int f1 = 600;
    double rate = 0.05; // translation from linear dist to extrusion dist

    List<Point3d> pts = new List<Point3d>();

    for (int i = 0; i < pl.Count; i++){
      Point3d pt = pl[i];
      double X = Math.Round(pt.X, 3);
      double Y = Math.Round(pt.Y, 3);
      double Z = Math.Round(pt.Z, 3);
      if(i == 0){
        string line = "G0 F" + f0 + "X" + X + "Y" + Y + "Z" + Z + "\n";
        code += line;
      }
      else{
        double dist = pt.DistanceTo(pl[i - 1]);
        double extrude = Math.Round(dist * rate, 5);
        e += extrude;

        string line = "G1 F" + f1 + " X" + X + " Y" + Y + " Z" + Z + " E" + e + "\n";
        code += line;
      }
    }

    A = code;
    B = pl.Count;
# ---------- end c_maincode ----------
panel_2 = Panel(c_maincode.B)  # disabled
panel_3 = Panel(c_maincode.A)  # disabled
save = Button()  # disabled

c_start = CSharpScript()  # -> out, msg; disabled
# ---------- c_start: C# ----------
    // Sample start code for Dremel 3D45 Printer

    //M190 S35 ;Wait for bed Temperature
    //M104 S220 ;Hotend Temperature
    //M109 S220 ;wait for Hotend Temperature
    //G28 ;Auto Home
    //G1 Z50.00 F400 ;linear move Z<pose>, F<rate>
    //G92 E0 ;set position
    //G1 F200 E3
    //G92 E0
    //M132 X Y Z A
    //M907 X100 Y100 Z60 A100 ;Set motor current
    //M107 ;Fan off


    //Concatenate GCode
    string gcode =
      ";Start Code for Dremel 3D45 Printer" + "\n" +
      "M190 S35" + "\n" +
      "M104 S220" + "\n" +
      "M109 S220" + "\n" +
      "G28" + "\n" +
      "G1 Z50.00 F400" + "\n" +
      "G92 E0" + "\n" +
      "G1 F200 E3" + "\n" +
      "G92 E0" + "\n" +
      "M132 X Y Z A" + "\n" +
      "M907 X100 Y100 Z60 A100" + "\n" +
      "M107";

    msg = gcode;
# ---------- end c_start ----------
c_end = CSharpScript()  # -> out, msg; disabled
# ---------- c_end: C# ----------
    // Sample end code for Dremel 3D45 Printer

    // G1 F1500 E14.00318
    // M107 ;Fan off
    // M104 S0 ;Set Hotend Temp S<temp> T<index>
    // M140 S0 ;Set Bed Temp
    // G92 E1 ;Set Position
    // G1 E-1 F300
    // G162 Z F600
    // G162 X Y F2000
    // M84
    // M104 S0 ;Set hotend Temp S<temp>

    //Concatenate GCode
    string gcode =
      ";End Code" + "\n" +
      "G1 F1500 E14.00318" + "\n" +
      "M107" + "\n" +
      "M104 S0" + "\n" +
      "M140 S0" + "\n" +
      "G92 E1" + "\n" +
      "G1 E-1 F300" + "\n" +
      "G162 Z F600" + "\n" +
      "G162 X Y F2000" + "\n" +
      "M84" + "\n" +
      "M104 S0" + "\n" +
      ";End of Gcode";

    msg = gcode;
# ---------- end c_end ----------
c_gcode = CSharpScript(startCode=c_start.msg, gCode=c_maincode.A, endCode=c_end.msg, save=save)  # -> out, msg; inputs startCode: String, gCode: String, endCode: String, save: Boolean; disabled
# ---------- c_gcode: C# ----------
    string gcode =
      startCode + "\n" +
      gCode +
      endCode;

    msg = gcode;

    // Create the filepath to save the gcode to
    // In this case we are saving to the desktop
    string folder = Environment.GetFolderPath(Environment.SpecialFolder.Desktop);
    string name = "FinalCode_Class";

    string filepath = Path.Combine(folder, name + ".gcode");

    if(save == true){
      File.WriteAllText(filepath, gcode);
    }
# ---------- end c_gcode ----------

panel_4 = Panel(c_start.msg)  # disabled
panel_5 = Panel(c_end.msg)  # disabled
panel_6 = Panel(c_gcode.msg)  # disabled
