# Grasshopper definition 0_2Dtopology.gh (Grasshopper 1.0.7)
# plug-ins: Millipede

number_slider = Slider(-1000000, range=-1000000..1)
toggle = BooleanToggle(True)
unit_y = UnitY(Factor=number_slider)
unit_z = UnitZ(Factor=number_slider)
crv = Curve(<curve referenced from the Rhino model>)
crv_2 = Curve(<curve referenced from the Rhino model>)
crv_3 = Curve(<curve referenced from the Rhino model>)
mat = SupportType(X=True, Y=True, Z=True, RX=toggle, RY=toggle, RZ=toggle)
crv_4 = Curve(<curve referenced from the Rhino model>)
crv_5 = Curve(<curve referenced from the Rhino model>)

curve = Curve(<curve referenced from the Rhino model>)
_2d_density_region = _2DDensityRegion(Boundary=curve, Density=Slider(0.056, range=0..1))

load = _2DLoadRegion(Boundary=crv, Load=unit_y)
load_2 = _2DLoadRegion(Boundary=crv_2, Load=unit_y)
load_3 = _2DLoadRegion(Boundary=crv_3, Load=unit_z)
boundary = _2DBoundaryRegion(Boundary=crv_5, IsVoid=False)
support = _2DSupportRegion(Boundary=crv_4, SupportType=mat, AmendExistingSupports=True, Displacement=Vector(0, 0, 0))
topostruct_2d = Topostruct2DModel(ModelComponents=[boundary, load, support], XResolution=81)  # -> FEModel, CellCentres, CellSize
topostruct_2d_solver = Topostruct2DSolver(
    FEModel=topostruct_2d.FEModel,
    SelfWeightCoefficient=0,
    OptimizationIterations=3,
    Smoothing=0.1,
    Penalization=3,
    TargetDensity=0.3,
    InitialDensities=0.99,
    MinimumDensity=0.001,
    DeleteThreshold=0.5,
    PeriodicX=False,
    PeriodicY=False,
    LoadCase=0,
    AllCases=True,
    CompliantMechanism=False)  # -> FEModel, MaxDeflection
panel = Panel("""1
0
0
0
0
0
0
0
0
0
0
0
0
0
0""")
division = Division(A=Slider(0, range=0..1), B=topostruct_2d_solver.MaxDeflection)
dispatch = Dispatch(List=topostruct_2d.CellCentres, DispatchPattern=panel)  # -> ListA, ListB
_2d_iso_contour = _2DIsoContour(FEModel=topostruct_2d_solver.FEModel, Deflection=0, IsoContourValue=Slider(0.479, range=0..1))
_2d_mesh_results = _2DMeshResults(FEModel=topostruct_2d_solver.FEModel, Deflection=division, ColorMode=1)
stress_lines = StressLines(FEModel=topostruct_2d_solver.FEModel, Seeds=dispatch.ListA)  # -> Curves1, Curves2; disabled
crv_6 = Curve(stress_lines.Curves1)
preview = CustomPreview(Geometry=_2d_iso_contour, Shader=ColourSwatch(SwatchColor=RGB(247, 0, 0)))
