# Grasshopper definition 1_3Dtopology.gh (Grasshopper 1.0.7)
# plug-ins: Millipede

brep = Brep(<brep referenced from the Rhino model>)
neg = Negative(Value=Slider(540, range=0..500000))
Z = UnitZ(Factor=neg)
load = _3DLoadRegion(Boundary=brep, Load=Z)

brep_2 = Brep(<brep referenced from the Rhino model>)
boundary = _3DBoundaryRegion(Boundary=brep_2, IsVoid=Toggle(False))

brep_3 = Brep(<brep referenced from the Rhino model>)
brep_4 = Brep([<brep referenced from the Rhino model> x3])

brep_5 = Brep(<brep referenced from the Rhino model>)
_3d_density_region = _3DDensityRegion(Boundary=brep_5, Density=Slider(0.005, range=0..1))

mat = MillC_StockSupportType(X=True, Y=True, Z=True, RX=True, RY=True, RZ=True)
division = Division(A=neg, B="2")
unit_x = UnitX(Factor=division)
support = _3DSupportRegion(Boundary=brep_4, SupportType=mat, AmendExistingSupports=True)
load_2 = _3DLoadRegion(Boundary=brep_3, Load=unit_x)

topostruct_3d = Topostruct3DModel(ModelComponents=[load, support, boundary, load_2], XResolution=Slider(39, range=2..39))  # -> FEModel, CellCentres, CellSize; disabled
topostruct_3d_solver = Topostruct3DSolver(
    FEModel=topostruct_3d.FEModel,
    SelfWeightCoefficient=0,
    OptimisationIterations=Slider(4, range=0..4),
    Smoothing=Slider(0.5, range=0..1),
    Penalization=3,
    TargetDensity=Slider(0.3, range=0..1),
    MinimumDensity=0.001,
    DeleteThreshold=0.5,
    PeriodicX=False,
    PeriodicY=False,
    PeriodicZ=False,
    LoadCase=0,
    AllCases=True,
    CompliantMechanism=False)  # -> FEModel, MaxDeflection

division_2 = Division(A=Slider(3.061, range=0..10), B=topostruct_3d_solver.MaxDeflection)

_3d_iso_mesh = _3DIsoMesh(FEModel=topostruct_3d_solver.FEModel, Deflection=division_2, IsoContourValue=Slider(0, range=0..1), ColorMode=1)
preview = CustomPreview(Geometry=_3d_iso_mesh, Shader=ColourSwatch(SwatchColor=RGB(181, 181, 181)))

_3d_mesh_results = _3DMeshResults(FEModel=topostruct_3d_solver.FEModel, Deflection=division_2, ColorMode=1)
preview_2 = CustomPreview(Geometry=_3d_mesh_results, Shader=ColourSwatch(SwatchColor=RGBA(191, 191, 191, 70)))

transparency = Slider(0.239, range=0..1)
_3d_cell_results = _3DCellResults(FEModel=topostruct_3d_solver.FEModel)  # -> PrincipalStressPlanes, PrincipalStresses, VonMisesStress, Density

multiplication = Multiplication(A=_3d_cell_results.Density, B=transparency)

c_script = CSharpScript(x=multiplication)  # -> out, A; inputs x: Double
# ---------- c_script: C# ----------
    if (x <= 0.01) A = rn.NextDouble() * 0.01;
    else if (x > 1.0) A = 1.0;
    else A = x;
# ---------- c_script: C# additional code ----------
  Random rn = new Random();
# ---------- end c_script ----------
frgb = ColourRGBF(Alpha=c_script.A, Red=c_script.A, Green=c_script.A, Blue=c_script.A)
cloud = CloudDisplay(Points=_3d_cell_results.PrincipalStressPlanes, Colours=frgb, Size=Slider(1, range=0..1), SpriteType=0)
