# Grasshopper definition final.gh (Grasshopper 1.0.7)
# Copyright: ©2019 GNU General Public License
# plug-ins: Millipede

crystallonv2_cell_selector = CrystallonV2CellSelector({"Prim. Cubic": 0, "BC": 1, "BC Cubic": 2, "FC Cubic": 3, "Edge Octa.": 4, "Vertex Octa.": 5, "NaCl": 6, "Star Tet.": 7, "BC Star Tet.": 8, "Octa. Tet.": 9, "Dodecahedron": 10, "Trunc. Octa.": 11, "Tetrahedral": 12, "Auxetic": 13, "BC1 (tween)": 14, "BC2 (tween)": 15, "Octa. (shell)": 16, "Dodeca. (shell)": 17, "Trunc. Octa. (shell)": 18, "Gyroid (shell)": 19, "Cubic Center (shell)": 20, "Cubic Face (shell)": 21, "LH Square": 22, "LH Round": 23, "LH Square (shell)": 24, "LH Auxetic (shell)": 25, "MC Tri": 26, "MS Tri (shell)": 27, "MC Quad": 28, "MS Quad (shell)": 29}, selected="Prim. Cubic")
boolean_toggle = BooleanToggle(False)
brep = Brep([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])
brep_2 = Brep(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)
mat = SupportType(X=True, Y=True, Z=True, RX=boolean_toggle, RY=boolean_toggle, RZ=boolean_toggle)
crystallonv2_cell_type = CrystallonV2CellType(unit_cell_selector=crystallonv2_cell_selector)
brep_3 = Brep([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])
division = Division(A="-1075500", B=Slider(26, range=0..1000))
mat_2 = Material(MaterialType=2)
crystallonv2_cell_lattice_fill = CrystallonV2CellLatticeFill(unit_cell=crystallonv2_cell_type, voxels=brep_3)
panel = Panel(division)
Z = UnitZ(Factor=division)
curve = Curve(crystallonv2_cell_lattice_fill)
support_region = MSupportTypeRegion(Boundary=brep_2, SupportType=mat, AmmendExistingSupports=True, Displacement=Vector(0, 0, 0), Rotation=Vector(0, 0, 0))
load_region = LoadRegion(Boundary=brep, NodeLoad=Z)
csection = CrossSection(Material=mat_2, Radius=Slider(0.005, range=0..1), CrossSectionType=2)
fcurves = FrameCurves(Curves=curve, CrossSection=csection, LinearLoad=Vector(0, 0, 0), SupportType=0)
merge = Merge(Data1=fcurves, Data2=support_region, Data3=load_region)
fea_system = FEASystem(
    ModelComponents=flatten(merge),
    IntersectAddedCurves=True,
    MergeTolerance=0.0001,
    MinimumCurveSpan=0.05,
    MaximumCurveSpan=10000,
    CurveTolerance=0.1)  # disabled
fe_solver = FESolver(
    FEModel=fea_system,
    SelfWeightCoefficient=1,
    BeamOptimisationIterations=0,
    QuadOptimisationIterations=0,
    OptimizationTarget=0.3,
    OptimizationPenalization=2,
    LoadCase=0,
    AllCases=True)  # -> FEModel, MaxDeflection, Weight, Compliance
panel_2 = Panel(fe_solver.MaxDeflection)
merge_2 = Merge(Data1=curve)
panel_3 = Panel(fe_solver.Weight)

toggle = BooleanToggle(True)
toggle_2 = BooleanToggle(True)
division_2 = Division(A=Slider(0.25, range=0..9), B=fe_solver.MaxDeflection)
swatch = ColourSwatch(SwatchColor=RGB(79, 79, 79))  # disabled

# ---- group: bending
frame_visualization = FrameVisualization(
    FEModel=fe_solver.FEModel,
    DetailedOutput=toggle_2,
    Deflection=division_2,
    Inflation=0,
    Subdivision=0.1,
    OptScale=toggle,
    ColorMode=2)  # -> Curves, Meshes, CompleteRange, VisibleRange

# ---- group: axial
frame_visualization_2 = FrameVisualization(
    FEModel=fe_solver.FEModel,
    DetailedOutput=toggle_2,
    Deflection=division_2,
    Inflation=0,
    Subdivision=0.1,
    OptScale=toggle,
    ColorMode=1)  # -> Curves, Meshes, CompleteRange, VisibleRange

# ---- group: deflection
frame_visualization_3 = FrameVisualization(
    FEModel=fe_solver.FEModel,
    DetailedOutput=toggle_2,
    Deflection=division_2,
    Inflation=0,
    Subdivision=0.1,
    OptScale=toggle,
    ColorMode=7)  # -> Curves, Meshes, CompleteRange, VisibleRange

# ----
panel_4 = Panel(frame_visualization.CompleteRange)
panel_5 = Panel(frame_visualization_2.CompleteRange)
panel_6 = Panel(frame_visualization_3.CompleteRange)

preview = CustomPreview(Geometry=frame_visualization_3.Meshes, Shader=swatch)  # disabled

# ==== cluster CrystallonV2CellLatticeFill: Fill voxels with lattice unit cells

unit_cell = ClusterInput()  # Unit cell to populate voxels
voxels = ClusterInput()  # Voxels to be filled with unit cells
crv = Curve(unit_cell)
bbox = BoundingBox(Content=crv, Plane=PlaneXY(0, 0, 0), UnionBox=True)  # -> Box, Box_2
# CRYSTALLON V2.0 -- Lattice structure tools for Grasshopper3D
# 
# Copyright (C) 2019  Aaron Porterfield
# 
# www.fequalsf.com
# info@fequalsf.com
# 
#     This program is free software: you can redistribute it and/or modify
#     it under the terms of the GNU General Public License as published by
#     the Free Software Foundation, either version 3 of the License, or any later version.
# 
#     This program is distributed in the hope that it will be useful,
#     but WITHOUT ANY WARRANTY; without even the implied warranty of
#     MERCHANTABILITY or FITNESS FOR A PARTICULAR PURPOSE.  See the
#     GNU General Public License for more details.
# 
#     You should have received a copy of the GNU General Public License
#     along with this program.  If not, see <http://www.gnu.org/licenses/>.
panel = Panel("CELL FILL")
morph = BoxMorph(Geometry=crv, Reference=bbox.Box, Target=graft(voxels))  # -> flatten(Geometry)
remove_duplicate_lines = RemoveDuplicateLines(lattice_l=flatten(morph))
lattice = ClusterOutput(remove_duplicate_lines)  # List of curves that make up the lattice

# ==== cluster CrystallonV2CellType: A collection of pre-made unit cells

crv = Curve([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])
crv_2 = Curve([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])
crv_3 = Curve([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])
crv_4 = Curve([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])
crv_5 = Curve([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])
mesh = Mesh(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)
mesh_2 = Mesh(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)
mesh_3 = Mesh(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)
mesh_4 = Mesh([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])
crv_6 = Curve([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])
crv_7 = Curve([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])
crv_8 = Curve([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])
crv_9 = Curve([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])
crv_10 = Curve([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])
crv_11 = Curve([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])
crv_12 = Curve([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])
crv_13 = Curve([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])
crv_14 = Curve([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])
crv_15 = Curve([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])
crv_16 = Curve([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])
mesh_5 = Mesh(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)
mesh_6 = Mesh(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)
mesh_7 = Mesh(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)
mesh_8 = Mesh(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)
crv_17 = Curve([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])
crv_18 = Curve([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])
mesh_9 = Mesh(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)
geo = Geometry([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])
geo_2 = Geometry([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])
mesh_10 = Mesh([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])
panel = Panel("CELL TYPES")
entwine = Entwine(
    Branch00=crv_6,
    Branch01=crv_7,
    Branch02=crv,
    Branch03=crv_8,
    Branch04=crv_2,
    Branch05=crv_9,
    Branch06=crv_3,
    Branch07=crv_10,
    Branch08=crv_11,
    Branch09=crv_12,
    Branch010=crv_4,
    Branch011=crv_5,
    Branch012=crv_13,
    Branch013=crv_14,
    Branch014=crv_15,
    Branch015=crv_16,
    Branch016=mesh,
    Branch017=mesh_5,
    Branch018=mesh_6,
    Branch019=mesh_2,
    Branch020=mesh_7,
    Branch021=mesh_8,
    Branch022=crv_17,
    Branch023=crv_18,
    Branch024=mesh_9,
    Branch025=mesh_3,
    Branch026=geo,
    Branch027=mesh_4,
    Branch028=geo_2,
    Branch029=mesh_10,
    FlattenInputs=True)  # -> simplify(Result)
unit_cell_selector = ClusterInput()
branch = TreeBranch(Tree=entwine, Path=unit_cell_selector, MaintainPaths=True)
unit_cell = ClusterOutput(branch)  # Single unit cell to populate voxels

# ==== cluster RemoveDuplicateLines
lattice_l = ClusterInput()
crv = Curve(lattice_l)
curvepoint = PointOnCurve(crv, parameter=0.5)
cullpt = CullDuplicates(Points=curvepoint, Tolerance=".001", CullMode=1)  # -> Points, Indices, Valence
item = ListItem(List=crv, Index=cullpt.Indices, Wrap=True)
lattice = ClusterOutput(item)
