# Grasshopper definition graphic statics.gh (Grasshopper 1.0.7)
# plug-ins: 3D Graphic Statics V02

xy_plane = XYPlane(Origin=Point(0, 0, 0))
vector_xyz = VectorXYZ(XComponent=0, YComponent=0, ZComponent=Slider(5, range=0..10))  # -> Vector, Length
pyramid_solid = PyramidSolid(
    Plane=xy_plane,
    Sides=Slider(8, range=0..10),
    BaseEdgeLength=Slider(2, range=0..10),
    TopEdgeLength=0,
    Height=vector_xyz.Vector)  # -> Brep, Mesh, RadiusBase, RadiusTop
xy_plane_2 = XYPlane(Origin=Point(0, 0, 0))
number_slider = Slider(1, range=0..10)
select_polyhedra_nodes = SelectPolyhedraNodes(Polyhedra=pyramid_solid.Brep, ExtractMethod=Slider(0, range=0..100), PolyhedraIndices=0, Plane=xy_plane_2)  # -> Polyhedra, PolyhedonIndex, Patern
subdivide_polyhedra_nodes = SubdividePolyhedraNodes(Brep=pyramid_solid.Brep, Index=select_polyhedra_nodes.PolyhedonIndex, Subdiv=number_slider, Parallel=True)  # -> Brep, Indices, SubdivLevels
xz_plane = XZPlane(Origin=Point(0, 0, 0))
select_faces_edges = SelectFacesEdges(Faces=subdivide_polyhedra_nodes.Brep, ExtractMethod=Slider(4, range=0..10), FaceIndices=0, Planes=xz_plane)  # -> Faces, FaceIndex, Patern
subdivide_faces_edges = SubdivideFacesEdges(Brep=subdivide_polyhedra_nodes.Brep, Index=select_faces_edges.FaceIndex, Subdiv=number_slider, Parallel=True)  # -> Brep, Indices, SubdivLevels
yz_plane = YZPlane(Origin=Point(0, 0, 0))
select_faces_edges_2 = SelectFacesEdges(Faces=subdivide_faces_edges.Brep, ExtractMethod=Slider(2, range=0..10), FaceIndices=yz_plane)  # -> Faces, FaceIndex, Patern
subdivide_faces_edges_2 = SubdivideFacesEdges(Brep=subdivide_faces_edges.Brep, Index=select_faces_edges_2.FaceIndex, Subdiv=Slider(1, range=0..1), Parallel=True)  # -> Brep, Indices, SubdivLevels
constructor_for_direct_method = ConstructorForDIRECTMethod(Breps=subdivide_faces_edges_2.Brep, ParallelComputing=True)  # -> _3DGS, PreviewLines
form_solver = FormSolver(
    _3DGS=constructor_for_direct_method._3DGS,
    ParallelComputing=Toggle(True),
    Run=Toggle(True),
    Reset=Button(),
    Trigger=False,
    MaximumNumberOfIterations=Slider(7000, range=0..10000),
    AngleTolerance=Slider(0.01, range=0..0.01),
    MinEdgeLength=Slider(1.05, range=0..10),
    PreviewNth=Slider(100, range=0..100))  # -> _3DGS, Preview, CurrentIteration, Angles, AngleDomain
