# Grasshopper definition stress line.gh (Grasshopper 1.0.7)
# plug-ins: Millipede

# geometric input options
mesh = Mesh(<mesh referenced from the Rhino model>)
surface = Surface(<surface referenced from the Rhino model>)
toggle = BooleanToggle(True)
negative = Negative(Value=Slider(1000, range=0..1000))
unit_z = UnitZ(Factor=negative)
point = Point([<point referenced from the Rhino model> x2])
mat = SupportType(X=True, Y=True, Z=True, RX=toggle, RY=toggle, RZ=toggle)
point_2 = Point([<point referenced from the Rhino model> x2])
mesh_uv = MeshSurface(Surface=surface, UCount=Slider(50, range=0..50), VCount=Slider(20, range=0..50), Overhang=True, Equalize=Toggle(True))
fe_point_load = FEPointLoad(Point=point, Load=unit_z)
fe_point_supports = FEPointSupports(Point=point_2, SupportType=mat, Displacement=Vector(0, 0, 0), Rotation=Vector(0, 0, 0))
mat_2 = Material(MaterialType=5)
femesh = FEMesh(Meshes=mesh, Material=mat_2, Thickness=Slider(0.2, range=0..1), AreaLoad=Vector(0, 0, 0), NormalAreaLoad=0)

fea_system = FEASystem(
    ModelComponents=flatten([femesh, fe_point_supports, fe_point_load]),
    IntersectAddedCurves=True,
    MergeTolerance=0.0001,
    MinimumCurveSpan=0.05,
    MaximumCurveSpan=10000,
    CurveTolerance=0.1)
fe_solver = FESolver(
    FEModel=fea_system,
    SelfWeightCoefficient=1,
    BeamOptimisationIterations=0,
    QuadOptimisationIterations=0,
    OptimizationTarget=0.3,
    OptimizationPenalization=2,
    LoadCase=0,
    AllCases=True)  # -> FEModel, MaxDeflection, Weight, Compliance

demesh = DeconstructMesh(Mesh=mesh_uv)  # -> Vertices, Faces, Colours, Normals

panel = Panel(fe_solver.MaxDeflection)
panel_2 = Panel(fe_solver.Weight)
division = Division(A=Slider(0.93, range=0..1), B=fe_solver.MaxDeflection)
mesh_visualization = MeshVisualization(FEModel=fe_solver.FEModel, Deflection=division, Plane=1, ShowThickness=Toggle(True), ColorMode=3)  # -> Mesh, CompleteRange, VisibleRange

stresslines = StressLines(FEModel=fe_solver.FEModel, Points=demesh.Vertices, Plane=1)  # -> Stress1, Stress2
preview = CustomPreview(Geometry=stresslines.Stress1, Shader=ColourSwatch(SwatchColor=RGB(255, 255, 255)))
preview_2 = CustomPreview(Geometry=stresslines.Stress2, Shader=ColourSwatch(SwatchColor=RGB(255, 0, 0)))

stress_pattern = StressPattern(
    FEModel=fea_system,
    Omega=1,
    Scalefield=True,
    Uselambda=False,
    Smoothfactor=0,
    SmoothModulo=1,
    Iterations=0,
    MeshDenisty=1,
    Layer=1,
    Thickness=0,
    Bending=False)
