# Grasshopper definition thinning edges.gh (Grasshopper 1.0.7)
# Copyright: ©2019 GNU General Public License
# plug-ins: Weaverbird

# ---- group: Geometry
pt = ConstructPoint(XCoordinate="20", YCoordinate="20", ZCoordinate=0)
planesrf = PlaneSurface(Plane=pt, XSize=Domain(-10, 10), YSize=Domain(-10, 10))
Z = UnitZ(Factor="20")
range = Range(Domain=Domain(0, 1), Steps=Slider(5, range=0..10))
move = Move(Geometry=planesrf, Motion=Z)  # -> Geometry, Transform
mbs = CrystallonV2MorphBetweenSurfaces(surfaces=[planesrf, move.Geometry], x_parameter=range, y_parameter=range, z_parameter=range)

# ---- group: Values
neg = Negative(Value="10")
number_slider = Slider(10, range=0..100)
dom = ConstructDomain(DomainStart=neg, DomainEnd="10")
dom_2 = ConstructDomain(DomainStart="0", DomainEnd="20")
box = DomainBox(Base=pt, X=dom, Y=dom, Z=dom_2)
pop3d = Populate3D(Region=box, Count=number_slider, Seed=1)
random = Random(Range=Domain(0, 1), Number=number_slider, Seed=2)
gradient = Gradient(LowerLimit=0, UpperLimit=1, Parameter=random, stops=[0: RGB(255, 255, 255), 1: RGB(0, 0, 0)])
preview = CustomPreview(Geometry=pop3d, Material=gradient)

# ---- group: Attractor
md_slider = MDSlider(
    SliderMode=0,
    slider_value=Point(0.1232725702, 0.5500183105, 0.5),
    x_domain=Domain(0, 1),
    y_domain=Domain(0, 1),
    z_domain=Domain(0, 1))
Z_2 = UnitZ(Factor=Slider(16.095, range=0..20))
move_2 = Move(Geometry=planesrf, Motion=Z_2)  # -> Geometry, Transform
evalsrf = EvaluateSurface(Surface=reparameterize(move_2.Geometry), Point=md_slider)  # -> Point, Normal, UDirection, VDirection, Frame
sph = Sphere(Base=evalsrf.Point, Radius=1)

# ----
brep = Brep([<brep referenced from the Rhino model> x2432])
box_2 = Box(brep)
panel = Panel(mbs)

# ---- group: Shell Fill
unit_cell_selector = CrystallonV2CellSelector({"Prim. Cubic": 0, "BC": 1, "BC Cubic": 2, "FC Cubic": 3, "Edge Octa.": 4, "Vertex Octa.": 5, "NaCl": 6, "Star Tet.": 7, "BC Star Tet.": 8, "Octa. Tet.": 9, "Dodecahedron": 10, "Trunc. Octa.": 11, "Tetrahedral": 12, "Auxetic": 13, "BC1 (tween)": 14, "BC2 (tween)": 15, "Octa. (shell)": 16, "Dodeca. (shell)": 17, "Trunc. Octa. (shell)": 18, "Gyroid (shell)": 19, "Cubic Center (shell)": 20, "Cubic Face (shell)": 21, "LH Square": 22, "LH Round": 23, "LH Square (shell)": 24, "LH Auxetic (shell)": 25, "MC Tri": 26, "MS Tri (shell)": 27, "MC Quad": 28, "MS Quad (shell)": 29}, selected="Gyroid (shell)")
ct = CrystallonV2CellType(unit_cell_selector=unit_cell_selector)
csf = CrystallonV2CellShellFill(unit_cell_shell=ct, voxels=box_2, tolerance=".1")

# ---- group: Cell Fill
unit_cell_selector_2 = CrystallonV2CellSelector({"Prim. Cubic": 0, "BC": 1, "BC Cubic": 2, "FC Cubic": 3, "Edge Octa.": 4, "Vertex Octa.": 5, "NaCl": 6, "Star Tet.": 7, "BC Star Tet.": 8, "Octa. Tet.": 9, "Dodecahedron": 10, "Trunc. Octa.": 11, "Tetrahedral": 12, "Auxetic": 13, "BC1 (tween)": 14, "BC2 (tween)": 15, "Octa. (shell)": 16, "Dodeca. (shell)": 17, "Trunc. Octa. (shell)": 18, "Gyroid (shell)": 19, "Cubic Center (shell)": 20, "Cubic Face (shell)": 21, "LH Square": 22, "LH Round": 23, "LH Square (shell)": 24, "LH Auxetic (shell)": 25, "MC Tri": 26, "MS Tri (shell)": 27, "MC Quad": 28, "MS Quad (shell)": 29}, selected="BC")
ct_2 = CrystallonV2CellType(unit_cell_selector=unit_cell_selector_2)
clf = CrystallonV2CellLatticeFill(unit_cell=ct_2, voxels=box_2)

# ---- group: Lattice Thickness (value)
ltv = CrystallonV2LatticeThicknessValue(
    lattice=clf,
    points=pop3d,
    values=random,
    distance_influence=Toggle(True),
    influence=Slider(0.228, range=0..1),
    magnitude_min=Slider(0.087, range=0..1),
    magnitude_max=Slider(0.582, range=0..1))
pipe = Pipe(Curve=clf, Radius=ltv, Caps=0)
preview_2 = CustomPreview(Geometry=pipe, Material=ColourSwatch(SwatchColor=RGB(120, 120, 120)))

# ---- group: Shell Thickness (value)
stv = CrystallonV2ShellThicknessValue(
    lattice_shell=csf,
    points=pop3d,
    values=random,
    distance_influence=Toggle(True),
    influence=Slider(0.228, range=0..1),
    magnitude_min=Slider(0.087, range=0..1),
    magnitude_max=Slider(0.582, range=0..1))
wbthicken = WeaverbirdsMeshThicken(MeshCurves=csf, Distance=stv, OffsetType=0)
preview_3 = CustomPreview(Geometry=wbthicken, Material=ColourSwatch(SwatchColor=RGB(120, 120, 120)))

# ---- group: Shell Thickness (attractor)
sta = CrystallonV2ShellThicknessAttractor(
    lattice_shell=csf,
    attractor=evalsrf.Point,
    influence=Slider(0.228, range=0..1),
    magnitude_min=Slider(0.118, range=0..1),
    magnitude_max=Slider(1, range=0..1))
wbthicken_2 = WeaverbirdsMeshThicken(MeshCurves=csf, Distance=sta, OffsetType=0)
preview_4 = CustomPreview(Geometry=wbthicken_2, Material=ColourSwatch(SwatchColor=RGB(120, 120, 120)))

# ---- group: Lattice Thickness (attractor)
lta = CrystallonV2LatticeThicknessAttractor(
    lattice=clf,
    attractor=evalsrf.Point,
    influence=Slider(0.228, range=0..1),
    magnitude_min=Slider(0.087, range=0..1),
    magnitude_max=Slider(0.582, range=0..1))
pipe_2 = Pipe(Curve=clf, Radius=lta, Caps=0)
preview_5 = CustomPreview(Geometry=pipe_2, Material=ColourSwatch(SwatchColor=RGB(120, 120, 120)))

# ----
pipe_3 = Pipe(Curve=clf, Radius=Slider(0.02, range=0..0.5), Caps=Toggle(True))
preview_6 = CustomPreview(Geometry=pipe_3, Material=ColourSwatch(SwatchColor=RGB(120, 120, 120)))

# ==== cluster CrystallonV2CellLatticeFill: Fill voxels with lattice unit cells

unit_cell = ClusterInput()  # Unit cell to populate voxels
voxels = ClusterInput()  # Voxels to be filled with unit cells
crv = Curve(unit_cell)
bbox = BoundingBox(Content=crv, Plane=PlaneXY(0, 0, 0), UnionBox=True)  # -> Box, Box_2
# CRYSTALLON V2.0 -- Lattice structure tools for Grasshopper3D
# 
# Copyright (C) 2019  Aaron Porterfield
# 
# www.fequalsf.com
# info@fequalsf.com
# 
#     This program is free software: you can redistribute it and/or modify
#     it under the terms of the GNU General Public License as published by
#     the Free Software Foundation, either version 3 of the License, or any later version.
# 
#     This program is distributed in the hope that it will be useful,
#     but WITHOUT ANY WARRANTY; without even the implied warranty of
#     MERCHANTABILITY or FITNESS FOR A PARTICULAR PURPOSE.  See the
#     GNU General Public License for more details.
# 
#     You should have received a copy of the GNU General Public License
#     along with this program.  If not, see <http://www.gnu.org/licenses/>.
panel = Panel("CELL FILL")
morph = BoxMorph(Geometry=crv, Reference=bbox.Box, Target=graft(voxels))  # -> flatten(Geometry)
remove_duplicate_lines = RemoveDuplicateLines(lattice_l=flatten(morph))
lattice = ClusterOutput(remove_duplicate_lines)  # List of curves that make up the lattice

# ==== cluster CrystallonV2CellType: A collection of pre-made unit cells

crv = Curve([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])
crv_2 = Curve([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])
crv_3 = Curve([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])
crv_4 = Curve([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])
crv_5 = Curve([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])
mesh = Mesh(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)
mesh_2 = Mesh(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)
mesh_3 = Mesh(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)
mesh_4 = Mesh([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])
crv_6 = Curve([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])
crv_7 = Curve([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])
crv_8 = Curve([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])
crv_9 = Curve([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])
crv_10 = Curve([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])
crv_11 = Curve([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])
crv_12 = Curve([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])
crv_13 = Curve([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])
crv_14 = Curve([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])
crv_15 = Curve([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])
crv_16 = Curve([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])
mesh_5 = Mesh(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)
mesh_6 = Mesh(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)
mesh_7 = Mesh(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)
mesh_8 = Mesh(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)
crv_17 = Curve([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])
crv_18 = Curve([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])
mesh_9 = Mesh(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)
geo = Geometry([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])
geo_2 = Geometry([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])
mesh_10 = Mesh([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])
panel = Panel("CELL TYPES")
entwine = Entwine(
    Branch00=crv_6,
    Branch01=crv_7,
    Branch02=crv,
    Branch03=crv_8,
    Branch04=crv_2,
    Branch05=crv_9,
    Branch06=crv_3,
    Branch07=crv_10,
    Branch08=crv_11,
    Branch09=crv_12,
    Branch010=crv_4,
    Branch011=crv_5,
    Branch012=crv_13,
    Branch013=crv_14,
    Branch014=crv_15,
    Branch015=crv_16,
    Branch016=mesh,
    Branch017=mesh_5,
    Branch018=mesh_6,
    Branch019=mesh_2,
    Branch020=mesh_7,
    Branch021=mesh_8,
    Branch022=crv_17,
    Branch023=crv_18,
    Branch024=mesh_9,
    Branch025=mesh_3,
    Branch026=geo,
    Branch027=mesh_4,
    Branch028=geo_2,
    Branch029=mesh_10,
    FlattenInputs=True)  # -> simplify(Result)
unit_cell_selector = ClusterInput()
branch = TreeBranch(Tree=entwine, Path=unit_cell_selector, MaintainPaths=True)
unit_cell = ClusterOutput(branch)  # Single unit cell to populate voxels

# ==== cluster CrystallonV2CellShellFill: Fill voxels with shell unit cells

unit_cell_shell = ClusterInput()  # Unit cell to populate voxels
tolerance = ClusterInput()  # Tolerance for merging faces and vertices (number usually between 0.001 and 0.1)
voxels = ClusterInput()  # Voxels to be filled with unit cells
geo = Geometry(unit_cell_shell)
bbox = BoundingBox(Content=geo, Plane=PlaneXY(0, 0, 0), UnionBox=True)  # -> Box, Box_2
morph = BoxMorph(Geometry=geo, Reference=bbox.Box, Target=graft(voxels))  # -> flatten(Geometry)
mjoin = MeshJoin(Meshes=morph)
panel = Panel("CELL SHELL FILL")
demesh = DeconstructMesh(Mesh=mjoin)  # -> Vertices, Faces, Colours, Normals
facen = FaceNormals(Mesh=mjoin)  # -> Centers, Normals
cullpt = CullDuplicates(Points=facen.Centers, Tolerance=tolerance, CullMode=1)  # -> Points, Indices, Valence
item = ListItem(List=demesh.Faces, Index=cullpt.Indices, Wrap=True)
conmesh = ConstructMesh(Vertices=demesh.Vertices, Faces=item)
weld = WeldMesh(Mesh=conmesh, Angle=3.141592654)
c_script = CSharpScript(M=weld, radius=tolerance)  # -> out, A; inputs M: Mesh, radius: Double
# ---------- c_script: C# usings ----------
using System.IO;
using System.Linq;
using System.Data;
using System.Drawing;
using System.Reflection;
using System.Windows.Forms;
using System.Xml;
using System.Xml.Linq;
using System.Runtime.InteropServices;

using Rhino.DocObjects;
using Rhino.Collections;
using GH_IO;
using GH_IO.Serialization;
# ---------- c_script: C# ----------
    Component.Message = "Weld Mesh - RTree";


    //Store naked mesh vertices and their ids
    List<Point3f> pts = new List<Point3f>();
    bool[] flag = M.GetNakedEdgePointStatus();

    allPointsFound = new List<List<int>>();

    //History is need to stop searching rtee
    //When all point groups are found
    history.Clear();

    //Create Rtree
    RTree tree = new RTree();

    for(int i = 0; i < flag.Length; i++){
      if(flag[i]){
        tree.Insert(M.Vertices[i], i);
        pts.Add(M.Vertices[i]);
      }
    }

    //Search RTree
    for(int i = 0; i < pts.Count; i++){
      tempIDList = new List<int>();
      tree.Search(new Sphere(pts[i], radius), method);

      if(tempIDList.Count > 1)
        allPointsFound.Add(tempIDList);

      if(history.Count == M.Vertices.Count)
        break;
    }

    //Now move found vertices to one of firs vertex position
    foreach(List<int> i in allPointsFound)
      for(int j = 1; j < i.Count; j++)
        M.Vertices[i[0]] = M.Vertices[i[j]];

    M.Vertices.CombineIdentical(true, true);


    A = M;
# ---------- c_script: C# additional code ----------
  //Rtree collections
  List<int> history = new List<int>();
  List<List<int>> allPointsFound;
  List<int> tempIDList;

  private void method(object sender, RTreeEventArgs e){
    if(!history.Contains(e.Id)){
      tempIDList.Add(e.Id);
      history.Add(e.Id);
    }
  }
# ---------- end c_script ----------
lattice_shell = ClusterOutput(c_script.A)  # Joined mesh that makes up the lattice

# ==== cluster CrystallonV2MorphBetweenSurfaces: Conformal fill of voxels between two or more surfaces

x_parameter = ClusterInput()  # Range of numbers (0-1) for X divisions
z_parameter = ClusterInput()  # Range of numbers (0-1) for Z divisions
surfaces = ClusterInput()  # At least 2 surfaces to morph voxels between
y_parameter = ClusterInput()  # Range of numbers (0-1) for Y divisions
srf = Surface(flatten(surfaces))
num = Number(y_parameter)
num_2 = Number(x_parameter)
num_3 = Number(z_parameter)
pt = ConstructPoint(XCoordinate=simplify(graft(num_2)), YCoordinate=simplify(num), ZCoordinate=0)  # -> simplify(Point)
lng = ListLength(List=num_2)
num_4 = Number(lng)
evalsrf = EvaluateSurface(Surface=reparameterize(simplify(srf)), Point=simplify(graft(pt)))  # -> simplify(Point), Normal, Frame
pline = PolyLine(Vertices=evalsrf.Point, Closed=False)
eval = EvaluateCurve(Curve=reparameterize(pline), Parameter=num_3)  # -> Point, Tangent, Angle
path_mapper = PathMapper(eval.Point, source="{A;B}(i)", target="{B;A}(i)")
path_mapper_2 = PathMapper(path_mapper, source="{A;B}", target="{path_index}")
toggle = BooleanToggle(False)
shift = ShiftList(List=path_mapper_2, Shift="1", Wrap=toggle)
shift_2 = ShiftList(List=path_mapper_2, Shift="-1", Wrap=toggle)
flip = FlipMatrix(Data=shift)
flip_2 = FlipMatrix(Data=shift_2)
partition = PartitionList(List=flip_2, Size=num_4)
partition_2 = PartitionList(List=flip, Size=num_4)
shift_3 = ShiftList(List=partition, Shift="-1", Wrap=toggle)  # -> simplify(List)
shift_4 = ShiftList(List=partition, Shift="1", Wrap=toggle)  # -> simplify(List)
shift_5 = ShiftList(List=partition_2, Shift="1", Wrap=toggle)  # -> simplify(List)
shift_6 = ShiftList(List=partition_2, Shift="-1", Wrap=toggle)  # -> simplify(List)
path_mapper_3 = PathMapper(shift_4, source="{A;B}(i)", target="{A;i}(B)")
path_mapper_4 = PathMapper(shift_3, source="{A;B}(i)", target="{A;i}(B)")
path_mapper_5 = PathMapper(shift_5, source="{A;B}(i)", target="{A;i}(B)")
path_mapper_6 = PathMapper(shift_6, source="{A;B}(i)", target="{A;i}(B)")
shift_7 = ShiftList(List=path_mapper_4, Shift="-1", Wrap=toggle)
shift_8 = ShiftList(List=path_mapper_3, Shift="1", Wrap=toggle)
shift_9 = ShiftList(List=path_mapper_3, Shift="-1", Wrap=toggle)
shift_10 = ShiftList(List=path_mapper_6, Shift="-1", Wrap=toggle)
shift_11 = ShiftList(List=path_mapper_4, Shift="1", Wrap=toggle)
shift_12 = ShiftList(List=path_mapper_5, Shift="1", Wrap=toggle)
shift_13 = ShiftList(List=path_mapper_5, Shift="-1", Wrap=toggle)
shift_14 = ShiftList(List=path_mapper_6, Shift="1", Wrap=toggle)
tbox = TwistedBox(
    CornerA=shift_11,
    CornerB=shift_7,
    CornerC=shift_9,
    CornerD=shift_8,
    CornerE=shift_14,
    CornerF=shift_10,
    CornerG=shift_13,
    CornerH=shift_12)
voxels = ClusterOutput(tbox)  # Voxels to be filled with unit cells

# ==== cluster CrystallonV2LatticeThicknessAttractor: Apply thickness values to lattice curves with attractor(s)

lattice = ClusterInput()  # Lattice to thicken
attractor = ClusterInput()  # Any geometry to use as attractor(s)
influence = ClusterInput()  # Smoothed range of attractor influence (0-1)
magnitude_min = ClusterInput()  # Lattice beam thickness (minimum value)
magnitude_max = ClusterInput()  # Lattice beam thickness (maximum value)
crv = Curve(lattice)
geo = Geometry(attractor)
curvepoint = PointOnCurve(crv, parameter=0.5)
pull = PullPoint(Point=curvepoint, Geometry=geo, ClosestOnly=True)  # -> ClosestPoint, Distance
panel = Panel("THICKNESS ATTRACTOR")
expression = Expression(x=influence, y=pull.Distance, Expression="-1*e^(-x*y)")
dom = ConstructDomain(DomainStart=magnitude_min, DomainEnd=magnitude_max)
bnd = Bounds(Numbers=expression)
dedomain = DeconstructDomain(Domain=bnd)  # -> Start, End
dom_2 = ConstructDomain(DomainStart=dedomain.End, DomainEnd=dedomain.Start)
remap = RemapNumbers(Value=expression, Source=dom_2, Target=dom)  # -> Mapped, Clipped
value = ClusterOutput(remap.Mapped)  # Values for beam thickness

# ==== cluster CrystallonV2LatticeThicknessValue: Apply thickness values to lattice curves with a point cloud and corrosponding values

lattice = ClusterInput()  # Lattice to thicken
points = ClusterInput()  # List of points (flattened)
values = ClusterInput()  # Values that correspond to points (flattened)
distance_influence = ClusterInput()  # If true the distance between the points and voxels will affect the magnitude
influence = ClusterInput()  # Smoothed range of attractor influence (0-1)
magnitude_min = ClusterInput()  # Lattice beam thickness (minimum value)
magnitude_max = ClusterInput()  # Lattice beam thickness (maximum value)
crv = Curve(lattice)
curvepoint = PointOnCurve(crv, parameter=0.5)
num = Number(values)
pt = Point(points)
cp = ClosestPoint(Point=curvepoint, Cloud=pt)  # -> ClosestPoint, CPIndex, Distance
dom = ConstructDomain(DomainStart=magnitude_min, DomainEnd=magnitude_max)
item = ListItem(List=num, Index=cp.CPIndex, Wrap=True)
panel = Panel("THICKNESS VALUE")
expression = Expression(x=influence, y=cp.Distance, Expression="-1*e^(-x*y)")
bnd = Bounds(Numbers=item)
remap = RemapNumbers(Value=item, Source=bnd, Target=dom)  # -> Mapped, Clipped
not = GateNot(A=distance_influence)
bnd_2 = Bounds(Numbers=expression)
remap_2 = RemapNumbers(Value=expression, Source=bnd_2, Target="1 to 0")  # -> Mapped, Clipped
cull = CullPattern(List=remap.Mapped, CullPattern=not)
multiplication = Multiplication(A=remap.Mapped, B=remap_2.Mapped)
cull_2 = CullPattern(List=multiplication, CullPattern=distance_influence)
bnd_3 = Bounds(Numbers=cull_2)
remap_3 = RemapNumbers(Value=cull_2, Source=bnd_3, Target=dom)  # -> Mapped, Clipped
num_2 = Number([remap_3.Mapped, cull])
value = ClusterOutput(num_2)  # Values for beam thickness

# ==== cluster CrystallonV2ShellThicknessAttractor: Apply thickness values to shell vertices with attractor(s)

lattice_shell = ClusterInput()  # Lattice shell to thicken
attractor = ClusterInput()  # Any geometry to use as attractor(s)
influence = ClusterInput()  # Smoothed range of attractor influence (0-1)
magnitude_min = ClusterInput()  # Lattice shell thickness (minimum value)
magnitude_max = ClusterInput()  # Lattice shell thickness (maximum value)
mesh = Mesh(lattice_shell)
geo = Geometry(attractor)
demesh = DeconstructMesh(Mesh=mesh)  # -> Vertices, Faces, Colours, Normals
pull = PullPoint(Point=demesh.Vertices, Geometry=geo, ClosestOnly=True)  # -> ClosestPoint, Distance
panel = Panel("SHELL THICKNESS ATTRACTOR")
expression = Expression(x=influence, y=pull.Distance, Expression="-1*e^(-x*y)")
dom = ConstructDomain(DomainStart=magnitude_min, DomainEnd=magnitude_max)
bnd = Bounds(Numbers=expression)
dedomain = DeconstructDomain(Domain=bnd)  # -> Start, End
dom_2 = ConstructDomain(DomainStart=dedomain.End, DomainEnd=dedomain.Start)
remap = RemapNumbers(Value=expression, Source=dom_2, Target=dom)  # -> Mapped, Clipped
value = ClusterOutput(remap.Mapped)  # Values for shell thickness (mesh vertices)

# ==== cluster CrystallonV2ShellThicknessValue: Apply thickness values to shell vertices with a point cloud and corrosponding values

lattice_shell = ClusterInput()  # Lattice shell to thicken
points = ClusterInput()  # List of points (flattened)
values = ClusterInput()  # Values that correspond to points (flattened)
distance_influence = ClusterInput()  # If true the distance between the points and voxels will affect the magnitude
influence = ClusterInput()  # Smoothed range of attractor influence (0-1)
magnitude_min = ClusterInput()  # Lattice shell thickness (minimum value)
magnitude_max = ClusterInput()  # Lattice shell thickness (maximum value)
mesh = Mesh(lattice_shell)
num = Number(values)
pt = Point(points)
demesh = DeconstructMesh(Mesh=mesh)  # -> Vertices, Faces, Colours, Normals
cp = ClosestPoint(Point=demesh.Vertices, Cloud=pt)  # -> ClosestPoint, CPIndex, Distance
item = ListItem(List=num, Index=cp.CPIndex, Wrap=True)
expression = Expression(x=influence, y=cp.Distance, Expression="-1*e^(-x*y)")
dom = ConstructDomain(DomainStart=magnitude_min, DomainEnd=magnitude_max)
bnd = Bounds(Numbers=item)
panel = Panel("SHELL THICKNESS VALUE")
remap = RemapNumbers(Value=item, Source=bnd, Target=dom)  # -> Mapped, Clipped
bnd_2 = Bounds(Numbers=expression)
not = GateNot(A=distance_influence)
remap_2 = RemapNumbers(Value=expression, Source=bnd_2, Target="1 to 0")  # -> Mapped, Clipped
multiplication = Multiplication(A=remap.Mapped, B=remap_2.Mapped)
cull = CullPattern(List=remap.Mapped, CullPattern=not)
cull_2 = CullPattern(List=multiplication, CullPattern=distance_influence)
bnd_3 = Bounds(Numbers=cull_2)
remap_3 = RemapNumbers(Value=cull_2, Source=bnd_3, Target=dom)  # -> Mapped, Clipped
num_2 = Number([remap_3.Mapped, cull])
value = ClusterOutput(num_2)  # Values for shell thickness (mesh vertices)

# ==== cluster RemoveDuplicateLines
lattice_l = ClusterInput()
crv = Curve(lattice_l)
curvepoint = PointOnCurve(crv, parameter=0.5)
cullpt = CullDuplicates(Points=curvepoint, Tolerance=".001", CullMode=1)  # -> Points, Indices, Valence
item = ListItem(List=crv, Index=cullpt.Indices, Wrap=True)
lattice = ClusterOutput(item)
