# Grasshopper definition voxel_approach0.gh (Grasshopper 1.0.7)
# Copyright: ©2019 GNU General Public License

# ---- group: Base Plane
number_slider = Slider(0, range=0..360)  # disabled
number_slider_2 = Slider(0, range=0..360)  # disabled
xy = XYPlane(Origin=Point(0, 0, 0))  # disabled
rad = Radians(Degrees=number_slider)  # disabled
rad_2 = Radians(Degrees=number_slider_2)  # disabled
rotate = Rotate(Geometry=xy, Angle=rad_2, Plane=xy)  # -> Geometry, Transform; disabled
xz = XZPlane(Origin=Point(0, 0, 0))  # disabled
rotate_2 = Rotate(Geometry=rotate.Geometry, Angle=rad, Plane=xz)  # -> Geometry, Transform; disabled

# ----
brep = Brep([<brep referenced from the Rhino model> x250])
brep_2 = Brep(<brep referenced from the Rhino model>)  # disabled

# ---- group: Geometry
pt = ConstructPoint(XCoordinate="20", YCoordinate="20", ZCoordinate=0)
planesrf = PlaneSurface(Plane=pt, XSize=Domain(-10, 10), YSize=Domain(-10, 10))
Z = UnitZ(Factor="20")
range = Range(Domain=Domain(0, 1), Steps=Slider(5, range=0..10))
move = Move(Geometry=planesrf, Motion=Z)  # -> Geometry, Transform
mbs = CrystallonV2MorphBetweenSurfaces(surfaces=[planesrf, move.Geometry], x_parameter=range, y_parameter=range, z_parameter=range)

# ---- group: Attractor
md_slider = MDSlider(
    SliderMode=0,
    slider_value=Point(0.1232725702, 0.5500183105, 0.5),
    x_domain=Domain(0, 1),
    y_domain=Domain(0, 1),
    z_domain=Domain(0, 1))
Z_2 = UnitZ(Factor=Slider(16.095, range=0..20))
move_2 = Move(Geometry=planesrf, Motion=Z_2)  # -> Geometry, Transform
evalsrf = EvaluateSurface(Surface=reparameterize(move_2.Geometry), Point=md_slider)  # -> Point, Normal, UDirection, VDirection, Frame
sph = Sphere(Base=evalsrf.Point, Radius=1)

# ---- group: Voxelize (parameter)
number_slider_3 = Slider(10, range=0..10)  # disabled
number_slider_4 = Slider(10, range=0..10)  # disabled
number_slider_5 = Slider(10, range=0..10)  # disabled
range_2 = Range(Domain=Domain(0, 1), Steps=number_slider_3)  # disabled
range_3 = Range(Domain=Domain(0, 1), Steps=number_slider_4)  # disabled
range_4 = Range(Domain=Domain(0, 1), Steps=number_slider_5)  # disabled
graph = GraphMapper(
    range_2,
    x0=0,
    x1=1,
    y0=0,
    y1=1,
    container_name="Bezier",
    cpx=[0, 0.1130437404, 0.8184120059, 1],
    cpy=[0, 0.4992905259, 0.4266634583, 1])  # disabled
graph_2 = GraphMapper(
    range_3,
    x0=0,
    x1=1,
    y0=0,
    y1=1,
    container_name="Bezier",
    cpx=[0, 0.1318841428, 0.7695652843, 1],
    cpy=[0, 0.4964538813, 0.4283685088, 1])  # disabled
graph_3 = GraphMapper(
    range_4,
    x0=0,
    x1=1,
    y0=0,
    y1=1,
    container_name="Bezier",
    cpx=[0, 0.2115942985, 0.7764883637, 1],
    cpy=[0, 0.5128570795, 0.3069961667, 1])  # disabled
toggle = BooleanToggle(False)  # disabled
vp = CrystallonV2VoxelizeParameter(
    geometry=brep_2,
    plane=rotate_2.Geometry,
    x_parameter=graph_3,
    y_parameter=graph_2,
    z_parameter=graph,
    fill_completely=toggle)  # disabled

# ----
box = Box(brep)

# ---- group: Values
neg = Negative(Value="10")
number_slider_6 = Slider(10, range=0..100)
dom = ConstructDomain(DomainStart=neg, DomainEnd="10")
dom_2 = ConstructDomain(DomainStart="0", DomainEnd="20")
box_2 = DomainBox(Base=pt, X=dom, Y=dom, Z=dom_2)
pop3d = Populate3D(Region=box_2, Count=number_slider_6, Seed=1)
random = Random(Range=Domain(0, 1), Number=number_slider_6, Seed=2)
gradient = Gradient(LowerLimit=0, UpperLimit=1, Parameter=random, stops=[0: RGB(255, 255, 255), 1: RGB(0, 0, 0)])
preview = CustomPreview(Geometry=pop3d, Material=gradient)

# ----
number_slider_7 = Slider(150, range=0..300)  # disabled
panel = Panel(mbs)

# ---- group: Cell Fill
unit_cell_selector = CrystallonV2CellSelector({"Prim. Cubic": 0, "BC": 1, "BC Cubic": 2, "FC Cubic": 3, "Edge Octa.": 4, "Vertex Octa.": 5, "NaCl": 6, "Star Tet.": 7, "BC Star Tet.": 8, "Octa. Tet.": 9, "Dodecahedron": 10, "Trunc. Octa.": 11, "Tetrahedral": 12, "Auxetic": 13, "BC1 (tween)": 14, "BC2 (tween)": 15, "Octa. (shell)": 16, "Dodeca. (shell)": 17, "Trunc. Octa. (shell)": 18, "Gyroid (shell)": 19, "Cubic Center (shell)": 20, "Cubic Face (shell)": 21, "LH Square": 22, "LH Round": 23, "LH Square (shell)": 24, "LH Auxetic (shell)": 25, "MC Tri": 26, "MS Tri (shell)": 27, "MC Quad": 28, "MS Quad (shell)": 29}, selected="BC")
ct = CrystallonV2CellType(unit_cell_selector=unit_cell_selector)
clf = CrystallonV2CellLatticeFill(unit_cell=ct, voxels=box)

# ---- group: Voxelize (distance)
toggle_2 = BooleanToggle(True)  # disabled
vd = CrystallonV2VoxelizeDistance(
    geometry=brep_2,
    plane=rotate_2.Geometry,
    voxel_size_x=number_slider_7,
    voxel_size_y=number_slider_7,
    voxel_size_z=number_slider_7,
    fill_completely=toggle_2)  # disabled

# ----
curve = Curve(clf)

# ---- group: Lattice Thickness (value)
ltv = CrystallonV2LatticeThicknessValue(
    lattice=clf,
    points=pop3d,
    values=random,
    distance_influence=Toggle(True),
    influence=Slider(0.228, range=0..1),
    magnitude_min=Slider(0.087, range=0..1),
    magnitude_max=Slider(0.582, range=0..1))
pipe = Pipe(Curve=clf, Radius=ltv, Caps=0)
preview_2 = CustomPreview(Geometry=pipe, Material=ColourSwatch(SwatchColor=RGB(120, 120, 120)))

# ---- group: Lattice Thickness (attractor)
lta = CrystallonV2LatticeThicknessAttractor(
    lattice=clf,
    attractor=evalsrf.Point,
    influence=Slider(0.228, range=0..1),
    magnitude_min=Slider(0.087, range=0..1),
    magnitude_max=Slider(0.582, range=0..1))
pipe_2 = Pipe(Curve=clf, Radius=lta, Caps=0)
preview_3 = CustomPreview(Geometry=pipe_2, Material=ColourSwatch(SwatchColor=RGB(120, 120, 120)))

# ----
pipe_3 = Pipe(Curve=clf, Radius=Slider(0.02, range=0..0.5), Caps=Toggle(True))
preview_4 = CustomPreview(Geometry=pipe_3, Material=ColourSwatch(SwatchColor=RGB(120, 120, 120)))

# ==== cluster CrystallonV2VoxelizeDistance: Fill a volume with equal sized voxels

voxel_size_x = ClusterInput()  # Voxel size int the X direction
voxel_size_y = ClusterInput()  # Voxel size int the Y direction
voxel_size_z = ClusterInput()  # Voxel size int the Z direction
plane = ClusterInput()  # Base plane for voxels
geometry = ClusterInput()  # Geometry to voxelize
fill_completely = ClusterInput()  # If true, Voxels will fill entire volume. If false, only Voxels with their centroid within the volume will be kept.
mesh = Mesh(geometry)
pln = Plane(plane)
num = Number(voxel_size_x)
num_2 = Number(voxel_size_y)
num_3 = Number(voxel_size_z)
bool = Boolean(fill_completely)
bbox = BoundingBox(Content=mesh, Plane=pln)  # -> Box, Box_2
edges = BrepEdges(Brep=bbox.Box)  # -> Naked, Interior, NonManifold
item = ListItem(List=edges.Interior, Index="8", Wrap=True)
item_2 = ListItem(List=edges.Interior, Index="1", Wrap=True)
# CRYSTALLON V2.0 -- Lattice structure tools for Grasshopper3D
# 
# Copyright (C) 2019  Aaron Porterfield
# 
# www.fequalsf.com
# info@fequalsf.com
# 
#     This program is free software: you can redistribute it and/or modify
#     it under the terms of the GNU General Public License as published by
#     the Free Software Foundation, either version 3 of the License, or any later version.
# 
#     This program is distributed in the hope that it will be useful,
#     but WITHOUT ANY WARRANTY; without even the implied warranty of
#     MERCHANTABILITY or FITNESS FOR A PARTICULAR PURPOSE.  See the
#     GNU General Public License for more details.
# 
#     You should have received a copy of the GNU General Public License
#     along with this program.  If not, see <http://www.gnu.org/licenses/>.
item_3 = ListItem(List=edges.Interior, Index="0", Wrap=True)
divlength = DivideLength(Curve=reparameterize(item_2), Length=num_2)  # -> Points, Tangents, Parameters
divlength_2 = DivideLength(Curve=reparameterize(item_3), Length=num)  # -> Points, Tangents, Parameters
divlength_3 = DivideLength(Curve=reparameterize(item), Length=num_3)  # -> Points, Tangents, Parameters
reldif = RelativeDifferences(Values=divlength.Parameters)
reldif_2 = RelativeDifferences(Values=divlength_2.Parameters)
reldif_3 = RelativeDifferences(Values=divlength_3.Parameters)
item_4 = ListItem(List=reverse(divlength.Parameters), Index=0, Wrap=True)
item_5 = ListItem(List=reverse(reldif), Index=0, Wrap=True)
item_6 = ListItem(List=reverse(divlength_2.Parameters), Index=0, Wrap=True)
item_7 = ListItem(List=reverse(reldif_2), Index=0, Wrap=True)
item_8 = ListItem(List=reverse(divlength_3.Parameters), Index=0, Wrap=True)
item_9 = ListItem(List=reverse(reldif_3), Index=0, Wrap=True)
addition = Addition(A=item_5, B=item_4)
addition_2 = Addition(A=item_7, B=item_6)
addition_3 = Addition(A=item_9, B=item_8)
merge = Merge(Data1=divlength.Parameters, Data2=addition)
merge_2 = Merge(Data1=divlength_2.Parameters, Data2=addition_2)
merge_3 = Merge(Data1=divlength_3.Parameters, Data2=addition_3)
crossref = CrossReference(ListA=merge, ListB=merge_3, CrossMode=1)  # -> ListA, ListB
box = EvaluateBox(Box=bbox.Box, UParameter=graft(merge_2), VParameter=crossref.ListA, WParameter=crossref.ListB)  # -> Plane, Point, Include
panel = Panel("Voxelize")
division = Division(A=num_3, B="2")
division_2 = Division(A=num_2, B="2")
division_3 = Division(A=num, B="2")
neg = Negative(Value=division)
neg_2 = Negative(Value=division_2)
neg_3 = Negative(Value=division_3)
dom = ConstructDomain(DomainStart=neg, DomainEnd=division)
dom_2 = ConstructDomain(DomainStart=neg_2, DomainEnd=division_2)
dom_3 = ConstructDomain(DomainStart=neg_3, DomainEnd=division_3)
crossref_2 = CrossReference(ListA=dom_2, ListB=dom, CrossMode=1)  # -> ListA, ListB
box_2 = DomainBox(Base=simplify(box.Plane), X=graft(dom_3), Y=crossref_2.ListA, Z=crossref_2.ListB)
minc = MeshInclusion(Mesh=mesh, Point=box.Plane, Strict=False)
sort = SortList(Keys=[num, num_2, num_3])  # -> Keys, ValuesA
cull = CullPattern(List=box_2, CullPattern=minc)
meshcp = MeshClosestPoint(Point=box.Plane, Mesh=mesh)  # -> Point, Index, Parameter
dist = Distance(PointA=box.Plane, PointB=meshcp.Point)
expression = Expression(a=sort.Keys, d=dist, Expression="if(d<sqrt(2*(a/2)^2),True,False)")
cull_2 = CullPattern(List=box_2, CullPattern=expression)
cull_3 = CullPattern(List=cull_2, CullPattern=bool)
merge_4 = Merge(Data1=cull, Data2=cull_3)
voxels = ClusterOutput(merge_4)  # Voxels to be filled with unit cells

# ==== cluster CrystallonV2VoxelizeParameter: Fill a volume with varying sized voxels

plane = ClusterInput()  # Base plane for voxels
geometry = ClusterInput()  # Geometry to voxelize
x_parameter = ClusterInput()  # Range of numbers (0-1) for X divisions of the bounding box
y_parameter = ClusterInput()  # Range of numbers (0-1) for Y divisions of the bounding box
z_parameter = ClusterInput()  # Range of numbers (0-1) for Z divisions of the bounding box
fill_completely = ClusterInput()  # If true, Voxels will fill entire volume. If false, only Voxels with their centroid within the volume will be kept.
mesh = Mesh(geometry)
pln = Plane(plane)
num = Number(y_parameter)
bool = Boolean(fill_completely)
num_2 = Number(x_parameter)
num_3 = Number(z_parameter)
bbox = BoundingBox(Content=mesh, Plane=pln)  # -> Box, Box_2
edges = BrepEdges(Brep=bbox.Box)  # -> Naked, Interior, NonManifold
crossref = CrossReference(ListA=num, ListB=num_3, CrossMode=1)  # -> ListA, ListB
item = ListItem(List=edges.Interior, Index="8", Wrap=True)
toggle = BooleanToggle(False)
toggle_2 = BooleanToggle(True)
item_2 = ListItem(List=edges.Interior, Index="1", Wrap=True)
item_3 = ListItem(List=edges.Interior, Index="0", Wrap=True)
box = EvaluateBox(Box=bbox.Box, UParameter=graft(num_2), VParameter=crossref.ListA, WParameter=crossref.ListB)  # -> Plane, Point, Include
len = Length(Curve=item_2)
len_2 = Length(Curve=item_3)
len_3 = Length(Curve=item)
dom = ConstructDomain(DomainStart=0, DomainEnd=len)
dom_2 = ConstructDomain(DomainStart=0, DomainEnd=len_2)
dom_3 = ConstructDomain(DomainStart=0, DomainEnd=len_3)
remap = RemapNumbers(Value=num, Source=Domain(0, 1), Target=dom)  # -> Mapped, Clipped
remap_2 = RemapNumbers(Value=num_2, Source=Domain(0, 1), Target=dom_2)  # -> Mapped, Clipped
remap_3 = RemapNumbers(Value=num_3, Source=Domain(0, 1), Target=dom_3)  # -> Mapped, Clipped
shift = ShiftList(List=remap.Mapped, Shift="-1", Wrap=toggle)
shift_2 = ShiftList(List=remap.Mapped, Shift="1", Wrap=toggle)
shift_3 = ShiftList(List=remap_2.Mapped, Shift="-1", Wrap=toggle)
shift_4 = ShiftList(List=remap_2.Mapped, Shift="1", Wrap=toggle)
shift_5 = ShiftList(List=remap_3.Mapped, Shift="-1", Wrap=toggle)
shift_6 = ShiftList(List=remap_3.Mapped, Shift="1", Wrap=toggle)
subtraction = Subtraction(A=shift_2, B=shift)
subtraction_2 = Subtraction(A=shift_4, B=shift_3)
subtraction_3 = Subtraction(A=shift_6, B=shift_5)
division = Division(A=subtraction, B="2")
division_2 = Division(A=subtraction_2, B="2")
division_3 = Division(A=subtraction_3, B="2")
shift_7 = ShiftList(List=division, Shift="1", Wrap=toggle_2)
neg = Negative(Value=division)
neg_2 = Negative(Value=division_2)
shift_8 = ShiftList(List=division_2, Shift="1", Wrap=toggle_2)
shift_9 = ShiftList(List=division_3, Shift="1", Wrap=toggle_2)
neg_3 = Negative(Value=division_3)
panel = Panel("VOXELIZE (parameter)")
dom_4 = ConstructDomain(DomainStart=neg, DomainEnd=division)
dom_5 = ConstructDomain(DomainStart=neg, DomainEnd=shift_7)
dom_6 = ConstructDomain(DomainStart=neg_2, DomainEnd=division_2)
dom_7 = ConstructDomain(DomainStart=neg_2, DomainEnd=shift_8)
dom_8 = ConstructDomain(DomainStart=neg_3, DomainEnd=division_3)
dom_9 = ConstructDomain(DomainStart=neg_3, DomainEnd=shift_9)
rev = ReverseList(List=dom_4)
rev_2 = ReverseList(List=dom_6)
shift_10 = ShiftList(List=dom_5, Shift="-1", Wrap=toggle)
shift_11 = ShiftList(List=dom_7, Shift="-1", Wrap=toggle)
rev_3 = ReverseList(List=dom_8)
item_4 = ListItem(List=dom_4, Index=0, Wrap=True)
shift_12 = ShiftList(List=dom_9, Shift="-1", Wrap=toggle)
item_5 = ListItem(List=dom_6, Index=0, Wrap=True)
item_6 = ListItem(List=rev, Index=0, Wrap=True)
item_7 = ListItem(List=rev_2, Index=0, Wrap=True)
item_8 = ListItem(List=dom_8, Index=0, Wrap=True)
item_9 = ListItem(List=rev_3, Index=0, Wrap=True)
entwine = Entwine(Branch00=item_4, Branch01=shift_10, Branch02=item_6, FlattenInputs=True)  # -> flatten(Result)
entwine_2 = Entwine(Branch00=item_5, Branch01=shift_11, Branch02=item_7, FlattenInputs=True)  # -> flatten(Result)
entwine_3 = Entwine(Branch00=item_8, Branch01=shift_12, Branch02=item_9, FlattenInputs=True)  # -> flatten(Result)
sort = SortList(Keys=flatten([subtraction_3, subtraction, subtraction_2]))  # -> Keys, ValuesA
crossref_2 = CrossReference(ListA=entwine, ListB=entwine_3, CrossMode=1)  # -> ListA, ListB
rev_4 = ReverseList(List=sort.Keys)
box_2 = DomainBox(Base=simplify(box.Plane), X=graft(entwine_2), Y=crossref_2.ListA, Z=crossref_2.ListB)
item_10 = ListItem(List=rev_4, Index=0, Wrap=True)
minc = MeshInclusion(Mesh=mesh, Point=box.Plane, Strict=False)
cull = CullPattern(List=box_2, CullPattern=minc)
meshcp = MeshClosestPoint(Point=box.Plane, Mesh=mesh)  # -> Point, Index, Parameter
dist = Distance(PointA=box.Plane, PointB=meshcp.Point)
expression = Expression(a=item_10, d=dist, Expression="if(d<sqrt(2*(a/2)^2),True,False)")
cull_2 = CullPattern(List=box_2, CullPattern=expression)
cull_3 = CullPattern(List=cull_2, CullPattern=bool)
merge = Merge(Data1=cull, Data2=cull_3)
voxels = ClusterOutput(merge)  # Voxels to be filled with unit cells

# ==== cluster CrystallonV2CellLatticeFill: Fill voxels with lattice unit cells

unit_cell = ClusterInput()  # Unit cell to populate voxels
voxels = ClusterInput()  # Voxels to be filled with unit cells
crv = Curve(unit_cell)
bbox = BoundingBox(Content=crv, Plane=PlaneXY(0, 0, 0), UnionBox=True)  # -> Box, Box_2
panel = Panel("CELL FILL")
morph = BoxMorph(Geometry=crv, Reference=bbox.Box, Target=graft(voxels))  # -> flatten(Geometry)
remove_duplicate_lines = RemoveDuplicateLines(lattice_l=flatten(morph))
lattice = ClusterOutput(remove_duplicate_lines)  # List of curves that make up the lattice

# ==== cluster CrystallonV2CellType: A collection of pre-made unit cells

crv = Curve([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])
crv_2 = Curve([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])
crv_3 = Curve([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])
crv_4 = Curve([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])
crv_5 = Curve([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])
mesh = Mesh(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)
mesh_2 = Mesh(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)
mesh_3 = Mesh(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)
mesh_4 = Mesh([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])
crv_6 = Curve([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])
crv_7 = Curve([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])
crv_8 = Curve([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])
crv_9 = Curve([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])
crv_10 = Curve([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])
crv_11 = Curve([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])
crv_12 = Curve([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])
crv_13 = Curve([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])
crv_14 = Curve([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])
crv_15 = Curve([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])
crv_16 = Curve([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])
mesh_5 = Mesh(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)
mesh_6 = Mesh(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)
mesh_7 = Mesh(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)
mesh_8 = Mesh(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)
crv_17 = Curve([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])
crv_18 = Curve([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])
mesh_9 = Mesh(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)
geo = Geometry([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])
geo_2 = Geometry([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])
mesh_10 = Mesh([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])
panel = Panel("CELL TYPES")
entwine = Entwine(
    Branch00=crv_6,
    Branch01=crv_7,
    Branch02=crv,
    Branch03=crv_8,
    Branch04=crv_2,
    Branch05=crv_9,
    Branch06=crv_3,
    Branch07=crv_10,
    Branch08=crv_11,
    Branch09=crv_12,
    Branch010=crv_4,
    Branch011=crv_5,
    Branch012=crv_13,
    Branch013=crv_14,
    Branch014=crv_15,
    Branch015=crv_16,
    Branch016=mesh,
    Branch017=mesh_5,
    Branch018=mesh_6,
    Branch019=mesh_2,
    Branch020=mesh_7,
    Branch021=mesh_8,
    Branch022=crv_17,
    Branch023=crv_18,
    Branch024=mesh_9,
    Branch025=mesh_3,
    Branch026=geo,
    Branch027=mesh_4,
    Branch028=geo_2,
    Branch029=mesh_10,
    FlattenInputs=True)  # -> simplify(Result)
unit_cell_selector = ClusterInput()
branch = TreeBranch(Tree=entwine, Path=unit_cell_selector, MaintainPaths=True)
unit_cell = ClusterOutput(branch)  # Single unit cell to populate voxels

# ==== cluster CrystallonV2MorphBetweenSurfaces: Conformal fill of voxels between two or more surfaces

x_parameter = ClusterInput()  # Range of numbers (0-1) for X divisions
z_parameter = ClusterInput()  # Range of numbers (0-1) for Z divisions
surfaces = ClusterInput()  # At least 2 surfaces to morph voxels between
y_parameter = ClusterInput()  # Range of numbers (0-1) for Y divisions
srf = Surface(flatten(surfaces))
num = Number(y_parameter)
num_2 = Number(x_parameter)
num_3 = Number(z_parameter)
pt = ConstructPoint(XCoordinate=simplify(graft(num_2)), YCoordinate=simplify(num), ZCoordinate=0)  # -> simplify(Point)
lng = ListLength(List=num_2)
num_4 = Number(lng)
evalsrf = EvaluateSurface(Surface=reparameterize(simplify(srf)), Point=simplify(graft(pt)))  # -> simplify(Point), Normal, Frame
pline = PolyLine(Vertices=evalsrf.Point, Closed=False)
eval = EvaluateCurve(Curve=reparameterize(pline), Parameter=num_3)  # -> Point, Tangent, Angle
path_mapper = PathMapper(eval.Point, source="{A;B}(i)", target="{B;A}(i)")
path_mapper_2 = PathMapper(path_mapper, source="{A;B}", target="{path_index}")
toggle = BooleanToggle(False)
shift = ShiftList(List=path_mapper_2, Shift="1", Wrap=toggle)
shift_2 = ShiftList(List=path_mapper_2, Shift="-1", Wrap=toggle)
flip = FlipMatrix(Data=shift)
flip_2 = FlipMatrix(Data=shift_2)
partition = PartitionList(List=flip_2, Size=num_4)
partition_2 = PartitionList(List=flip, Size=num_4)
shift_3 = ShiftList(List=partition, Shift="-1", Wrap=toggle)  # -> simplify(List)
shift_4 = ShiftList(List=partition, Shift="1", Wrap=toggle)  # -> simplify(List)
shift_5 = ShiftList(List=partition_2, Shift="1", Wrap=toggle)  # -> simplify(List)
shift_6 = ShiftList(List=partition_2, Shift="-1", Wrap=toggle)  # -> simplify(List)
path_mapper_3 = PathMapper(shift_4, source="{A;B}(i)", target="{A;i}(B)")
path_mapper_4 = PathMapper(shift_3, source="{A;B}(i)", target="{A;i}(B)")
path_mapper_5 = PathMapper(shift_5, source="{A;B}(i)", target="{A;i}(B)")
path_mapper_6 = PathMapper(shift_6, source="{A;B}(i)", target="{A;i}(B)")
shift_7 = ShiftList(List=path_mapper_4, Shift="-1", Wrap=toggle)
shift_8 = ShiftList(List=path_mapper_3, Shift="1", Wrap=toggle)
shift_9 = ShiftList(List=path_mapper_3, Shift="-1", Wrap=toggle)
shift_10 = ShiftList(List=path_mapper_6, Shift="-1", Wrap=toggle)
shift_11 = ShiftList(List=path_mapper_4, Shift="1", Wrap=toggle)
shift_12 = ShiftList(List=path_mapper_5, Shift="1", Wrap=toggle)
shift_13 = ShiftList(List=path_mapper_5, Shift="-1", Wrap=toggle)
shift_14 = ShiftList(List=path_mapper_6, Shift="1", Wrap=toggle)
tbox = TwistedBox(
    CornerA=shift_11,
    CornerB=shift_7,
    CornerC=shift_9,
    CornerD=shift_8,
    CornerE=shift_14,
    CornerF=shift_10,
    CornerG=shift_13,
    CornerH=shift_12)
voxels = ClusterOutput(tbox)  # Voxels to be filled with unit cells

# ==== cluster CrystallonV2LatticeThicknessAttractor: Apply thickness values to lattice curves with attractor(s)

lattice = ClusterInput()  # Lattice to thicken
attractor = ClusterInput()  # Any geometry to use as attractor(s)
influence = ClusterInput()  # Smoothed range of attractor influence (0-1)
magnitude_min = ClusterInput()  # Lattice beam thickness (minimum value)
magnitude_max = ClusterInput()  # Lattice beam thickness (maximum value)
crv = Curve(lattice)
geo = Geometry(attractor)
curvepoint = PointOnCurve(crv, parameter=0.5)
pull = PullPoint(Point=curvepoint, Geometry=geo, ClosestOnly=True)  # -> ClosestPoint, Distance
panel = Panel("THICKNESS ATTRACTOR")
expression = Expression(x=influence, y=pull.Distance, Expression="-1*e^(-x*y)")
dom = ConstructDomain(DomainStart=magnitude_min, DomainEnd=magnitude_max)
bnd = Bounds(Numbers=expression)
dedomain = DeconstructDomain(Domain=bnd)  # -> Start, End
dom_2 = ConstructDomain(DomainStart=dedomain.End, DomainEnd=dedomain.Start)
remap = RemapNumbers(Value=expression, Source=dom_2, Target=dom)  # -> Mapped, Clipped
value = ClusterOutput(remap.Mapped)  # Values for beam thickness

# ==== cluster CrystallonV2LatticeThicknessValue: Apply thickness values to lattice curves with a point cloud and corrosponding values

lattice = ClusterInput()  # Lattice to thicken
points = ClusterInput()  # List of points (flattened)
values = ClusterInput()  # Values that correspond to points (flattened)
distance_influence = ClusterInput()  # If true the distance between the points and voxels will affect the magnitude
influence = ClusterInput()  # Smoothed range of attractor influence (0-1)
magnitude_min = ClusterInput()  # Lattice beam thickness (minimum value)
magnitude_max = ClusterInput()  # Lattice beam thickness (maximum value)
crv = Curve(lattice)
curvepoint = PointOnCurve(crv, parameter=0.5)
num = Number(values)
pt = Point(points)
cp = ClosestPoint(Point=curvepoint, Cloud=pt)  # -> ClosestPoint, CPIndex, Distance
dom = ConstructDomain(DomainStart=magnitude_min, DomainEnd=magnitude_max)
item = ListItem(List=num, Index=cp.CPIndex, Wrap=True)
panel = Panel("THICKNESS VALUE")
expression = Expression(x=influence, y=cp.Distance, Expression="-1*e^(-x*y)")
bnd = Bounds(Numbers=item)
remap = RemapNumbers(Value=item, Source=bnd, Target=dom)  # -> Mapped, Clipped
not = GateNot(A=distance_influence)
bnd_2 = Bounds(Numbers=expression)
remap_2 = RemapNumbers(Value=expression, Source=bnd_2, Target="1 to 0")  # -> Mapped, Clipped
cull = CullPattern(List=remap.Mapped, CullPattern=not)
multiplication = Multiplication(A=remap.Mapped, B=remap_2.Mapped)
cull_2 = CullPattern(List=multiplication, CullPattern=distance_influence)
bnd_3 = Bounds(Numbers=cull_2)
remap_3 = RemapNumbers(Value=cull_2, Source=bnd_3, Target=dom)  # -> Mapped, Clipped
num_2 = Number([remap_3.Mapped, cull])
value = ClusterOutput(num_2)  # Values for beam thickness

# ==== cluster RemoveDuplicateLines
lattice_l = ClusterInput()
crv = Curve(lattice_l)
curvepoint = PointOnCurve(crv, parameter=0.5)
cullpt = CullDuplicates(Points=curvepoint, Tolerance=".001", CullMode=1)  # -> Points, Indices, Valence
item = ListItem(List=crv, Index=cullpt.Indices, Wrap=True)
lattice = ClusterOutput(item)
