# Grasshopper definition voxel_approach2.gh (Grasshopper 1.0.7)

total_width = Slider(8, range=-8..10)
expression = Expression(x=total_width, Expression="x/(2^(1/3))")
expression_2 = Expression(x=expression, Expression="x/(2^(1/3))")

divisions = Slider(12, range=0..100)

# ---- group: Grid
division = Division(A=[total_width, expression, expression_2], B=divisions)
item = ListItem(List=division, Index=0, Wrap=True)  # -> Item, Item1, Item2
recgrid = Rectangular(
    Plane=PlaneXY(1, -1, 0),
    SizeX=item.Item,
    SizeY=item.Item1,
    ExtentX=expr("x-1", divisions),
    ExtentY=expr("x-1", divisions))  # -> Cells, Points
pt = ConstructPoint(XCoordinate=expr("x/2", item.Item), YCoordinate=expr("x/2", item.Item1), ZCoordinate=expr("x/2", item.Item2))
series = Series(Start=0, Step=item.Item2, Count=divisions)
Z = UnitZ(Factor=series)
move = Move(Geometry=flatten(recgrid.Points), Motion=graft(Z))  # -> Geometry, Transform
move_2 = Move(Geometry=move.Geometry, Motion=pt)  # -> flatten(Geometry), Transform

# ----
rectangle = Rectangle(Plane=PlaneXY(0, 0, 0), XSize=total_width, YSize=expression, Radius=0)  # -> Rectangle, Length
boxrec = BoxRectangle(Rectangle=rectangle.Rectangle, Height=expression_2)

sph = Sphere(Base=PlaneXY(0, 0, 0), Radius=Slider(3.175, range=0..10))

mesh = Mesh()
range = Range(Domain=Domain(0, 1), Steps=Slider(6, range=0..10))
gradient = Gradient(LowerLimit=0, UpperLimit=1, Parameter=range, stops=[0: RGB(97, 48, 176), 0.503: RGB(134, 29, 153), 1: RGB(255, 5, 63)])
cluster = Cluster(relay=mesh, centers=move_2.Geometry, seed=item.Item, generation="0", colour=gradient)  # -> centers_2, seed_2, generation_2
cluster_2 = Cluster(relay=mesh, centers=cluster.centers_2, seed=cluster.seed_2, generation=cluster.generation_2, colour=gradient)  # -> centers_2, seed_2, generation_2
cluster_3 = Cluster(relay=mesh, centers=cluster_2.centers_2, seed=cluster_2.seed_2, generation=cluster_2.generation_2, colour=gradient)  # -> centers_2, seed_2, generation_2
cluster_4 = Cluster(relay=mesh, centers=cluster_3.centers_2, seed=cluster_3.seed_2, generation=cluster_3.generation_2, colour=gradient)  # -> centers_2, seed_2, generation_2
cluster_5 = Cluster(relay=mesh, centers=cluster_4.centers_2, seed=cluster_4.seed_2, generation=cluster_4.generation_2, colour=gradient)  # -> centers_2, seed_2, generation_2
cluster_6 = Cluster(relay=mesh, centers=cluster_5.centers_2, seed=cluster_5.seed_2, generation=cluster_5.generation_2, colour=gradient)  # -> centers_2, seed_2, generation_2

# ---- group: R-Voxels
lng = ListLength(List=[move_2.Geometry, cluster.centers_2, cluster_2.centers_2, cluster_3.centers_2, cluster_4.centers_2, cluster_5.centers_2, cluster_6.centers_2])
lng_2 = ListLength()
panel = Panel("Voxels")
panel_2 = Panel("checking points")
panel_3 = Panel(lng)
panel_4 = Panel(lng_2)

# ----
cluster_7 = Cluster(relay=mesh, centers=cluster_6.centers_2, seed=cluster_6.seed_2, generation=cluster_6.generation_2, colour=gradient)  # -> centers_2, seed_2, generation_2
cluster_8 = Cluster(relay=mesh, centers=cluster_7.centers_2, seed=cluster_7.seed_2, generation=cluster_7.generation_2, colour=gradient)  # -> centers_2, seed_2, generation_2

# ==== cluster Cluster
seed = ClusterInput()
generation = ClusterInput()
centers = ClusterInput()
relay = ClusterInput()
colour = ClusterInput()

addition = Addition(A=generation, B=1)

generation_2 = ClusterOutput(addition)

item = ListItem(List=colour, Index=generation, Wrap=True)
panel = Panel("""0
1
2""")
expression = Expression(x=seed, y=panel, Expression="x/((2^(1/3))^y)")
mod = Modulus(A=generation, B=3)
shift = ShiftList(List=expression, Shift=expr("-x", mod), Wrap=True)
expression_2 = Expression(x=shift, Expression="x/2")
neg = Negative(Value=expression_2)
item_2 = ListItem(List=expression, Index=0, Wrap=True)  # -> Item, Item1
merge = Merge(Data1=graft(expression_2), Data2=graft(neg))  # -> simplify(Result)
bnd = Bounds(Numbers=merge)
item_3 = ListItem(List=flatten(bnd), Index=0, Wrap=True)  # -> Item, Item1, Item2

# ---- group: FULLY/NOT FULLY EMERGED
expression_3 = Expression(x=shift, Expression="x/2")
item_4 = ListItem(List=expression_3, Index=0, Wrap=True)  # -> Item, Item1, Item2
neg_2 = Negative(Value=item_4.Item)
neg_3 = Negative(Value=item_4.Item1)
neg_4 = Negative(Value=item_4.Item2)
crossref = CrossReference(ListA=[item_4.Item, neg_2], ListB=[item_4.Item1, neg_3], ListC=[neg_4, item_4.Item2], CrossMode=1)  # -> ListA, ListB, ListC
pt = ConstructPoint(XCoordinate=crossref.ListA, YCoordinate=crossref.ListB, ZCoordinate=crossref.ListC)
addition_2 = Addition(A=pt, B=graft(centers))
minc = MeshInclusion(Mesh=relay, Point=addition_2, Strict=False)
item_5 = ListItem(List=minc, Index=0, Wrap=True)  # -> Item, Item1, Item2, Item3, Item4, Item5, Item6, Item7
and = GateAnd(
    A=item_5.Item,
    B=item_5.Item1,
    C=item_5.Item2,
    D=item_5.Item3,
    E=item_5.Item4,
    F=item_5.Item5,
    G=item_5.Item6,
    H=item_5.Item7)
or = GateOr(
    A=item_5.Item,
    B=item_5.Item1,
    C=item_5.Item2,
    D=item_5.Item3,
    E=item_5.Item4,
    F=item_5.Item5,
    G=item_5.Item6,
    H=item_5.Item7)
not = GateNot(A=and)
dispatch = Dispatch(List=centers, DispatchPattern=flatten(and))  # -> ListA, ListB
and_2 = GateAnd(A=flatten(or), B=flatten(not))
dispatch_2 = Dispatch(List=centers, DispatchPattern=flatten(and_2))  # -> ListA, ListB

# ---- group: Center of half 'cubes'
vectors_x_y_z = Panel("""1,0,0
0,1,0
0,0,1""")
item_6 = ListItem(List=vectors_x_y_z, Index=mod, Wrap=True)
division = Division(A=item_2.Item, B=4)
rev = Reverse(Vector=item_6)
vec = Vector(item_6)
multiplication = Multiplication(A=division, B=graft([vec, rev]))
move = Move(Geometry=dispatch_2.ListA, Motion=multiplication)  # -> flatten(Geometry), Transform

# ----
box = DomainBox(Base=dispatch.ListA, X=item_3.Item, Y=item_3.Item1, Z=item_3.Item2)
preview = CustomPreview(Geometry=box, Material=item)

seed_2 = ClusterOutput(item_2.Item1)
centers_2 = ClusterOutput(move.Geometry)
