# Grasshopper definition 0_thermSimulation.gh (Grasshopper 1.0.7)
# plug-ins: Human

number_slider = Slider(11, range=0..100)
division = Division(A="8", B=number_slider)
rectangle = Rectangle(Plane="0,0,0", XSize=division, YSize=division, Radius=0)  # -> Rectangle, Length
series = Series(Start="0", Step=division, Count=number_slider)
vector_xyz = VectorXYZ(XComponent=graft(series), YComponent=series, ZComponent=0)  # -> Vector, Length
move = Move(Geometry=rectangle.Rectangle, Motion=vector_xyz.Vector)  # -> Geometry, Transform
deconstruct_brep = DeconstructBrep(Brep=move.Geometry)  # -> Faces, Edges, Vertices
number_slider_2 = Slider(0.25, range=0..1)
deconstruct_brep_2 = DeconstructBrep(Brep=rectangle.Rectangle)  # -> Faces, Edges, Vertices
list_item = ListItem(List=deconstruct_brep_2.Edges, Index=0, Wrap=True)
list_item_2 = ListItem(List=deconstruct_brep.Vertices, Index="2", Wrap=True)
square_root = SquareRoot(Value=number_slider_2)
length = Length(Curve=list_item)  # -> flatten(Length)
scale = Scale(Geometry=flatten(move.Geometry), Center=flatten(list_item_2), Factor=square_root)  # -> Geometry, Transform
list_item_3 = ListItem(List=flatten(move.Geometry), Index=0, Wrap=True)
list_item_4 = ListItem(List=scale.Geometry, Index=0, Wrap=True)
deconstruct_brep_3 = DeconstructBrep(Brep=list_item_4)  # -> Faces, Edges, Vertices
list_item_5 = ListItem(List=deconstruct_brep_3.Faces, Index=0, Wrap=True)
length_2 = Length(Curve=list_item_5)  # -> flatten(Length)
merge = Merge(Data1="pore size:  ", Data2=length_2)
merge_2 = Merge(Data1="block size:  ", Data2=length)
merge_3 = Merge(Data1="porosity:  ", Data2=number_slider_2)
panel = Panel(list_item_3)
curve = Curve(list_item_4)
curve_2 = Curve(list_item_3)
text_join = TextJoin(Text=merge_3)
text_join_2 = TextJoin(Text=merge_2)
text_join_3 = TextJoin(Text=merge)
solid_difference = SolidDifference(BrepsA=move.Geometry, BrepsB=scale.Geometry)
solid_difference_2 = SolidDifference(BrepsA=curve_2, BrepsB=curve)
geometry = Geometry(solid_difference)
geometry_2 = Geometry(scale.Geometry)
colour_picker = ColourPicker(PickedColour=RGB(125, 111, 111))
point = Point([<point referenced from the Rhino model> x4])
vector_xyz_2 = VectorXYZ(XComponent=Slider(-4, range=-100..100), YComponent=0, ZComponent=0)  # -> Vector, Length
move_2 = Move(Geometry=solid_difference_2, Motion=vector_xyz_2.Vector)  # -> Geometry, Transform
custom_preview = CustomPreview(Geometry=move_2.Geometry, Material=colour_picker)
curve_3 = Curve([<curve referenced from the Rhino model> x253])
curve_4 = Curve([<curve referenced from the Rhino model> x253])

interiorboundary = Curve(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)
exteriorboundary = Curve(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)
list = ValueList({"indoor", "outdoor"}, selected="indoor")
list_2 = ValueList({"indoor", "outdoor"}, selected="outdoor")
createthermboundaries = Honeybee_CreateThermBoundaries(boundaryCurve=interiorboundary, name="Interior", temperature="0", filmCoefficient=list, uFactorTag="IntWall")  # -> readMe, simplify(thermBoundary); plug-in component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
createthermboundaries_2 = Honeybee_CreateThermBoundaries(boundaryCurve=exteriorboundary, name="Exterior", temperature="-20", filmCoefficient=list_2)  # -> readMe, simplify(thermBoundary); plug-in component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

panel_2 = Panel("AIR WALL MATERIAL")
air_gap = Geometry(curve_3)
panel_3 = Panel("AIR 13MM")
concrete = Geometry(curve_4)
createthermpolygons = Honeybee_CreateThermPolygons(geometry=air_gap, material="FRAME CAVITY SLIGHTLY VENTILATED NFRC 100")  # -> readMe, simplify(thermPolygon); plug-in component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
createthermpolygons_2 = Honeybee_CreateThermPolygons(geometry=concrete, material="8IN CONCRETE HW")  # -> readMe, simplify(thermPolygon); plug-in component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
toggle = BooleanToggle(True)
geo = Geometry(flatten([createthermpolygons_2.thermPolygon, createthermpolygons.thermPolygon]))

writetherm = Honeybee_WriteTHERMFile(
    polygons=flatten(geo),
    boundaries=flatten([createthermboundaries_2.thermBoundary, createthermboundaries.thermBoundary]),
    fileName="thermWallStud",
    writeTHMFile=toggle,
    runTHERM=toggle)  # -> readMe, thermFile, resultFile, uFactorFile, port, probRegion; plug-in component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

edges = BrepEdges(Brep=geo)  # -> Naked, Interior, NonManifold
preview = CustomPreview(Geometry=edges.Naked, Shader=ColourSwatch(SwatchColor=RGB(204, 204, 204)))

xml_file_that_can_be_opened_in_therm = Panel(writetherm.readMe)
panel_4 = Panel(writetherm.thermFile)

colorscheme = Slider(2, range=0..23)
gradientlibrary = Ladybug_GradientLibrary(gradIndex=colorscheme)  # -> customColors; plug-in component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
legendpar = Ladybug_LegendParameters(lowBound="-20", highBound="5", customColors=flatten(gradientlibrary), decimalPlaces="1", removeLessThan=Toggle(True))  # -> legendPar; plug-in component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

readtherm = Honeybee_ReadTHERMResult(resultFile=writetherm.resultFile, uFactorFile=writetherm.uFactorFile, legendPar=legendpar, runIt=Toggle(True))  # -> uFactorTags, uFactors, uFactorLength, deltaT, meshValues, meshPoints, coloredMesh, legend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; plug-in component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
u_factor_tags = Panel(readtherm.uFactorTags)
temperatures = Panel(readtherm.meshValues)
u_factors = Panel(readtherm.uFactors)

panel_5 = Panel(readtherm.legend)
panel_6 = Panel(readtherm.deltaT)
list_item_6 = ListItem(List=u_factors, Index=0, Wrap=True)
merge_4 = Merge(Data1="u-factor:  ", Data2=list_item_6)
text_join_4 = TextJoin(Text=merge_4)
merge_5 = Merge(Data1=text_join, Data2=text_join_2, Data3=text_join_3, Data4=text_join_4)
panel_7 = Panel(merge_5)
screen_oriented_text = ScreenOrientedText(
    Text=panel_7,
    Justification=7,
    Location=point,
    SizeFactor=Slider(14, range=0..15),
    Color=colour_picker,
    Depth=0,
    Absolute=False)
list_item_7 = ListItem(List=u_factors, Index="4", Wrap=True)
merge_6 = Merge(Data1=number_slider_2, Data2=list_item_6, Data3=list_item_7)
panel_8 = Panel(merge_6)
join = TextJoin(Text=merge_6, Join="; ")
file_path = FilePath("F:\GSD\04-2020spring\Thermal Monocoque\new-concrete\final\txt\test3.txt")
c_script = CSharpScript(file=file_path, data=join, append=Toggle(True), enable=Toggle(True))  # -> out, A; inputs file: String, data: String, append: Boolean, enable: Boolean
# ---------- c_script: C# ----------
    if (!enable)
      return;

    if (data == null)
      return;

    if (append)
      System.IO.File.AppendAllText(file, data + Environment.NewLine);
    else
      System.IO.File.WriteAllText(file, data);
# ---------- end c_script ----------

series_2 = Series(Start="0", Step="1", Count="15")
multiplication = Multiplication(A=series_2, B=Slider(5, range=0..10))
panel_9 = Panel(series_2)
list_item_8 = ListItem(List=readtherm.uFactors, Index="0", Wrap=True)
evaluate = Evaluate(Expression="y+(x-y)*e^(-z/(105.99/k))", x="-20", y="0", z=series_2, k=list_item_8)
vector_xyz_3 = VectorXYZ(XComponent=Slider(75, range=-100..100), YComponent=evaluate, ZComponent=0)  # -> Vector, Length
vector_xyz_4 = VectorXYZ(XComponent=multiplication, YComponent=Slider(-20, range=-100..100), ZComponent=0)  # -> Vector, Length
vector_xyz_5 = VectorXYZ(XComponent=Slider(-5, range=-100..100), YComponent=evaluate, ZComponent=0)  # -> Vector, Length
vector_xyz_6 = VectorXYZ(XComponent=multiplication, YComponent=Slider(-7, range=-100..100), ZComponent=0)  # -> Vector, Length
vector_xyz_7 = VectorXYZ(XComponent=multiplication, YComponent=evaluate, ZComponent=0)  # -> Vector, Length
panel_10 = Panel(evaluate)
line = Line(StartPoint=vector_xyz_6.Vector, EndPoint=vector_xyz_4.Vector)
line_2 = Line(StartPoint=vector_xyz_5.Vector, EndPoint=vector_xyz_3.Vector)
circle = Circle(Plane=vector_xyz_7.Vector, Radius=Slider(0.5, range=0..1))
polyline = PolyLine(Vertices=vector_xyz_7.Vector, Closed=Toggle(False))
vector_xyz_8 = VectorXYZ(XComponent=0, YComponent=Slider(-50, range=-100..100), ZComponent=0)  # -> Vector, Length
move_3 = Move(Geometry=line, Motion=vector_xyz_8.Vector)  # -> Geometry, Transform
move_4 = Move(Geometry=line_2, Motion=vector_xyz_8.Vector)  # -> Geometry, Transform
move_5 = Move(Geometry=circle, Motion=vector_xyz_8.Vector)  # -> Geometry, Transform
move_6 = Move(Geometry=polyline, Motion=vector_xyz_8.Vector)  # -> Geometry, Transform
merge_7 = Merge(Data1=move_3.Geometry, Data2=move_4.Geometry)
merge_8 = Merge(Data1=move_5.Geometry, Data2=move_6.Geometry)
end_points = EndPoints(Curve=move_4.Geometry)  # -> Start, End
end_points_2 = EndPoints(Curve=move_3.Geometry)  # -> Start, End
colour_swatch = ColourSwatch(SwatchColor=RGB(168, 168, 168))
number_slider_3 = Slider(1, range=0..10)
screen_oriented_text_2 = ScreenOrientedText(
    Text=evaluate,
    Justification=7,
    Location=end_points.Start,
    SizeFactor=number_slider_3,
    Color=colour_swatch,
    Depth=0,
    Absolute=False)
screen_oriented_text_3 = ScreenOrientedText(
    Text=multiplication,
    Justification=7,
    Location=end_points_2.End,
    SizeFactor=number_slider_3,
    Color=colour_swatch,
    Depth=0,
    Absolute=False)
custom_preview_2 = CustomPreview(Geometry=merge_7, Material=colour_swatch)
custom_preview_3 = CustomPreview(Geometry=merge_8, Material=ColourSwatch(SwatchColor=RGB(222, 0, 0)))
