# Grasshopper definition 0_origami.gh (Grasshopper 1.0.7)

w = Slider(10, range=0..20)
h = Slider(5, range=0..10)
pt = Slider(0.35, range=-1..2)
numdiv = Slider(18, range=0..100)
numcen = Slider(2, range=2..20)
offset = Slider(0.6, range=0..1)
ghpython_script = GhPythonScript(w=w, h=h, ptCen=pt, numDiv=numdiv, numCen=numcen, offset=offset)  # -> out, rec, mountain, valley, boundary; inputs numDiv: Int32, numCen: Int32
# ---------- ghpython_script: Python ----------
__author__ = "kalunkuo"
__version__ = "2023.03.23"

import rhinoscriptsyntax as rs
import math
import Rhino as rc

# origin point
ptOrigin = (0, 0, 0)
rec = rs.AddRectangle(ptOrigin, w, h)

# four corners
pt_topL = rs.AddPoint(0, h, 0)
pt_bottomL = rs.AddPoint(0, 0, 0)
pt_TopR = rs.AddPoint(w, h, 0)
pt_bottomR = rs.AddPoint(w, 0, 0)

lineTop = rs.AddLine(pt_topL, pt_TopR)
lineLeft = rs.AddLine(pt_topL, pt_bottomL)

# two center point
disCen = w * ptCen
pt_bottomCen = rs.AddPoint(disCen, 0, 0)
pt_topCen = rs.AddPoint(w-disCen, h, 0)

line_dia = rs.AddLine(pt_bottomCen, pt_topCen)
ptMid = rs.CurveMidPoint(line_dia)

angle = rs.Angle(pt_bottomCen, pt_topCen)[0]
angleInit = angle
print("angle is: ", angle, angleInit)

angleDiv = ( (180 - angle) / numDiv)
angleDiv2 = angleDiv*2
print("angleDiv is: ", angleDiv, angleDiv2)

disDia = rs.Distance(pt_bottomCen, pt_topCen)


# radius collection
radius = []
r1 = (disDia - numCen*offset) / 2

for i in range(numCen+1):
    radiusTemp = r1 + offset*i
    radius.append(radiusTemp)
print("radius is: ", radius)

listMountain = []
listValley = []
test = []

foldRound = int(numDiv/2)

for i in range(numDiv):
    angleTemp = math.radians(angleInit + angleDiv*i)
    angleTemp2 = math.radians(angleInit + angleDiv*(i+1))
#    print(angleTemp, angleTemp2, angleTemp3)
    
    ptOrinCorr = rs.PointCoordinates(pt_bottomCen)
    
    for j in range(len(radius)-1):
        
        if (i%2 == 0):
            ptTemp = rs.AddPoint(radius[j] * math.cos(angleTemp) + ptOrinCorr[0], radius[j] * math.sin(angleTemp) + ptOrinCorr[1], 0)
            ptTemp2 = rs.AddPoint(radius[j+1] * math.cos(angleTemp2) + ptOrinCorr[0], radius[j+1] * math.sin(angleTemp2) + ptOrinCorr[1], 0)
            ptTemp3 = rs.AddPoint(radius[j+1] * math.cos(angleTemp) + ptOrinCorr[0], radius[j+1] * math.sin(angleTemp) + ptOrinCorr[1], 0)
            
            lineTemp1 = rs.AddLine(ptTemp, ptTemp2)
            if (j%2 == 0):
                listMountain.append(lineTemp1)
            else:
                listValley.append(lineTemp1)
            if (j == 0):
                lineTemp2 = rs.AddLine(ptTemp, pt_bottomCen)
                listValley.append(lineTemp2)
                
            lineTemp3 = rs.AddLine(ptTemp, ptTemp3)
            if (j != 0 and j%2 != 0):
                if (j != len(radius)-2):
                    listValley.append(lineTemp3)
                else:
                    ptTemp4 = rs.LineLineIntersection(lineTop, lineTemp3)[0]
                    ptTemp5 = rs.LineLineIntersection(lineLeft, lineTemp3)[0]
                    
                    lineTemp4 = rs.AddLine(ptTemp, ptTemp4)
                    lineTemp5 = rs.AddLine(ptTemp, ptTemp5)
                    length4 = rs.CurveLength(lineTemp4)
                    length5 = rs.CurveLength(lineTemp5)
                    
                    if (length4 < length5):
                        listValley.append(lineTemp4)
                    else:
                        listValley.append(lineTemp5)
            else: 
                if (j <len(radius)-2):
                    listMountain.append(lineTemp3)
                else:
                    ptTemp4 = rs.LineLineIntersection(lineTop, lineTemp3)[0]
                    ptTemp5 = rs.LineLineIntersection(lineLeft, lineTemp3)[0]
                    
                    lineTemp4 = rs.AddLine(ptTemp, ptTemp4)
                    lineTemp5 = rs.AddLine(ptTemp, ptTemp5)
                    length4 = rs.CurveLength(lineTemp4)
                    length5 = rs.CurveLength(lineTemp5)
                    
                    if (length4 < length5):
                        listMountain.append(lineTemp4)
                    else:
                        listMountain.append(lineTemp5)
        else:
            ptTemp = rs.AddPoint(radius[j+1] * math.cos(angleTemp) + ptOrinCorr[0], radius[j+1] * math.sin(angleTemp) + ptOrinCorr[1], 0)
            ptTemp2 = rs.AddPoint(radius[j] * math.cos(angleTemp2) + ptOrinCorr[0], radius[j] * math.sin(angleTemp2) + ptOrinCorr[1], 0)
            
            lineTemp1 = rs.AddLine(ptTemp, ptTemp2)
            if (j%2 == 0):
                listMountain.append(lineTemp1)
            else:
                listValley.append(lineTemp1)
            
            if (j == 0):
                lineTemp2 = rs.AddLine(ptTemp, pt_bottomCen)
                listMountain.append(lineTemp2)
                
                ptTemp3 = rs.AddPoint(radius[j+2] * math.cos(angleTemp) + ptOrinCorr[0], radius[j+2] * math.sin(angleTemp) + ptOrinCorr[1], 0)
                lineTemp3 = rs.AddLine(ptTemp, ptTemp3)
                listValley.append(lineTemp3)
                
            if (j != 0 and j < len(radius)-2):
                ptTemp3 = rs.AddPoint(radius[j+2] * math.cos(angleTemp) + ptOrinCorr[0], radius[j+2] * math.sin(angleTemp) + ptOrinCorr[1], 0)
                lineTemp3 = rs.AddLine(ptTemp, ptTemp3)
                if( j%2 == 0):
                    listValley.append(lineTemp3)
                else:
                    listMountain.append(lineTemp3)
            if (j == len(radius)-2):
                radiusNext = radius[j+1] + radius[j+1] - radius[j]
                ptTemp3 = rs.AddPoint(radiusNext* math.cos(angleTemp) + ptOrinCorr[0], radiusNext * math.sin(angleTemp) + ptOrinCorr[1], 0)
                lineTemp3 = rs.AddLine(ptTemp, ptTemp3)
                test.append(lineTemp3)
           
                ptTemp4 = rs.LineLineIntersection(lineTop, lineTemp3)[0]
                ptTemp5 = rs.LineLineIntersection(lineLeft, lineTemp3)[0]
                
                lineTemp4 = rs.AddLine(ptTemp, ptTemp4)
                lineTemp5 = rs.AddLine(ptTemp, ptTemp5)
                length4 = rs.CurveLength(lineTemp4)
                length5 = rs.CurveLength(lineTemp5)
                
                if (length4 < length5):
                    if ((j+1)%2 == 0):
                        listMountain.append(lineTemp4)
                    else:
                        listValley.append(lineTemp4)
                else:
                    if ((j+1)%2 == 0):
                        listMountain.append(lineTemp5)
                    else:
                        listValley.append(lineTemp5)



mountain = listMountain
valley = listValley
# ---------- end ghpython_script ----------
curve = Curve(ghpython_script.rec)
panel = Panel(ghpython_script.out)

geometry = Geometry(ghpython_script.mountain)
custom_preview = CustomPreview(Geometry=geometry, Material=ColourSwatch(SwatchColor=RGB(237, 36, 36)))

geometry_2 = Geometry(ghpython_script.valley)
custom_preview_2 = CustomPreview(Geometry=geometry_2, Material=ColourSwatch(SwatchColor=RGB(0, 8, 255)))
